# Grasshopper definition Artwork_Montry_001.gh (Grasshopper 1.0.8)
# plug-ins: RhinoCodePluginGH

file_path = FilePath("C:\Users\Sculpture\Desktop\circle_screenshot3.jpg")
panel = Panel(file_path)
artwork_montry_001 = Script(imgPath=file_path)  # -> out, A; inputs imgPath: String
# ---------- artwork_montry_001: C# ----------
// Grasshopper Script Instance
//#! csharp
using System;
using System.Collections;
using System.Collections.Generic;
using System.Drawing;
using System.IO;

using Rhino;
using Rhino.Geometry;

using Grasshopper;
using Grasshopper.Kernel;
using Grasshopper.Kernel.Data;
using Grasshopper.Kernel.Types;

public class Script_Instance : GH_ScriptInstance
{
  private void RunScript(string imgPath, ref object A)
  {
    if (!File.Exists(imgPath))
    {
      Component.AddRuntimeMessage(GH_RuntimeMessageLevel.Error, "File does not exist.");
      return;
    }

    Bitmap image = null;
    try
    {
      // Ensure the file at the path is an image
      image = new Bitmap(imgPath);
    }
    catch (ArgumentException e)
    {
      Component.AddRuntimeMessage(GH_RuntimeMessageLevel.Error, "The file is not a valid image. Error: " + e.Message);
      return;
    }

    // Initialize the mesh
    Mesh mesh = new Mesh();

    // Process the image and create vertices for the mesh
    for(int y = 0; y < image.Height; y++)
    {
      for(int x = 0; x < image.Width; x++)
      {
        // Get the pixel's brightness (0 for black, 1 for white)
        double brightness = image.GetPixel(x, y).GetBrightness();
        // Use brightness to set the Z-coordinate
        Point3d vertex = new Point3d(x, y, brightness * 10); // Scale the Z-coordinate by 10
        mesh.Vertices.Add(vertex);
      }
    }

    // Create faces for the mesh
    for(int y = 0; y < image.Height - 1; y++)
    {
      for(int x = 0; x < image.Width - 1; x++)
      {
        int lowerLeft = x + y * image.Width;
        int lowerRight = (x + 1) + y * image.Width;
        int upperLeft = x + (y + 1) * image.Width;
        int upperRight = (x + 1) + (y + 1) * image.Width;

        // Create two faces for each quad
        mesh.Faces.AddFace(lowerLeft, lowerRight, upperRight, upperLeft);
      }
    }

    // Assign the mesh to the output parameter
    A = mesh;

    // Compute the normals for the mesh
    mesh.Normals.ComputeNormals();
    mesh.Compact();

    // Dispose of the Bitmap object
    image.Dispose();
  }

  // <Custom additional code> 

  // </Custom additional code> 
}
# ---------- end artwork_montry_001 ----------
geometry = Geometry(artwork_montry_001.A)
param_viewer = ParamViewer(geometry)
panel_2 = Panel(geometry)
# Created at
# Wickerson Studios
# copyright 2024
# download all materials at
# www.wickersonstudios.com
panel_3 = Panel(artwork_montry_001.out)
# Artwork Montry from
# gpt Image Prompt
file_path_2 = FilePath("C:\Users\Sculpture\Desktop\circle_screenshot3.jpg")
panel_4 = Panel(file_path_2)
artwork_montry_001_2 = Script(imgPath=file_path_2, zFactor=Slider(12.28, range=0..100))  # -> out, A; inputs imgPath: String, zFactor: Double
# ---------- artwork_montry_001_2: C# ----------
// Grasshopper Script Instance
//#! csharp
using System;
using System.Drawing; // For Bitmap processing
using System.IO; // For file handling

using Rhino.Geometry; // For geometric computations

// You might need to ensure that the Grasshopper.dll is referenced in your script for these to work
using Grasshopper; // For Grasshopper methods and properties
using Grasshopper.Kernel; // For Grasshopper kernel methods

public class Script_Instance : GH_ScriptInstance
{
  private void RunScript(string imgPath, double zFactor, ref object A)
  {
    // Check if the file exists at the given path
    if (!File.Exists(imgPath))
    {
      this.Component.AddRuntimeMessage(GH_RuntimeMessageLevel.Error, "File does not exist. Please check the path.");
      return;
    }

    Bitmap image = null;
    try
    {
      // Load the image from the path
      image = new Bitmap(imgPath);
    }
    catch (ArgumentException e)
    {
      this.Component.AddRuntimeMessage(GH_RuntimeMessageLevel.Error, "The file is not a valid image: " + e.Message);
      return;
    }

    // Initialize a new mesh
    Mesh mesh = new Mesh();

    // Loop through each pixel in the image to create vertices
    for (int y = 0; y < image.Height; y++)
    {
      for (int x = 0; x < image.Width; x++)
      {
        // Retrieve the pixel color
        Color pixelColor = image.GetPixel(x, y);
        // Convert the pixel color to a brightness value
        double brightness = pixelColor.GetBrightness();
        // Use the brightness to modulate the Z coordinate, amplified by the zFactor
        Point3d vertex = new Point3d(x, image.Height - y, brightness * zFactor);
        mesh.Vertices.Add(vertex);
      }
    }

    // Generate faces for the mesh
    for (int y = 0; y < image.Height - 1; y++)
    {
      for (int x = 0; x < image.Width - 1; x++)
      {
        int lowerLeft = x + y * image.Width;
        int lowerRight = (x + 1) + y * image.Width;
        int upperLeft = x + (y + 1) * image.Width;
        int upperRight = (x + 1) + (y + 1) * image.Width;
        // Add two faces (as triangles) for each pixel (except for the border pixels)
        mesh.Faces.AddFace(lowerLeft, lowerRight, upperRight);
        mesh.Faces.AddFace(lowerLeft, upperRight, upperLeft);
      }
    }

    // Compute the normals for the mesh
    mesh.Normals.ComputeNormals();
    // Optimize the mesh
    mesh.Compact();

    // Assign the mesh to the output
    A = mesh;

    // Dispose of the bitmap to free resources
    image.Dispose();
  }
  
  // <Custom additional code> 
  // </Custom additional code> 
}
# ---------- end artwork_montry_001_2 ----------
geometry_2 = Geometry(artwork_montry_001_2.A)
param_viewer_2 = ParamViewer(geometry_2)
panel_5 = Panel(geometry_2)
panel_6 = Panel(artwork_montry_001_2.out)
