# Grasshopper definition CALCULUS_coordinateGraphs_003.gh (Grasshopper 1.0.8)
# plug-ins: RhinoCodePluginGH

construct_domain = ConstructDomain(DomainStart=Slider(-10, range=-10..10), DomainEnd=Slider(10, range=-10..10))
construct_domain_2 = ConstructDomain(DomainStart=Slider(-10, range=-10..10), DomainEnd=Slider(10, range=-10..10))
# Created at
# Wickerson Studios
# copyright 2024
# download all materials at
# www.wickersonstudios.com
# Visualizing Calculus Algorithm
# from
# gpt Image Prompt
range = Range(Domain=construct_domain, Steps=10)
range_2 = Range(Domain=construct_domain_2, Steps=10)
absolutevalue_002 = Script(xRange=range, yRange=range_2, numPointsU=Slider(10, range=3..10), numPointsV=Slider(10, range=3..10))  # -> out, A, B; inputs xRange: list of Double, yRange: list of Double, numPointsU: Int32, numPointsV: Int32
# ---------- absolutevalue_002: C# ----------
using System;
using System.Collections.Generic;
using System.Drawing;

using Rhino;
using Rhino.Geometry;

using Grasshopper;
using Grasshopper.Kernel;
using Grasshopper.Kernel.Data;
using Grasshopper.Kernel.Types;

public class Script_Instance : GH_ScriptInstance
{
    private void RunScript(
	IList<double> xRange,
	IList<double> yRange,
	int numPointsU,
	int numPointsV,
	ref object A,
	ref object B)
    {
        // Initialize output
        NurbsSurface nurbsSurface = null;
        List<Point3d> points = new List<Point3d>();

        // Handling invalid range inputs
        if (xRange.Count < 2 || yRange.Count < 2)
        {
            A = null;
            B = null;
            return;
        }

        // Calculating steps in each direction
        double xStep = (xRange[1] - xRange[0]) / (numPointsU - 1);
        double yStep = (yRange[1] - yRange[0]) / (numPointsV - 1);

        // Create points on the surface
        for (int i = 0; i < numPointsU; i++)
        {
            double x = xRange[0] + i * xStep;
            for (int j = 0; j < numPointsV; j++)
            {
                double y = yRange[0] + j * yStep;
                double z = Math.Abs(x) + Math.Abs(y); // Calculating z based on absolute values of x and y
                points.Add(new Point3d(x, y, z));
            }
        }

        // Create a NURBS surface from the points
        nurbsSurface = NurbsSurface.CreateFromPoints(points, numPointsU, numPointsV, 3, 3);

        // Output the surface and control points separately
        A = nurbsSurface;
        B = points;
    }

    // <Custom additional code> 
}
# ---------- end absolutevalue_002 ----------
geometry = Geometry(absolutevalue_002.A)
geometry_2 = Geometry(absolutevalue_002.B)
panel = Panel(absolutevalue_002.out)
param_viewer = ParamViewer(geometry)
panel_2 = Panel([geometry, geometry_2])
