# Grasshopper definition CALCULUS_interval_001.gh (Grasshopper 1.0.8)
# plug-ins: RhinoCodePluginGH, Kangaroo2 Components

# Created at
# Wickerson Studios
# copyright 2024
# download all materials at
# www.wickersonstudios.com
# Parametric Pattern Algorithm from
# gpt Image Prompt
number_slider = Slider(5, range=1..5)
pattern_010 = Script(
    hexRadius=number_slider,
    gridWidth=Slider(3, range=0..10),
    gridHeight=Slider(3, range=0..10),
    baseHeight=Slider(5, range=0..5),
    complexity=Slider(5, range=0..5),
    frequency=Slider(0, range=0..5),
    layerHeight=Slider(5, range=1..5),
    numberOfLayers=Slider(4, range=0..10))  # -> out, A; inputs hexRadius: Double, gridWidth: Int32, gridHeight: Int32, baseHeight: Double, complexity: Double, frequency: Double, layerHeight: Double, numberOfLayers: Int32
# ---------- pattern_010: C# ----------
// Grasshopper Script Instance
// #! csharp
using System;
using System.Collections.Generic;
using Rhino.Geometry;
using Grasshopper.Kernel.Types;

public class Script_Instance : GH_ScriptInstance
{
  private void RunScript(
	double hexRadius,
	int gridWidth,
	int gridHeight,
	double baseHeight,
	double complexity,
	double frequency,
	double layerHeight,
	int numberOfLayers,
	ref object A)
  {
    // List to store the resulting curves
    var complexPatternCurves = new List<GH_Curve>();

    // Function to add complexity using trigonometric polynomials
    Func<double, double, double> trigPoly = (x, y) =>
    {
      return Math.Sin(frequency * x) * Math.Cos(frequency * y) * complexity;
    };

    for (int k = 0; k < numberOfLayers; k++) // Loop through each layer
    {
      for (int i = 0; i < gridWidth; ++i)
      {
        for (int j = 0; j < gridHeight; ++j)
        {
          // Calculate the position of the current cell
          double x = i * hexRadius * 1.5;
          double y = j * Math.Sqrt(3) * hexRadius;
          if (i % 2 == 1) y += Math.Sqrt(3) * hexRadius / 2; // Offset every other row
          
          // Calculate Z-offset based on the current layer and local complexity
          double zOffset = layerHeight * k + trigPoly(x, y);

          // Create the geometry at the calculated position
          Point3d center = new Point3d(x, y, zOffset);
          List<Curve> cellCurves = CreateComplexGeometry(hexRadius, center, baseHeight);

          // Add the geometry's curves to the list
          foreach (Curve curve in cellCurves)
          {
            complexPatternCurves.Add(new GH_Curve(curve));
          }
        }
      }
    }

    // Output the curves
    A = complexPatternCurves;
  }

  // <Custom additional code>
  private List<Curve> CreateComplexGeometry(double radius, Point3d center, double height)
  {
    // Create complex geometry with a mix of different shapes
    List<Curve> edges = new List<Curve>();

    // Base hexagon
    Curve hexagon = CreateHexagon(radius, center);

    // Deform hexagon with a sine wave along Z-axis
    Curve[] segments = hexagon.DuplicateSegments();
    for (int i = 0; i < segments.Length; i++)
    {
      var segment = segments[i];
      var midPoint = segment.PointAtNormalizedLength(0.5);
      midPoint.Z += Math.Sin(i) * height; // Apply sine wave deformation
      var points = new List<Point3d> { segment.PointAtStart, midPoint, segment.PointAtEnd };
      Curve deformedSegment = Curve.CreateInterpolatedCurve(points, 3);
      edges.Add(deformedSegment);
    }

    return edges;
  }

  private Curve CreateHexagon(double radius, Point3d center)
  {
    // Create a flat hexagon centered at a given point
    Polyline hex = new Polyline(7);
    for (int i = 0; i < 6; i++)
    {
      double angle = Math.PI / 3 * i;
      hex.Add(center + new Vector3d(radius * Math.Cos(angle), radius * Math.Sin(angle), 0));
    }
    hex.Add(hex[0]); // Close the hexagon by adding the first point at the end

    return hex.ToNurbsCurve();
  }
  // </Custom additional code>
}
# ---------- end pattern_010 ----------
geometry = Geometry(pattern_010.A)
panel = Panel(pattern_010.out)
param_viewer = ParamViewer(geometry)
panel_2 = Panel(geometry)
multipipe = MultiPipe(Curves=pattern_010.A, NodeSize=0.5, EndOffset=1, StrutSize=1, Segment=0, KinkAngle=0.6, CubeFit=0, Caps=0)
