# Grasshopper definition algorithms_fractal_001.gh (Grasshopper 1.0.8)
# plug-ins: RhinoCodePluginGH

number_slider = Slider(2, range=0..10)
number_slider_2 = Slider(2.25, range=1..5)
construct_point = ConstructPoint(XCoordinate=0, YCoordinate=0, ZCoordinate=0)
construct_point_2 = ConstructPoint(XCoordinate=0, YCoordinate=0, ZCoordinate=0)
construct_point_3 = ConstructPoint(XCoordinate=0, YCoordinate=0, ZCoordinate=0)
mesh_box = MeshBox(
    Base={Plane=PlaneXY(0, 0, 0), X=Domain(-10, 10), Y=Domain(-10, 10), Z=Domain(-10, 10)},
    XCount=number_slider,
    YCount=number_slider,
    ZCount=number_slider)
milestree_003 = Script(
    basePoint=construct_point,
    trunkLength=Slider(2.07, range=0..10),
    branchAngle=Slider(0.36, range=0..2),
    recursionLimit=Slider(4, range=1..5),
    branchScaling=Slider(1.19, range=0.5..3))  # -> out, TreeCurves; inputs basePoint: Point3d, trunkLength: Double, branchAngle: Double, recursionLimit: Int32, branchScaling: Double
# ---------- milestree_003: C# ----------
using System;
using System.Collections.Generic;
using Rhino.Geometry;

public class Script_Instance : GH_ScriptInstance
{
  private void RunScript(Point3d basePoint, double trunkLength, double branchAngle, int recursionLimit, double branchScaling, ref object TreeCurves)
  {
    // Verification to maintain system performance
    if (recursionLimit > 10)
    {
      recursionLimit = 10;
      Print("Dave, to ensure the system's responsiveness, I've kept the recursion limit to a maximum of 10.");
    }

    // Initialize the list to hold the branch curves
    List<Curve> fractalBranches = new List<Curve>();

    // Begin the recursive branching process with trigonometric variations
    GenerateFractalBranches(basePoint, trunkLength, Vector3d.ZAxis, branchAngle, recursionLimit, branchScaling, 0, fractalBranches);

    // Set the output parameter to the resulting list of curves
    TreeCurves = fractalBranches;
  }

  // Recursive method to generate the fractal branches with trigonometric modulation
  private void GenerateFractalBranches(Point3d start, double length, Vector3d direction, double baseAngle, int depth, double scale, double phase, List<Curve> branches)
  {
    if (depth == 0)
    {
      return;
    }

    // Calculate the funky angle modulation using a trigonometric function
    double angle = baseAngle + Math.Sin(phase) * baseAngle * 0.5; // Modulate the angle with a sine function for funkiness
    phase += Math.PI / 4; // Increment phase to vary the modulation

    // Create the initial branch
    Point3d end = start + (direction * length);
    LineCurve branch = new LineCurve(start, end);
    branches.Add(branch);

    // Calculate the direction for the next branches with added funkiness
    Vector3d leftDirection = direction;
    leftDirection.Rotate(-angle, Vector3d.CrossProduct(direction, Vector3d.XAxis));
    Vector3d rightDirection = direction;
    rightDirection.Rotate(angle, Vector3d.CrossProduct(direction, Vector3d.XAxis));

    // Determine the starting point for the next branches
    Point3d nextStart = end;

    // Calculate the length for the next branches
    double nextLength = length * scale;

    // Recursively create the left and right branches
    GenerateFractalBranches(nextStart, nextLength, leftDirection, baseAngle, depth - 1, scale, phase, branches);
    GenerateFractalBranches(nextStart, nextLength, rightDirection, baseAngle, depth - 1, scale, phase, branches);
  }

  // <Custom additional code>
}
# ---------- end milestree_003 ----------
milestree_003_2 = Script(
    basePoint=construct_point_2,
    trunkLength=Slider(1.53, range=0..10),
    branchAngle=Slider(0.47, range=0..2),
    recursionLimit=Slider(4, range=1..5),
    branchScaling=Slider(1.36, range=0.5..3))  # -> out, TreeCurves; inputs basePoint: Point3d, trunkLength: Double, branchAngle: Double, recursionLimit: Int32, branchScaling: Double
# ---------- milestree_003_2: C# ----------
using System;
using System.Collections.Generic;
using Rhino.Geometry;

public class Script_Instance : GH_ScriptInstance
{
  private void RunScript(
	Point3d basePoint,
	double trunkLength,
	double branchAngle,
	int recursionLimit,
	double branchScaling,
	ref object TreeCurves)
  {
    // Verify that the recursion limit is not set to a level that would cause performance issues
    if (recursionLimit > 10)
    {
      recursionLimit = 10;
      Print("I'm sorry, Dave. I'm afraid I've adjusted the recursion limit to prevent performance issues.");
    }

    // Initialize the list to hold the branch curves
    List<Curve> fractalBranches = new List<Curve>();

    // Begin the recursive branching process
    GenerateFractalBranches(basePoint, trunkLength, Vector3d.ZAxis, branchAngle, recursionLimit, branchScaling, fractalBranches);

    // Set the output parameter to the resulting list of curves
    TreeCurves = fractalBranches;
  }

  // Recursive method to generate the fractal branches
  private void GenerateFractalBranches(Point3d start, double length, Vector3d direction, double angle, int depth, double scale, List<Curve> branches)
  {
    if (depth == 0)
    {
      return;
    }

    // Create the initial branch
    Point3d end = start + (direction * length);
    LineCurve branch = new LineCurve(start, end);
    branches.Add(branch);

    // Calculate the direction for the next branches
    Vector3d leftDirection = direction;
    leftDirection.Rotate(-angle, Vector3d.CrossProduct(direction, Vector3d.XAxis));
    Vector3d rightDirection = direction;
    rightDirection.Rotate(angle, Vector3d.CrossProduct(direction, Vector3d.XAxis));

    // Determine the starting point for the next branches
    Point3d nextStart = end;

    // Calculate the length for the next branches
    double nextLength = length * scale;

    // Recursively create the left and right branches
    GenerateFractalBranches(nextStart, nextLength, leftDirection, angle, depth - 1, scale, branches);
    GenerateFractalBranches(nextStart, nextLength, rightDirection, angle, depth - 1, scale, branches);
  }

  // <Custom additional code>
}
# ---------- end milestree_003_2 ----------
milestree_002 = Script(
    basePoint=construct_point_3,
    trunkLength=Slider(2.19, range=0..10),
    branchAngle=Slider(0.56, range=0..2),
    recursionLimit=Slider(4, range=1..5),
    branchScaling=Slider(1.36, range=0.5..3))  # -> out, TreeCurves; inputs basePoint: Point3d, trunkLength: Double, branchAngle: Double, recursionLimit: Int32, branchScaling: Double; same code as milestree_003_2
milestree_001 = Script()  # -> out, A
# ---------- milestree_001: C# ----------
using System;
using System.Collections.Generic;
using Rhino.Geometry;

public class Script_Instance : GH_ScriptInstance
{
  private void RunScript(object x, object y, ref object A)
  {
    // Parameters for the tree
    Point3d startPoint = new Point3d(0, 0, 0); // Starting point of the tree
    double initialLength = 10.0; // Initial length of the branch
    double angle = Math.PI / 4; // Angle between branches
    int recursionDepth = 5; // Depth of recursion
    double lengthFactor = 0.7; // Length factor for the branches

    // List to hold all the curves
    List<Curve> treeCurves = new List<Curve>();

    // Start the recursion
    GenerateFractalTree(startPoint, initialLength, Vector3d.ZAxis, angle, recursionDepth, lengthFactor, treeCurves);

    // Set the output
    A = treeCurves;
  }

  // Method to recursively generate the tree
  private void GenerateFractalTree(Point3d start, double length, Vector3d direction, double angle, int depth, double lengthFactor, List<Curve> treeCurves)
  {
    if (depth == 0)
    {
      return;
    }

    // Calculate the end point of the branch
    Point3d end = start + (direction * length);
    LineCurve branch = new LineCurve(start, end);
    treeCurves.Add(branch);

    // Reduce the length for the next branches
    double newLength = length * lengthFactor;

    // Calculate the direction of the two new branches
    Vector3d leftDirection = direction;
    leftDirection.Rotate(-angle, Vector3d.CrossProduct(direction, Vector3d.XAxis));
    Vector3d rightDirection = direction;
    rightDirection.Rotate(angle, Vector3d.CrossProduct(direction, Vector3d.XAxis));

    // Recursively create the left and right branches
    GenerateFractalTree(end, newLength, leftDirection, angle, depth - 1, lengthFactor, treeCurves);
    GenerateFractalTree(end, newLength, rightDirection, angle, depth - 1, lengthFactor, treeCurves);
  }
}
# ---------- end milestree_001 ----------
geometry = Geometry(milestree_003.TreeCurves)
geometry_2 = Geometry(milestree_003_2.TreeCurves)
geometry_3 = Geometry(milestree_001.A)
geometry_4 = Geometry(milestree_002.TreeCurves)
param_viewer = ParamViewer(geometry)
panel = Panel(geometry)
param_viewer_2 = ParamViewer(geometry_2)
panel_2 = Panel(milestree_003.out)
panel_3 = Panel(geometry_2)
panel_4 = Panel(milestree_003_2.out)
param_viewer_3 = ParamViewer(geometry_3)
param_viewer_4 = ParamViewer(geometry_4)
panel_5 = Panel(geometry_3)
panel_6 = Panel(geometry_4)
# Created at
# Wickerson Studios
# copyright 2024
# download all materials at
# www.wickersonstudios.com
# Parametric Lattice Algorithm from
# gpt Image Prompt
panel_7 = Panel(milestree_001.out)
panel_8 = Panel(milestree_002.out)
