# Grasshopper definition algorithms_interlocking_001.gh (Grasshopper 1.0.8)
# plug-ins: RhinoCodePluginGH

interlocking_002 = Script()  # -> out, A
# ---------- interlocking_002: C# ----------
//Grasshopper Script Instance
//#! csharp
using System;
using System.Collections.Generic;
using System.Drawing;

using Rhino;
using Rhino.Geometry;

using Grasshopper;
using Grasshopper.Kernel;
using Grasshopper.Kernel.Data;
using Grasshopper.Kernel.Types;

public class Script_Instance : GH_ScriptInstance
{
  private void RunScript(object x, object y, ref object A)
  {
    // List to store our mesh geometries
    var geometries = new List<Mesh>();

    // Call our custom function to create the interlocking geometries
    CreateInterlockingGeometry(ref geometries);

    // Assign the output parameter to the geometries list
    A = geometries;
  }

  // <Custom additional code> 

  // This function will create a pattern of interlocking hexagonal and pentagonal prisms
  private void CreateInterlockingGeometry(ref List<Mesh> geometries)
  {
    // Define the radius for the hexagons and pentagons
    double radius = 1.0;
    double extrusionHeight = 1.0; // Define the height of the extrusion
    int gridWidth = 10; // Define how wide the grid should be
    int gridHeight = 10; // Define how high the grid should be

    // Variables to help with positioning
    double hexHeight = Math.Sqrt(3) * radius;
    double hexWidth = 2 * radius;
    Point3d origin = new Point3d(0, 0, 0);

    // Create a grid of hexagons and pentagons
    for (int i = 0; i < gridWidth; i++)
    {
      for (int j = 0; j < gridHeight; j++)
      {
        // Calculate the position of the current cell
        double xCoord = i * (hexWidth * 0.75);
        double yCoord = j * hexHeight + (i % 2 == 0 ? 0 : -hexHeight / 2);

        // Create the hexagon prism
        Mesh hexMesh = CreatePrismMesh(origin + new Point3d(xCoord, yCoord, 0), radius, 6, extrusionHeight);
        geometries.Add(hexMesh);

        // Create the pentagon prism if we're on an even column, to keep the pattern
        if (i % 2 == 0)
        {
          Mesh pentMesh = CreatePrismMesh(origin + new Point3d(xCoord + hexWidth / 2, yCoord - hexHeight / 2, 0), radius, 5, extrusionHeight);
          geometries.Add(pentMesh);
        }
      }
    }
  }

  // Helper function to create a single prism mesh
  private Mesh CreatePrismMesh(Point3d center, double radius, int sides, double height)
  {
    Mesh prism = new Mesh();

    // Angle increment per side
    double angleInc = Math.PI * 2 / sides;

    // Create the base and top center points
    Point3d baseCenter = new Point3d(center.X, center.Y, center.Z);
    Point3d topCenter = new Point3d(center.X, center.Y, center.Z + height);

    // Add the center points for base and top to the mesh vertices
    prism.Vertices.Add(baseCenter); // Central vertex for the base
    prism.Vertices.Add(topCenter); // Central vertex for the top

    // Create the base and top vertices
    for (int i = 0; i < sides; i++)
    {
      double angle = angleInc * i;
      double x = center.X + radius * Math.Cos(angle);
      double y = center.Y + radius * Math.Sin(angle);
      // Add base vertices
      prism.Vertices.Add(new Point3d(x, y, center.Z));
      // Add top vertices
      prism.Vertices.Add(new Point3d(x, y, center.Z + height));
    }

    // Add base and top faces by triangulation
    for (int i = 2; i < sides + 1; i++)
    {
      int next = i % sides + 2;
      // Add base faces (triangles)
      prism.Faces.AddFace(0, i, next);
      // Add top faces (triangles)
      prism.Faces.AddFace(1, next + sides, i + sides);
    }

    // Add side faces
    for (int i = 2; i < sides + 2; i++)
    {
      int next = i % sides + 2;
      prism.Faces.AddFace(i, next, next + sides, i + sides);
    }

    // Finalize the mesh
    prism.Normals.ComputeNormals();
    prism.Compact();

    return prism;
  }

  // </Custom additional code> 
}
# ---------- end interlocking_002 ----------
interlocking_001 = Script()  # -> out, A
# ---------- interlocking_001: C# ----------
//Grasshopper Script Instance
//#! csharp
using System;
using System.Collections.Generic;
using System.Drawing;

using Rhino;
using Rhino.Geometry;

using Grasshopper;
using Grasshopper.Kernel;
using Grasshopper.Kernel.Data;
using Grasshopper.Kernel.Types;

public class Script_Instance : GH_ScriptInstance
{
  private void RunScript(object x, object y, ref object A)
  {
    // List to store our mesh geometries
    var geometries = new List<Mesh>();

    // Call our custom function to create the interlocking geometries
    CreateInterlockingGeometry(ref geometries);

    // Assign the output parameter to the geometries list
    A = geometries;
  }

  // <Custom additional code> 

  // This function will create a simplified interlocking pattern
  private void CreateInterlockingGeometry(ref List<Mesh> geometries)
  {
    // Define the size of each cube and the number of cubes in each direction
    double cubeSize = 10.0;
    int cubeCount = 5;

    // Loop to create a grid of cubes
    for (int i = 0; i < cubeCount; i++)
    {
      for (int j = 0; j < cubeCount; j++)
      {
        for (int k = 0; k < cubeCount; k++)
        {
          // Calculate the center point of the current cube
          Point3d center = new Point3d(i * cubeSize * 2, j * cubeSize * 2, k * cubeSize * 2);
          // Create a single cube mesh
          Mesh cubeMesh = CreateCubeMesh(center, cubeSize);
          // Add the mesh to the geometries list
          geometries.Add(cubeMesh);
        }
      }
    }
  }

  // Helper function to create a single cube mesh
  private Mesh CreateCubeMesh(Point3d center, double size)
  {
    // Create a new mesh
    Mesh cube = new Mesh();

    // Calculate half size for convenience
    double halfSize = size / 2.0;

    // Create vertices
    var vertices = new List<Point3d>
    {
      new Point3d(center.X - halfSize, center.Y - halfSize, center.Z - halfSize),
      new Point3d(center.X + halfSize, center.Y - halfSize, center.Z - halfSize),
      new Point3d(center.X + halfSize, center.Y + halfSize, center.Z - halfSize),
      new Point3d(center.X - halfSize, center.Y + halfSize, center.Z - halfSize),
      new Point3d(center.X - halfSize, center.Y - halfSize, center.Z + halfSize),
      new Point3d(center.X + halfSize, center.Y - halfSize, center.Z + halfSize),
      new Point3d(center.X + halfSize, center.Y + halfSize, center.Z + halfSize),
      new Point3d(center.X - halfSize, center.Y + halfSize, center.Z + halfSize)
    };

    // Add vertices to the mesh
    foreach (var vertex in vertices)
    {
      cube.Vertices.Add(vertex);
    }

    // Define faces
    var faces = new List<MeshFace>
    {
      new MeshFace(0, 1, 2, 3),
      new MeshFace(4, 5, 6, 7),
      new MeshFace(0, 1, 5, 4),
      new MeshFace(1, 2, 6, 5),
      new MeshFace(2, 3, 7, 6),
      new MeshFace(3, 0, 4, 7)
    };

    // Add faces to the mesh
    foreach (var face in faces)
    {
      cube.Faces.AddFace(face);
    }

    // Finalize the mesh
    cube.Normals.ComputeNormals();
    cube.Compact();

    return cube;
  }
  // </Custom additional code> 
}
# ---------- end interlocking_001 ----------
geometry = Geometry(interlocking_002.A)
geometry_2 = Geometry(interlocking_001.A)
param_viewer = ParamViewer(geometry)
param_viewer_2 = ParamViewer(geometry_2)
panel = Panel(geometry)
panel_2 = Panel(interlocking_002.out)
panel_3 = Panel(geometry_2)
# Created at
# Wickerson Studios
# copyright 2024
# download all materials at
# www.wickersonstudios.com
panel_4 = Panel(interlocking_001.out)
# Parametric Interlocking Algorithm from
# gpt Image Prompt
number_slider = Slider(1.5, range=0..10)
interlocking_003 = Script(Radius=number_slider, Height=Slider(1.7, range=0..10), Width=Slider(8, range=0..10), Length=Slider(10, range=0..10))  # -> out, A; inputs Radius: Double, Height: Double, Width: Int32, Length: Int32
# ---------- interlocking_003: C# ----------
//Grasshopper Script Instance
//#! csharp
using System;
using System.Collections.Generic;
using System.Drawing;

using Rhino;
using Rhino.Geometry;

using Grasshopper;
using Grasshopper.Kernel;
using Grasshopper.Kernel.Data;
using Grasshopper.Kernel.Types;

public class Script_Instance : GH_ScriptInstance
{
  private void RunScript(
	double Radius,
	double Height,
	int Width,
	int Length,
	ref object A)
  {
    // List to store our mesh geometries
    var geometries = new List<Mesh>();

    // Call our custom function to create the interlocking geometries
    CreateInterlockingGeometry(ref geometries, Radius, Height, Width, Length);

    // Assign the output parameter to the geometries list
    A = geometries;
  }

  // <Custom additional code> 

  // This function will create a pattern of interlocking hexagonal and pentagonal prisms
  private void CreateInterlockingGeometry(ref List<Mesh> geometries, double radius, double height, int gridWidth, int gridHeight)
  {
    // Variables to help with positioning
    double hexHeight = Math.Sqrt(3) * radius;
    double hexWidth = 2 * radius;
    Point3d origin = new Point3d(0, 0, 0);

    // Create a grid of hexagons and pentagons
    for (int i = 0; i < gridWidth; i++)
    {
      for (int j = 0; j < gridHeight; j++)
      {
        // Calculate the position of the current cell
        double xCoord = i * (hexWidth * 0.75);
        double yCoord = j * hexHeight + (i % 2 == 0 ? 0 : -hexHeight / 2);

        // Create the hexagon prism
        Mesh hexMesh = CreatePrismMesh(origin + new Point3d(xCoord, yCoord, 0), radius, 6, height);
        geometries.Add(hexMesh);

        // Create the pentagon prism if we're on an even column, to keep the pattern
        if (i % 2 == 0)
        {
          Mesh pentMesh = CreatePrismMesh(origin + new Point3d(xCoord + hexWidth / 2, yCoord - hexHeight / 2, 0), radius, 5, height);
          geometries.Add(pentMesh);
        }
      }
    }
  }

  // Helper function to create a single prism mesh
  private Mesh CreatePrismMesh(Point3d center, double radius, int sides, double height)
  {
    Mesh prism = new Mesh();

    // Angle increment per side
    double angleInc = Math.PI * 2 / sides;

    // Create the base and top center points
    Point3d baseCenter = new Point3d(center.X, center.Y, center.Z);
    Point3d topCenter = new Point3d(center.X, center.Y, center.Z + height);

    // Add the center points for base and top to the mesh vertices
    prism.Vertices.Add(baseCenter); // Central vertex for the base
    prism.Vertices.Add(topCenter); // Central vertex for the top

    // Create the base and top vertices
    for (int i = 0; i < sides; i++)
    {
      double angle = angleInc * i;
      double x = center.X + radius * Math.Cos(angle);
      double y = center.Y + radius * Math.Sin(angle);
      // Add base vertices
      prism.Vertices.Add(new Point3d(x, y, center.Z));
      // Add top vertices
      prism.Vertices.Add(new Point3d(x, y, center.Z + height));
    }

    // Add base and top faces by triangulation
    for (int i = 2; i < sides + 1; i++)
    {
      int next = i % sides + 2;
      // Add base faces (triangles)
      prism.Faces.AddFace(0, i, next);
      // Add top faces (triangles)
      prism.Faces.AddFace(1, next + sides, i + sides);
    }

    // Add side faces
    for (int i = 2; i < sides + 2; i++)
    {
      int next = i % sides + 2;
      prism.Faces.AddFace(i, next, next + sides, i + sides);
    }

    // Finalize the mesh
    prism.Normals.ComputeNormals();
    prism.Compact();

    return prism;
  }

  // </Custom additional code> 
}
# ---------- end interlocking_003 ----------
geometry_3 = Geometry(interlocking_003.A)
panel_5 = Panel(interlocking_003.out)
param_viewer_3 = ParamViewer(geometry_3)
panel_6 = Panel(geometry_3)
