# Grasshopper definition algorithms_lattice_002.gh (Grasshopper 1.0.8)
# plug-ins: RhinoCodePluginGH

number_slider = Slider(2, range=0..10)  # disabled
number_slider_2 = Slider(3.6, range=1..5)  # disabled
number_slider_3 = Slider(3.6, range=1..5)  # disabled
number_slider_4 = Slider(2.99, range=1..5)  # disabled
number_slider_5 = Slider(2.25, range=1..5)  # disabled
mesh_box = MeshBox(
    Base={Plane=PlaneXY(0, 0, 0), X=Domain(-10, 10), Y=Domain(-10, 10), Z=Domain(-10, 10)},
    XCount=number_slider,
    YCount=number_slider,
    ZCount=number_slider)  # disabled
lattice_001 = Script(inputMesh=mesh_box, cellSize=number_slider_5)  # -> out, A; inputs inputMesh: Mesh, cellSize: Double; disabled
# ---------- lattice_001: C# ----------
// Grasshopper Script Instance
//#! csharp
using System;
using System.Collections.Generic;
using System.Drawing;

using Rhino;
using Rhino.Geometry;

using Grasshopper;
using Grasshopper.Kernel;
using Grasshopper.Kernel.Data;
using Grasshopper.Kernel.Types;

public class Script_Instance : GH_ScriptInstance
{
  private void RunScript(Mesh inputMesh, double cellSize, ref object A)
  {
    if (inputMesh == null || inputMesh.Faces.Count == 0)
    {
      A = null;
      Print("Invalid or empty mesh input.");
      return;
    }

    if (cellSize <= 0)
    {
      A = null;
      Print("Cell size must be greater than zero.");
      return;
    }

    A = CreateLattice(inputMesh, cellSize);
  }

  // <Custom additional code> 
  private List<Brep> CreateLattice(Mesh mesh, double cellSize)
  {
    List<Brep> latticeCells = new List<Brep>();
    BoundingBox bbox = mesh.GetBoundingBox(true);

    double xLength = bbox.Max.X - bbox.Min.X;
    double yLength = bbox.Max.Y - bbox.Min.Y;
    double zLength = bbox.Max.Z - bbox.Min.Z;

    int xCount = (int)(xLength / cellSize);
    int yCount = (int)(yLength / cellSize);
    int zCount = (int)(zLength / cellSize);

    for (int i = 0; i <= xCount; i++)
    {
      for (int j = 0; j <= yCount; j++)
      {
        for (int k = 0; k <= zCount; k++)
        {
          Point3d corner = new Point3d(bbox.Min.X + i * cellSize, bbox.Min.Y + j * cellSize, bbox.Min.Z + k * cellSize);
          Box cellBox = new Box(new Plane(corner, Vector3d.ZAxis), new Interval(0, cellSize), new Interval(0, cellSize), new Interval(0, cellSize));
          Brep cellBrep = cellBox.ToBrep();
          if (cellBrep != null)
          {
            latticeCells.Add(cellBrep);
          }
        }
      }
    }

    return latticeCells;
  }
}
# ---------- end lattice_001 ----------
lattice_003 = Script(cellSize=number_slider_2)  # -> out, A; inputs cellSize: Double; disabled
# ---------- lattice_003: C# ----------
// Grasshopper Script Instance
//#! csharp
using System;
using System.Collections.Generic;
using System.Drawing;

using Rhino;
using Rhino.Geometry;

using Grasshopper;
using Grasshopper.Kernel;
using Grasshopper.Kernel.Data;
using Grasshopper.Kernel.Types;

public class Script_Instance : GH_ScriptInstance
{
  private void RunScript(double cellSize, ref object A)
  {
    // Generate a funky mesh with trigonometric polynomial deformations
    Mesh funkyMesh = GenerateFunkyMesh();

    // Create a wiggly lattice around the modified mesh
    A = CreateWigglyLattice(funkyMesh, cellSize);
  }

  // Method to generate a mesh with trigonometric polynomial deformations
  private Mesh GenerateFunkyMesh()
  {
    int uDiv = 30; // divisions along the u axis
    int vDiv = 30; // divisions along the v axis
    double size = 20.0; // size of the grid

    Mesh mesh = new Mesh();
    for (int i = 0; i <= uDiv; i++)
    {
      for (int j = 0; j <= vDiv; j++)
      {
        double u = i / (double)uDiv;
        double v = j / (double)vDiv;
        double x = u * size;
        double y = v * size;
        double z = 5.0 * Math.Sin(2 * Math.PI * u) * Math.Cos(2 * Math.PI * v);
        mesh.Vertices.Add(new Point3d(x, y, z));
      }
    }

    // Add faces to the mesh
    for (int i = 0; i < uDiv; i++)
    {
      for (int j = 0; j < vDiv; j++)
      {
        int lowerLeft = i * (vDiv + 1) + j;
        int lowerRight = lowerLeft + 1;
        int upperLeft = lowerLeft + (vDiv + 1);
        int upperRight = upperLeft + 1;
        mesh.Faces.AddFace(lowerLeft, lowerRight, upperRight, upperLeft);
      }
    }

    mesh.Normals.ComputeNormals();
    mesh.Compact();
    return mesh;
  }

  // Method to create a wiggly lattice around the mesh
  private List<Brep> CreateWigglyLattice(Mesh mesh, double cellSize)
  {
    List<Brep> latticeCells = new List<Brep>();
    BoundingBox bbox = mesh.GetBoundingBox(true);

    double xLength = bbox.Max.X - bbox.Min.X;
    double yLength = bbox.Max.Y - bbox.Min.Y;
    double zLength = bbox.Max.Z - bbox.Min.Z;

    int xCount = (int)(xLength / cellSize);
    int yCount = (int)(yLength / cellSize);
    int zCount = (int)(zLength / cellSize);

    for (int i = 0; i <= xCount; i++)
    {
      for (int j = 0; j <= yCount; j++)
      {
        for (int k = 0; k <= zCount; k++)
        {
          // Modulate the cell dimensions using trigonometric functions
          double wiggleFactorX = 1.0 + 0.3 * Math.Sin(i + 0.5 * Math.PI);
          double wiggleFactorY = 1.0 + 0.3 * Math.Sin(j + 0.5 * Math.PI);
          double wiggleFactorZ = 1.0 + 0.3 * Math.Cos(k + 0.5 * Math.PI);

          Point3d corner = new Point3d(
            bbox.Min.X + i * cellSize * wiggleFactorX,
            bbox.Min.Y + j * cellSize * wiggleFactorY,
            bbox.Min.Z + k * cellSize * wiggleFactorZ
          );

          Box cellBox = new Box(
            new Plane(corner, Vector3d.ZAxis),
            new Interval(0, cellSize * wiggleFactorX),
            new Interval(0, cellSize * wiggleFactorY),
            new Interval(0, cellSize * wiggleFactorZ)
          );

          Brep cellBrep = cellBox.ToBrep();
          if (cellBrep != null)
          {
            latticeCells.Add(cellBrep);
          }
        }
      }
    }

    return latticeCells;
  }
}
# ---------- end lattice_003 ----------
lattice_003_2 = Script(cellSize=number_slider_3)  # -> out, A; inputs cellSize: Double; disabled; same code as lattice_003
lattice_002 = Script(cellSize=number_slider_4)  # -> out, A; inputs cellSize: Double; disabled
# ---------- lattice_002: C# ----------
// Grasshopper Script Instance
//#! csharp
using System;
using System.Collections.Generic;
using System.Drawing;

using Rhino;
using Rhino.Geometry;

using Grasshopper;
using Grasshopper.Kernel;
using Grasshopper.Kernel.Data;
using Grasshopper.Kernel.Types;

public class Script_Instance : GH_ScriptInstance
{
  private void RunScript(double cellSize, ref object A)
  {
    // Generate a funky mesh with trigonometric polynomial deformations
    Mesh funkyMesh = GenerateFunkyMesh();

    // Create lattice around the modified mesh
    A = CreateLattice(funkyMesh, cellSize);
  }

  // Method to generate a mesh with trigonometric polynomial deformations
  private Mesh GenerateFunkyMesh()
  {
    int uDiv = 30; // divisions along the u axis
    int vDiv = 30; // divisions along the v axis
    double size = 20.0; // size of the grid

    Mesh mesh = new Mesh();
    for (int i = 0; i <= uDiv; i++)
    {
      for (int j = 0; j <= vDiv; j++)
      {
        double u = i / (double)uDiv;
        double v = j / (double)vDiv;
        double x = u * size;
        double y = v * size;
        double z = 5.0 * Math.Sin(2 * Math.PI * u) * Math.Cos(2 * Math.PI * v);
        mesh.Vertices.Add(new Point3d(x, y, z));
      }
    }

    // Add faces to the mesh
    for (int i = 0; i < uDiv; i++)
    {
      for (int j = 0; j < vDiv; j++)
      {
        int lowerLeft = i * (vDiv + 1) + j;
        int lowerRight = lowerLeft + 1;
        int upperLeft = lowerLeft + (vDiv + 1);
        int upperRight = upperLeft + 1;
        mesh.Faces.AddFace(lowerLeft, lowerRight, upperRight, upperLeft);
      }
    }

    mesh.Normals.ComputeNormals();
    mesh.Compact();
    return mesh;
  }

  // Method to create a lattice around the mesh
  private List<Brep> CreateLattice(Mesh mesh, double cellSize)
  {
    List<Brep> latticeCells = new List<Brep>();
    BoundingBox bbox = mesh.GetBoundingBox(true);

    double xLength = bbox.Max.X - bbox.Min.X;
    double yLength = bbox.Max.Y - bbox.Min.Y;
    double zLength = bbox.Max.Z - bbox.Min.Z;

    int xCount = (int)(xLength / cellSize);
    int yCount = (int)(yLength / cellSize);
    int zCount = (int)(zLength / cellSize);

    for (int i = 0; i <= xCount; i++)
    {
      for (int j = 0; j <= yCount; j++)
      {
        for (int k = 0; k <= zCount; k++)
        {
          Point3d corner = new Point3d(bbox.Min.X + i * cellSize, bbox.Min.Y + j * cellSize, bbox.Min.Z + k * cellSize);
          Box cellBox = new Box(new Plane(corner, Vector3d.ZAxis), new Interval(0, cellSize), new Interval(0, cellSize), new Interval(0, cellSize));
          Brep cellBrep = cellBox.ToBrep();
          if (cellBrep != null)
          {
            latticeCells.Add(cellBrep);
          }
        }
      }
    }

    return latticeCells;
  }
}
# ---------- end lattice_002 ----------
geometry = Geometry(lattice_003.A)  # disabled
geometry_2 = Geometry(lattice_003_2.A)  # disabled
geometry_3 = Geometry(lattice_002.A)  # disabled
geometry_4 = Geometry(lattice_001.A)  # disabled
param_viewer = ParamViewer(geometry)  # disabled
param_viewer_2 = ParamViewer(geometry_2)  # disabled
panel = Panel(geometry)  # disabled
panel_2 = Panel(lattice_003.out)  # disabled
panel_3 = Panel(geometry_2)  # disabled
param_viewer_3 = ParamViewer(geometry_3)  # disabled
panel_4 = Panel(lattice_003_2.out)  # disabled
panel_5 = Panel(geometry_3)  # disabled
param_viewer_4 = ParamViewer(geometry_4)  # disabled
panel_6 = Panel(lattice_002.out)  # disabled
panel_7 = Panel(geometry_4)  # disabled
# Created at
# Wickerson Studios
# copyright 2024
# download all materials at
# www.wickersonstudios.com
panel_8 = Panel(lattice_001.out)  # disabled
# Parametric Lattice Algorithm from
# gpt Image Prompt
number_slider_6 = Slider(1.7, range=0..10)
lattice_004 = Script(radius=number_slider_6, divisions=Slider(23, range=0..100))  # -> out, A; inputs radius: Double, divisions: Int32
# ---------- lattice_004: C# ----------
// Grasshopper Script Instance
//#! csharp
using System;
using System.Collections.Generic;
using Rhino.Geometry; // Ensure that Rhino geometry types are recognized

public class Script_Instance : GH_ScriptInstance
{
  private void RunScript(double radius, int divisions, ref object A)
  {
    // Generate spiral points based on trigonometric functions
    List<Point3d> points = GenerateSpiralPoints(radius, divisions);

    // Create spirally interconnected pipes
    List<Brep> pipes = new List<Brep>();
    double pipeRadius = 0.05; // Fixed radius for the pipes

    // Create pipes between sequential and overlapping spiral points
    for (int i = 0; i < points.Count - 1; i++)
    {
      // Connect current point to the next
      Brep pipe = CreatePipe(points[i], points[i + 1], pipeRadius);
      if (pipe != null)
        pipes.Add(pipe);

      // Create overlapping connections for a more intricate lattice
      if (i < points.Count - 2)
      {
        pipe = CreatePipe(points[i], points[i + 2], pipeRadius * 0.8); // Slightly thinner pipes for overlapping connections
        if (pipe != null)
          pipes.Add(pipe);
      }
    }

    A = pipes;
  }

  // Function to create a single pipe
  private Brep CreatePipe(Point3d start, Point3d end, double radius)
  {
    Curve curve = new LineCurve(start, end);
    if (curve == null) return null;

    // Generate the pipe
    var pipes = Brep.CreatePipe(curve, radius, false, PipeCapMode.Round, true, 0.01, 0.01);
    return pipes != null && pipes.Length > 0 ? pipes[0] : null;
  }

  // Function to generate points in a spiral pattern
  private List<Point3d> GenerateSpiralPoints(double radius, int divisions)
  {
    List<Point3d> points = new List<Point3d>();
    double angleStep = Math.PI * 2 / divisions;

    for (int i = 0; i < divisions; i++)
    {
      double angle = i * angleStep;
      double x = radius * Math.Cos(angle) * Math.Sin(angle * 3);
      double y = radius * Math.Sin(angle) * Math.Sin(angle * 3);
      double z = radius * Math.Cos(angle * 3);
      points.Add(new Point3d(x, y, z));
    }

    return points;
  }
}
# ---------- end lattice_004 ----------
geometry_5 = Geometry(lattice_004.A)
panel_9 = Panel(lattice_004.out)
param_viewer_5 = ParamViewer(geometry_5)
panel_10 = Panel(geometry_5)
