# Grasshopper definition algorithms_lattice_007.gh (Grasshopper 1.0.8)
# plug-ins: RhinoCodePluginGH

number_slider = Slider(2, range=0..10)  # disabled
number_slider_2 = Slider(3.6, range=1..5)  # disabled
number_slider_3 = Slider(3.6, range=1..5)  # disabled
number_slider_4 = Slider(2.99, range=1..5)  # disabled
number_slider_5 = Slider(2.25, range=1..5)  # disabled
mesh_box = MeshBox(
    Base={Plane=PlaneXY(0, 0, 0), X=Domain(-10, 10), Y=Domain(-10, 10), Z=Domain(-10, 10)},
    XCount=number_slider,
    YCount=number_slider,
    ZCount=number_slider)  # disabled
lattice_001 = Script(inputMesh=mesh_box, cellSize=number_slider_5)  # -> out, A; inputs inputMesh: Mesh, cellSize: Double; disabled
# ---------- lattice_001: C# ----------
// Grasshopper Script Instance
//#! csharp
using System;
using System.Collections.Generic;
using System.Drawing;

using Rhino;
using Rhino.Geometry;

using Grasshopper;
using Grasshopper.Kernel;
using Grasshopper.Kernel.Data;
using Grasshopper.Kernel.Types;

public class Script_Instance : GH_ScriptInstance
{
  private void RunScript(Mesh inputMesh, double cellSize, ref object A)
  {
    if (inputMesh == null || inputMesh.Faces.Count == 0)
    {
      A = null;
      Print("Invalid or empty mesh input.");
      return;
    }

    if (cellSize <= 0)
    {
      A = null;
      Print("Cell size must be greater than zero.");
      return;
    }

    A = CreateLattice(inputMesh, cellSize);
  }

  // <Custom additional code> 
  private List<Brep> CreateLattice(Mesh mesh, double cellSize)
  {
    List<Brep> latticeCells = new List<Brep>();
    BoundingBox bbox = mesh.GetBoundingBox(true);

    double xLength = bbox.Max.X - bbox.Min.X;
    double yLength = bbox.Max.Y - bbox.Min.Y;
    double zLength = bbox.Max.Z - bbox.Min.Z;

    int xCount = (int)(xLength / cellSize);
    int yCount = (int)(yLength / cellSize);
    int zCount = (int)(zLength / cellSize);

    for (int i = 0; i <= xCount; i++)
    {
      for (int j = 0; j <= yCount; j++)
      {
        for (int k = 0; k <= zCount; k++)
        {
          Point3d corner = new Point3d(bbox.Min.X + i * cellSize, bbox.Min.Y + j * cellSize, bbox.Min.Z + k * cellSize);
          Box cellBox = new Box(new Plane(corner, Vector3d.ZAxis), new Interval(0, cellSize), new Interval(0, cellSize), new Interval(0, cellSize));
          Brep cellBrep = cellBox.ToBrep();
          if (cellBrep != null)
          {
            latticeCells.Add(cellBrep);
          }
        }
      }
    }

    return latticeCells;
  }
}
# ---------- end lattice_001 ----------
lattice_003 = Script(cellSize=number_slider_2)  # -> out, A; inputs cellSize: Double; disabled
# ---------- lattice_003: C# ----------
// Grasshopper Script Instance
//#! csharp
using System;
using System.Collections.Generic;
using System.Drawing;

using Rhino;
using Rhino.Geometry;

using Grasshopper;
using Grasshopper.Kernel;
using Grasshopper.Kernel.Data;
using Grasshopper.Kernel.Types;

public class Script_Instance : GH_ScriptInstance
{
  private void RunScript(double cellSize, ref object A)
  {
    // Generate a funky mesh with trigonometric polynomial deformations
    Mesh funkyMesh = GenerateFunkyMesh();

    // Create a wiggly lattice around the modified mesh
    A = CreateWigglyLattice(funkyMesh, cellSize);
  }

  // Method to generate a mesh with trigonometric polynomial deformations
  private Mesh GenerateFunkyMesh()
  {
    int uDiv = 30; // divisions along the u axis
    int vDiv = 30; // divisions along the v axis
    double size = 20.0; // size of the grid

    Mesh mesh = new Mesh();
    for (int i = 0; i <= uDiv; i++)
    {
      for (int j = 0; j <= vDiv; j++)
      {
        double u = i / (double)uDiv;
        double v = j / (double)vDiv;
        double x = u * size;
        double y = v * size;
        double z = 5.0 * Math.Sin(2 * Math.PI * u) * Math.Cos(2 * Math.PI * v);
        mesh.Vertices.Add(new Point3d(x, y, z));
      }
    }

    // Add faces to the mesh
    for (int i = 0; i < uDiv; i++)
    {
      for (int j = 0; j < vDiv; j++)
      {
        int lowerLeft = i * (vDiv + 1) + j;
        int lowerRight = lowerLeft + 1;
        int upperLeft = lowerLeft + (vDiv + 1);
        int upperRight = upperLeft + 1;
        mesh.Faces.AddFace(lowerLeft, lowerRight, upperRight, upperLeft);
      }
    }

    mesh.Normals.ComputeNormals();
    mesh.Compact();
    return mesh;
  }

  // Method to create a wiggly lattice around the mesh
  private List<Brep> CreateWigglyLattice(Mesh mesh, double cellSize)
  {
    List<Brep> latticeCells = new List<Brep>();
    BoundingBox bbox = mesh.GetBoundingBox(true);

    double xLength = bbox.Max.X - bbox.Min.X;
    double yLength = bbox.Max.Y - bbox.Min.Y;
    double zLength = bbox.Max.Z - bbox.Min.Z;

    int xCount = (int)(xLength / cellSize);
    int yCount = (int)(yLength / cellSize);
    int zCount = (int)(zLength / cellSize);

    for (int i = 0; i <= xCount; i++)
    {
      for (int j = 0; j <= yCount; j++)
      {
        for (int k = 0; k <= zCount; k++)
        {
          // Modulate the cell dimensions using trigonometric functions
          double wiggleFactorX = 1.0 + 0.3 * Math.Sin(i + 0.5 * Math.PI);
          double wiggleFactorY = 1.0 + 0.3 * Math.Sin(j + 0.5 * Math.PI);
          double wiggleFactorZ = 1.0 + 0.3 * Math.Cos(k + 0.5 * Math.PI);

          Point3d corner = new Point3d(
            bbox.Min.X + i * cellSize * wiggleFactorX,
            bbox.Min.Y + j * cellSize * wiggleFactorY,
            bbox.Min.Z + k * cellSize * wiggleFactorZ
          );

          Box cellBox = new Box(
            new Plane(corner, Vector3d.ZAxis),
            new Interval(0, cellSize * wiggleFactorX),
            new Interval(0, cellSize * wiggleFactorY),
            new Interval(0, cellSize * wiggleFactorZ)
          );

          Brep cellBrep = cellBox.ToBrep();
          if (cellBrep != null)
          {
            latticeCells.Add(cellBrep);
          }
        }
      }
    }

    return latticeCells;
  }
}
# ---------- end lattice_003 ----------
lattice_003_2 = Script(cellSize=number_slider_3)  # -> out, A; inputs cellSize: Double; disabled; same code as lattice_003
lattice_002 = Script(cellSize=number_slider_4)  # -> out, A; inputs cellSize: Double; disabled
# ---------- lattice_002: C# ----------
// Grasshopper Script Instance
//#! csharp
using System;
using System.Collections.Generic;
using System.Drawing;

using Rhino;
using Rhino.Geometry;

using Grasshopper;
using Grasshopper.Kernel;
using Grasshopper.Kernel.Data;
using Grasshopper.Kernel.Types;

public class Script_Instance : GH_ScriptInstance
{
  private void RunScript(double cellSize, ref object A)
  {
    // Generate a funky mesh with trigonometric polynomial deformations
    Mesh funkyMesh = GenerateFunkyMesh();

    // Create lattice around the modified mesh
    A = CreateLattice(funkyMesh, cellSize);
  }

  // Method to generate a mesh with trigonometric polynomial deformations
  private Mesh GenerateFunkyMesh()
  {
    int uDiv = 30; // divisions along the u axis
    int vDiv = 30; // divisions along the v axis
    double size = 20.0; // size of the grid

    Mesh mesh = new Mesh();
    for (int i = 0; i <= uDiv; i++)
    {
      for (int j = 0; j <= vDiv; j++)
      {
        double u = i / (double)uDiv;
        double v = j / (double)vDiv;
        double x = u * size;
        double y = v * size;
        double z = 5.0 * Math.Sin(2 * Math.PI * u) * Math.Cos(2 * Math.PI * v);
        mesh.Vertices.Add(new Point3d(x, y, z));
      }
    }

    // Add faces to the mesh
    for (int i = 0; i < uDiv; i++)
    {
      for (int j = 0; j < vDiv; j++)
      {
        int lowerLeft = i * (vDiv + 1) + j;
        int lowerRight = lowerLeft + 1;
        int upperLeft = lowerLeft + (vDiv + 1);
        int upperRight = upperLeft + 1;
        mesh.Faces.AddFace(lowerLeft, lowerRight, upperRight, upperLeft);
      }
    }

    mesh.Normals.ComputeNormals();
    mesh.Compact();
    return mesh;
  }

  // Method to create a lattice around the mesh
  private List<Brep> CreateLattice(Mesh mesh, double cellSize)
  {
    List<Brep> latticeCells = new List<Brep>();
    BoundingBox bbox = mesh.GetBoundingBox(true);

    double xLength = bbox.Max.X - bbox.Min.X;
    double yLength = bbox.Max.Y - bbox.Min.Y;
    double zLength = bbox.Max.Z - bbox.Min.Z;

    int xCount = (int)(xLength / cellSize);
    int yCount = (int)(yLength / cellSize);
    int zCount = (int)(zLength / cellSize);

    for (int i = 0; i <= xCount; i++)
    {
      for (int j = 0; j <= yCount; j++)
      {
        for (int k = 0; k <= zCount; k++)
        {
          Point3d corner = new Point3d(bbox.Min.X + i * cellSize, bbox.Min.Y + j * cellSize, bbox.Min.Z + k * cellSize);
          Box cellBox = new Box(new Plane(corner, Vector3d.ZAxis), new Interval(0, cellSize), new Interval(0, cellSize), new Interval(0, cellSize));
          Brep cellBrep = cellBox.ToBrep();
          if (cellBrep != null)
          {
            latticeCells.Add(cellBrep);
          }
        }
      }
    }

    return latticeCells;
  }
}
# ---------- end lattice_002 ----------
geometry = Geometry(lattice_003.A)  # disabled
geometry_2 = Geometry(lattice_003_2.A)  # disabled
geometry_3 = Geometry(lattice_002.A)  # disabled
geometry_4 = Geometry(lattice_001.A)  # disabled
param_viewer = ParamViewer(geometry)  # disabled
param_viewer_2 = ParamViewer(geometry_2)  # disabled
panel = Panel(geometry)  # disabled
panel_2 = Panel(lattice_003.out)  # disabled
panel_3 = Panel(geometry_2)  # disabled
param_viewer_3 = ParamViewer(geometry_3)  # disabled
panel_4 = Panel(lattice_003_2.out)  # disabled
panel_5 = Panel(geometry_3)  # disabled
param_viewer_4 = ParamViewer(geometry_4)  # disabled
panel_6 = Panel(lattice_002.out)  # disabled
panel_7 = Panel(geometry_4)  # disabled
# Created at
# Wickerson Studios
# copyright 2024
# download all materials at
# www.wickersonstudios.com
panel_8 = Panel(lattice_001.out)  # disabled
number_slider_6 = Slider(3, range=0..10)
number_slider_7 = Slider(1.2, range=0..10)
# Parametric Lattice Algorithm from
# gpt Image Prompt
number_slider_8 = Slider(4.8, range=0..10)
lattice_007b = Script(
    length=Slider(5.1, range=0..10),
    width=Slider(2.6, range=0..10),
    layerHeight=Slider(2.7, range=0..10),
    numLayers=Slider(3, range=0..10),
    uDiv=Slider(8, range=0..10),
    vDiv=Slider(3, range=0..10))  # -> out, A; inputs length: Double, width: Double, layerHeight: Double, numLayers: Int32, uDiv: Int32, vDiv: Int32
# ---------- lattice_007b: C# ----------
// Grasshopper Script Instance
//#! csharp
using System;
using System.Collections.Generic;
using Rhino.Geometry; // Ensure that Rhino geometry types are recognized

public class Script_Instance : GH_ScriptInstance
{
  private void RunScript(
	double length,
	double width,
	double layerHeight,
	int numLayers,
	int uDiv,
	int vDiv,
	ref object A)
  {
    // Generate points with parametrically defined trigonometric layers
    List<List<Point3d>> pointLayers = GenerateTrigonometricLayers(length, width, layerHeight, numLayers, uDiv, vDiv);

    // Create dynamically connected pipes
    List<Brep> pipes = new List<Brep>();
    double baseRadius = 0.03; // Base radius for the pipes

    // Connect the points in each layer and between layers
    for (int layer = 0; layer < numLayers; layer++)
    {
      List<Point3d> points = pointLayers[layer];
      for (int i = 0; i < points.Count - 1; i++)
      {
        // Horizontal connections within the same layer
        if (i < uDiv - 1)
          pipes.Add(CreatePipe(points[i], points[i + 1], baseRadius));

        // Vertical connections to the next layer
        if (layer < numLayers - 1)
        {
          List<Point3d> nextLayerPoints = pointLayers[layer + 1];
          pipes.Add(CreatePipe(points[i], nextLayerPoints[i], baseRadius * 1.2)); // slightly larger radius for vertical connections
        }
      }
    }

    A = pipes;
  }

  // Function to create a single pipe
  private Brep CreatePipe(Point3d start, Point3d end, double radius)
  {
    Curve curve = new LineCurve(start, end);
    if (curve == null) return null;

    // Generate the pipe
    var pipes = Brep.CreatePipe(curve, radius, false, PipeCapMode.Round, true, 0.01, 0.01);
    return pipes != null && pipes.Length > 0 ? pipes[0] : null;
  }

  // Function to generate layers of points influenced by trigonometric patterns
  private List<List<Point3d>> GenerateTrigonometricLayers(double length, double width, double layerHeight, int numLayers, int uDiv, int vDiv)
  {
    List<List<Point3d>> allLayers = new List<List<Point3d>>();
    double spacingX = length / (uDiv - 1);
    double spacingY = width / (vDiv - 1);

    for (int layer = 0; layer < numLayers; layer++)
    {
      List<Point3d> points = new List<Point3d>();
      double layerZ = layer * layerHeight;
      for (int i = 0; i < uDiv; i++)
      {
        for (int j = 0; j < vDiv; j++)
        {
          double x = i * spacingX;
          double y = j * spacingY;
          double z = layerZ + Math.Sin(Math.PI * (x / length + y / width) + layer) * Math.Cos(Math.PI * (y / width + layer));
          points.Add(new Point3d(x, y, z));
        }
      }
      allLayers.Add(points);
    }
    return allLayers;
  }
}
# ---------- end lattice_007b ----------
lattice_007 = Script(length=number_slider_8, width=Slider(4.2, range=0..10), uDiv=Slider(10, range=0..10), vDiv=Slider(10, range=0..10))  # -> out, A; inputs length: Double, width: Double, uDiv: Int32, vDiv: Int32
# ---------- lattice_007: C# ----------
// Grasshopper Script Instance
//#! csharp
using System;
using System.Collections.Generic;
using Rhino.Geometry; // Ensure that Rhino geometry types are recognized

public class Script_Instance : GH_ScriptInstance
{
  private void RunScript(
	double length,
	double width,
	int uDiv,
	int vDiv,
	ref object A)
  {
    // Generate a grid of points influenced by complex trigonometric functions
    Point3d[,] points = GenerateComplexTrigonometricGrid(length, width, uDiv, vDiv);

    // Create dynamically interconnected panels
    List<Brep> panels = new List<Brep>();

    // Create panels from the points grid
    for (int i = 0; i < uDiv - 1; i++)
    {
      for (int j = 0; j < vDiv - 1; j++)
      {
        Point3d[] corners = new Point3d[4]
        {
          points[i, j],
          points[i, j + 1],
          points[i + 1, j + 1],
          points[i + 1, j]
        };
        Brep panel = Brep.CreateFromCornerPoints(corners[0], corners[1], corners[2], corners[3], 0.01);
        if (panel != null)
          panels.Add(panel);
      }
    }

    A = panels;
  }

  // Function to generate a grid of points with complex trigonometric modulations
  private Point3d[,] GenerateComplexTrigonometricGrid(double length, double width, int uDiv, int vDiv)
  {
    Point3d[,] points = new Point3d[uDiv, vDiv];
    double xSpacing = length / (uDiv - 1);
    double ySpacing = width / (vDiv - 1);

    for (int i = 0; i < uDiv; i++)
    {
      for (int j = 0; j < vDiv; j++)
      {
        double x = i * xSpacing;
        double y = j * ySpacing;
        double z = Math.Sin(4 * Math.PI * x / length) * Math.Cos(4 * Math.PI * y / width) * Math.Cos(2 * Math.PI * x / length);
        points[i, j] = new Point3d(x, y, z);
      }
    }
    return points;
  }
}
# ---------- end lattice_007 ----------
geometry_5 = Geometry(lattice_007b.A)
geometry_6 = Geometry(lattice_007.A)
panel_9 = Panel(lattice_007b.out)
param_viewer_5 = ParamViewer(geometry_5)
panel_10 = Panel(lattice_007.out)
param_viewer_6 = ParamViewer(geometry_6)
panel_11 = Panel(geometry_5)
panel_12 = Panel(geometry_6)
