# Grasshopper definition algorithms_pattern_001.gh (Grasshopper 1.0.8)

number_slider = Slider(2, range=0..10)
number_slider_2 = Slider(2.25, range=1..5)
mesh_box = MeshBox(
    Base={Plane=PlaneXY(0, 0, 0), X=Domain(-10, 10), Y=Domain(-10, 10), Z=Domain(-10, 10)},
    XCount=number_slider,
    YCount=number_slider,
    ZCount=number_slider)
geometry = Geometry()
# Created at
# Wickerson Studios
# copyright 2024
# download all materials at
# www.wickersonstudios.com
# Parametric Pattern Algorithm from
# gpt Image Prompt
param_viewer = ParamViewer(geometry)
panel = Panel(geometry)
