# Grasshopper definition algorithms_pattern_006.gh (Grasshopper 1.0.8)
# plug-ins: RhinoCodePluginGH

# Created at
# Wickerson Studios
# copyright 2024
# download all materials at
# www.wickersonstudios.com
# Parametric Pattern Algorithm from
# gpt Image Prompt
number_slider = Slider(5, range=1..5)
pattern_005 = Script(
    sideLength=number_slider,
    numberOfSides=Slider(3, range=0..10),
    modulationIntensity=Slider(2, range=0..2),
    layers=Slider(10, range=0..10),
    rotationFactor=Slider(0.29, range=0..2),
    heightFactor=Slider(2, range=0..2))  # -> out, A; inputs sideLength: Double, numberOfSides: Int32, modulationIntensity: Double, layers: Int32, rotationFactor: Double, heightFactor: Double
# ---------- pattern_005: C# ----------
// Grasshopper Script Instance
// #! csharp
using System;
using System.Collections.Generic;
using Rhino.Geometry;
using Grasshopper.Kernel.Types;

public class Script_Instance : GH_ScriptInstance
{
  private void RunScript(
	double sideLength,
	int numberOfSides,
	double modulationIntensity,
	int layers,
	double rotationFactor,
	double heightFactor,
	ref object A)
  {
    // Outputs
    List<GH_Curve> complexPolygonEdges = new List<GH_Curve>();

    // Create a base polygon with trigonometric modulation
    List<Curve> initialPolygonEdges = CreateComplexPolygon(sideLength, numberOfSides, modulationIntensity, Plane.WorldXY);
    AddEdgesToOutput(initialPolygonEdges, complexPolygonEdges);

    // Apply transformations to make the pattern more complex
    for (int i = 1; i <= layers; i++) // User-defined number of layers
    {
      double layerRotationAngle = i * rotationFactor * (Math.PI / numberOfSides); // Incremental rotation angle
      double layerHeight = i * heightFactor * (sideLength / 10); // Incremental height based on user input
      foreach (Curve edge in initialPolygonEdges)
      {
        Curve transformedEdge = TransformCurve(edge, layerRotationAngle, layerHeight);
        complexPolygonEdges.Add(new GH_Curve(transformedEdge));
      }
    }

    // Output the complex edges without joining them
    A = complexPolygonEdges;
  }

  // <Custom additional code> 
  private void AddEdgesToOutput(List<Curve> edges, List<GH_Curve> output)
  {
    foreach (Curve edge in edges)
    {
      output.Add(new GH_Curve(edge));
    }
  }

  private Curve TransformCurve(Curve curve, double rotationAngle, double height)
  {
    // Create a transformation that rotates around the Z axis and translates upwards
    Transform rotation = Transform.Rotation(rotationAngle, Vector3d.ZAxis, Point3d.Origin);
    Transform translation = Transform.Translation(new Vector3d(0, 0, height));

    Curve transformedCurve = curve.DuplicateCurve();
    transformedCurve.Transform(rotation);
    transformedCurve.Transform(translation);

    return transformedCurve;
  }

  private List<Curve> CreateComplexPolygon(double sideLength, int numberOfSides, double modulationIntensity, Plane plane)
  {
    // Method to create a polygon with funky and complex 3D deformation
    double radius = sideLength / (2 * Math.Sin(Math.PI / numberOfSides));
    var points = new List<Point3d>();

    // Complex function to deform the shape in 3D
    Func<double, double, double> complexFunction = (angle, r) =>
    {
      return r + modulationIntensity * Math.Sin(3 * angle) + modulationIntensity * Math.Cos(5 * angle);
    };

    for (int i = 0; i < numberOfSides; i++)
    {
      double angle = i * 2 * Math.PI / numberOfSides;
      double funkyRadius = complexFunction(angle, radius);
      double z = modulationIntensity * Math.Sin(2 * angle); // Deform in Z-axis for a 3D effect
      points.Add(plane.Origin + new Point3d(funkyRadius * Math.Cos(angle), funkyRadius * Math.Sin(angle), z));
    }
    points.Add(points[0]); // Close the polyline to create a complex polygon

    // Create the edges
    var edges = new List<Curve>();
    for (int i = 0; i < points.Count - 1; i++)
    {
      edges.Add(new LineCurve(points[i], points[i + 1]));
    }

    return edges;
  }
  // </Custom additional code>
}
# ---------- end pattern_005 ----------
geometry = Geometry(pattern_005.A)
param_viewer = ParamViewer(geometry)
panel = Panel(geometry)
panel_2 = Panel(pattern_005.out)
