# Grasshopper definition algorithms_pattern_009.gh (Grasshopper 1.0.8)
# plug-ins: RhinoCodePluginGH, Kangaroo2 Components

pattern_008 = Script(
    hexRadius=Slider(2.8, range=1..5),
    gridWidth=Slider(3, range=0..10),
    gridHeight=Slider(5, range=0..10),
    extrusionBaseHeight=Slider(2, range=0..2),
    complexity=Slider(2, range=0..2),
    randomness=Slider(1.8, range=0..2))  # -> out, A; inputs hexRadius: Double, gridWidth: Int32, gridHeight: Int32, extrusionBaseHeight: Double, complexity: Double, randomness: Double
# ---------- pattern_008: C# ----------
// Grasshopper Script Instance
// #! csharp
using System;
using System.Collections.Generic;
using Rhino.Geometry;
using Grasshopper.Kernel.Types;

public class Script_Instance : GH_ScriptInstance
{
  private void RunScript(
	double hexRadius,
	int gridWidth,
	int gridHeight,
	double extrusionBaseHeight,
	double complexity,
	double randomness,
	ref object A)
  {
    // List to store the resulting curves
    List<GH_Curve> complexHexagonCurves = new List<GH_Curve>();
    Random rnd = new Random();

    for (int i = 0; i < gridWidth; ++i)
    {
      for (int j = 0; j < gridHeight; ++j)
      {
        // Calculate the position of the current hexagon
        double x = i * 3 * hexRadius;
        double y = j * Math.Sqrt(3) * hexRadius;
        if (i % 2 == 1) y += Math.Sqrt(3) * hexRadius / 2; // Offset every other row

        // Create the hexagon at the calculated position
        List<Curve> hexagon = CreateHexagon(hexRadius, new Point3d(x, y, 0));

        // Apply a complex function to vary the extrusion height
        double extrusionHeight = extrusionBaseHeight + complexity * Math.Sin(i * j * 0.5) + complexity * Math.Cos(j * 0.5);

        // Add some randomness
        extrusionHeight += (rnd.NextDouble() - 0.5) * randomness;

        // Extrude the hexagon in 3D
        foreach (var curve in hexagon)
        {
          var extrusionVector = Vector3d.ZAxis * extrusionHeight;
          Surface srf = ExtrudeCurve(curve, extrusionVector);

          // Convert edges of the extruded surface to curves and add to the list
          foreach (var edge in srf.ToBrep().Edges)
          {
            complexHexagonCurves.Add(new GH_Curve(edge.ToNurbsCurve()));
          }
        }
      }
    }

    // Output the curves
    A = complexHexagonCurves;
  }

  // <Custom additional code>
  private List<Curve> CreateHexagon(double radius, Point3d center)
  {
    // Create a hexagon centered at a given point
    List<Curve> edges = new List<Curve>();
    for (int i = 0; i < 6; i++)
    {
      double angle = Math.PI / 3 * i;
      double nextAngle = Math.PI / 3 * ((i + 1) % 6);
      Point3d start = new Point3d(center.X + radius * Math.Cos(angle), center.Y + radius * Math.Sin(angle), center.Z);
      Point3d end = new Point3d(center.X + radius * Math.Cos(nextAngle), center.Y + radius * Math.Sin(nextAngle), center.Z);
      edges.Add(new LineCurve(start, end));
    }
    return edges;
  }

  private Surface ExtrudeCurve(Curve curve, Vector3d direction)
  {
    // Extrude a curve in a given direction to create a surface
    return Surface.CreateExtrusion(curve, direction);
  }
  // </Custom additional code>
}
# ---------- end pattern_008 ----------
pattern_007 = Script(
    hexRadius=Slider(2.8, range=1..5),
    gridWidth=Slider(3, range=0..10),
    gridHeight=Slider(5, range=0..10),
    extrusionHeight=Slider(2, range=0..2),
    offset=Slider(0.89, range=0..2))  # -> out, A; inputs hexRadius: Double, gridWidth: Int32, gridHeight: Int32, extrusionHeight: Double, offset: Double
# ---------- pattern_007: C# ----------
// Grasshopper Script Instance
// #! csharp
using System;
using System.Collections.Generic;
using Rhino.Geometry;
using Grasshopper.Kernel.Types;

public class Script_Instance : GH_ScriptInstance
{
  private void RunScript(
	double hexRadius,
	int gridWidth,
	int gridHeight,
	double extrusionHeight,
	double offset,
	ref object A)
  {
    // List to store the resulting curves
    List<GH_Curve> hexagonCurves = new List<GH_Curve>();

    for (int i = 0; i < gridWidth; ++i)
    {
      for (int j = 0; j < gridHeight; ++j)
      {
        // Calculate the position of the current hexagon
        double x = i * 3 * hexRadius * offset;
        double y = j * Math.Sqrt(3) * hexRadius;
        if (i % 2 == 1) y += Math.Sqrt(3) * hexRadius / 2; // Offset every other row

        // Create the hexagon at the calculated position
        List<Curve> hexagon = CreateHexagon(hexRadius, new Point3d(x, y, 0));

        // Extrude the hexagon in 3D
        foreach (var curve in hexagon)
        {
          var extrusionVector = (i + j) % 2 == 0 ? Vector3d.ZAxis * extrusionHeight : Vector3d.ZAxis * -extrusionHeight;
          Surface srf = ExtrudeCurve(curve, extrusionVector);

          // Convert edges of the extruded surface to curves and add to the list
          foreach (var edge in srf.ToBrep().Edges)
          {
            hexagonCurves.Add(new GH_Curve(edge.ToNurbsCurve()));
          }
        }
      }
    }

    // Output the curves
    A = hexagonCurves;
  }

  // <Custom additional code> 
  private List<Curve> CreateHexagon(double radius, Point3d center)
  {
    // Create a hexagon centered at a given point
    List<Curve> edges = new List<Curve>();
    for (int i = 0; i < 6; i++)
    {
      double angle = Math.PI / 3 * i;
      double nextAngle = Math.PI / 3 * ((i + 1) % 6);
      Point3d start = new Point3d(center.X + radius * Math.Cos(angle), center.Y + radius * Math.Sin(angle), center.Z);
      Point3d end = new Point3d(center.X + radius * Math.Cos(nextAngle), center.Y + radius * Math.Sin(nextAngle), center.Z);
      edges.Add(new LineCurve(start, end));
    }
    return edges;
  }

  private Surface ExtrudeCurve(Curve curve, Vector3d direction)
  {
    // Extrude a curve in a given direction to create a surface
    return Surface.CreateExtrusion(curve, direction);
  }
  // </Custom additional code>
}
# ---------- end pattern_007 ----------
pattern_006 = Script()  # -> out, A
# ---------- pattern_006: C# ----------
// Grasshopper Script Instance
// #! csharp
using System;
using System.Collections.Generic;
using Rhino.Geometry;
using Grasshopper.Kernel.Types;

public class Script_Instance : GH_ScriptInstance
{
  private void RunScript(ref object A)
  {
    // Define parameters for the pattern
    double hexRadius = 1.0; // Radius of the hexagons
    int gridWidth = 10; // Number of hexagons in width
    int gridHeight = 10; // Number of hexagons in height
    double extrusionHeight = 0.5; // Height to extrude the hexagons
    
    // List to store the resulting curves
    List<GH_Curve> hexagonCurves = new List<GH_Curve>();

    for (int i = 0; i < gridWidth; i++)
    {
      for (int j = 0; j < gridHeight; j++)
      {
        // Calculate the position of the current hexagon
        double x = i * 3 * hexRadius;
        double y = j * Math.Sqrt(3) * hexRadius;
        if (i % 2 == 1) y += Math.Sqrt(3) * hexRadius / 2; // Offset every other row
        
        // Create the hexagon at the calculated position
        List<Curve> hexagon = CreateHexagon(hexRadius, new Point3d(x, y, 0));
        
        // Extrude the hexagon in 3D
        foreach (var curve in hexagon)
        {
          // For alternating extrusions, you can use a condition based on i and j
          var extrusionVector = (i + j) % 2 == 0 ? Vector3d.ZAxis * extrusionHeight : Vector3d.ZAxis * -extrusionHeight;
          Surface srf = ExtrudeCurve(curve, extrusionVector);

          // Convert edges of the extruded surface to curves and add to the list
          foreach (var edge in srf.ToBrep().Edges)
          {
            hexagonCurves.Add(new GH_Curve(edge.ToNurbsCurve()));
          }
        }
      }
    }

    // Output the curves
    A = hexagonCurves;
  }

  // <Custom additional code>
  private List<Curve> CreateHexagon(double radius, Point3d center)
  {
    // Create a hexagon centered at a given point
    List<Curve> edges = new List<Curve>();
    for (int i = 0; i < 6; i++)
    {
      double angle = Math.PI / 3 * i;
      double nextAngle = Math.PI / 3 * ((i + 1) % 6);
      Point3d start = new Point3d(center.X + radius * Math.Cos(angle), center.Y + radius * Math.Sin(angle), center.Z);
      Point3d end = new Point3d(center.X + radius * Math.Cos(nextAngle), center.Y + radius * Math.Sin(nextAngle), center.Z);
      edges.Add(new LineCurve(start, end));
    }
    return edges;
  }

  private Surface ExtrudeCurve(Curve curve, Vector3d direction)
  {
    // Extrude a curve in a given direction
    return Surface.CreateExtrusion(curve, direction);
  }
  // </Custom additional code>
}
# ---------- end pattern_006 ----------
geometry = Geometry(pattern_006.A)
geometry_2 = Geometry(pattern_007.A)
geometry_3 = Geometry(pattern_008.A)
param_viewer = ParamViewer(geometry)
panel = Panel(geometry)
panel_2 = Panel(pattern_006.out)
param_viewer_2 = ParamViewer(geometry_2)
panel_3 = Panel(geometry_2)
param_viewer_3 = ParamViewer(geometry_3)
panel_4 = Panel(pattern_007.out)
panel_5 = Panel(geometry_3)
panel_6 = Panel(pattern_008.out)
# Created at
# Wickerson Studios
# copyright 2024
# download all materials at
# www.wickersonstudios.com
# Parametric Pattern Algorithm from
# gpt Image Prompt
number_slider = Slider(5, range=1..5)
pattern_009 = Script(
    hexRadius=number_slider,
    gridWidth=Slider(5, range=0..10),
    gridHeight=Slider(5, range=0..10),
    baseHeight=Slider(5, range=0..5),
    complexity=Slider(2, range=0..2),
    frequency=Slider(2, range=-2..2))  # -> out, A; inputs hexRadius: Double, gridWidth: Int32, gridHeight: Int32, baseHeight: Double, complexity: Double, frequency: Double
# ---------- pattern_009: C# ----------
// Grasshopper Script Instance
// #! csharp
using System;
using System.Collections.Generic;
using Rhino.Geometry;
using Grasshopper.Kernel.Types;

public class Script_Instance : GH_ScriptInstance
{
  private void RunScript(
	double hexRadius,
	int gridWidth,
	int gridHeight,
	double baseHeight,
	double complexity,
	double frequency,
	ref object A)
  {
    // List to store the resulting curves
    List<GH_Curve> complexPatternCurves = new List<GH_Curve>();

    // Function to add complexity using trigonometric polynomials
    Func<double, double, double> trigPoly = (x, y) =>
    {
      return Math.Sin(frequency * x) * Math.Cos(frequency * y) * complexity;
    };

    for (int i = 0; i < gridWidth; ++i)
    {
      for (int j = 0; j < gridHeight; ++j)
      {
        // Calculate the position of the current cell
        double x = i * hexRadius * 1.5;
        double y = j * Math.Sqrt(3) * hexRadius;
        if (i % 2 == 1) y += Math.Sqrt(3) * hexRadius / 2; // Offset every other row

        // Create the geometry at the calculated position
        Point3d center = new Point3d(x, y, 0);
        double localComplexity = trigPoly(x, y);
        List<Curve> cellCurves = CreateComplexGeometry(hexRadius, center, baseHeight + localComplexity);

        // Add the geometry's curves to the list
        foreach (Curve curve in cellCurves)
        {
          complexPatternCurves.Add(new GH_Curve(curve));
        }
      }
    }

    // Output the curves
    A = complexPatternCurves;
  }

  // <Custom additional code> 
  private List<Curve> CreateComplexGeometry(double radius, Point3d center, double height)
  {
    // Create complex geometry with a mix of different shapes
    List<Curve> edges = new List<Curve>();

    // Base hexagon
    Curve hexagon = CreateHexagon(radius, center);

    // Deform hexagon with a sine wave along Z-axis
    Curve[] segments = hexagon.DuplicateSegments();
    for (int i = 0; i < segments.Length; i++)
    {
      var segment = segments[i];
      var midPoint = segment.PointAtNormalizedLength(0.5);
      midPoint.Z += Math.Sin(i) * height; // Apply sine wave deformation
      var points = new List<Point3d> { segment.PointAtStart, midPoint, segment.PointAtEnd };
      Curve deformedSegment = Curve.CreateInterpolatedCurve(points, 3);
      edges.Add(deformedSegment);
    }

    return edges;
  }

  private Curve CreateHexagon(double radius, Point3d center)
  {
    // Create a flat hexagon centered at a given point
    Polyline hex = new Polyline(7);
    for (int i = 0; i < 6; i++)
    {
      double angle = Math.PI / 3 * i;
      hex.Add(center + new Vector3d(radius * Math.Cos(angle), radius * Math.Sin(angle), 0));
    }
    hex.Add(hex[0]); // Close the hexagon by adding the first point at the end

    return hex.ToNurbsCurve();
  }
  // </Custom additional code>
}
# ---------- end pattern_009 ----------
geometry_4 = Geometry(pattern_009.A)
multipipe = MultiPipe(Curves=geometry_4, NodeSize=0.5, EndOffset=1, StrutSize=1, Segment=0, KinkAngle=0.6, CubeFit=0, Caps=0)
panel_7 = Panel(pattern_009.out)
param_viewer_4 = ParamViewer(geometry_4)
panel_8 = Panel(geometry_4)
