# Grasshopper definition algorithms_subdivision_001.gh (Grasshopper 1.0.8)
# plug-ins: RhinoCodePluginGH

number_slider = Slider(25.9, range=0..100)
number_slider_2 = Slider(7.5, range=0..10)
number_slider_3 = Slider(10.9, range=0..20)
number_slider_4 = Slider(101.9, range=0..200)
number_slider_5 = Slider(5, range=0..10)
number_slider_6 = Slider(19.5, range=0..100)
number_slider_7 = Slider(10.9, range=0..20)
number_slider_8 = Slider(101.9, range=0..200)
number_slider_9 = Slider(5, range=0..10)
number_slider_10 = Slider(25.9, range=0..100)
number_slider_11 = Slider(7.5, range=0..10)
number_slider_12 = Slider(19.5, range=0..100)
number_slider_13 = Slider(10.9, range=0..20)
number_slider_14 = Slider(101.9, range=0..200)
number_slider_15 = Slider(5, range=0..10)
number_slider_16 = Slider(25.9, range=0..100)
number_slider_17 = Slider(7.5, range=0..10)
number_slider_18 = Slider(19.5, range=0..100)
number_slider_19 = Slider(25.9, range=0..100)
number_slider_20 = Slider(7.5, range=0..10)
number_slider_21 = Slider(19.5, range=0..100)
number_slider_22 = Slider(25.9, range=0..100)
number_slider_23 = Slider(7.5, range=0..10)
number_slider_24 = Slider(19.5, range=0..100)
number_slider_25 = Slider(10.9, range=0..20)
number_slider_26 = Slider(101.9, range=0..200)
number_slider_27 = Slider(5, range=0..10)
number_slider_28 = Slider(10.9, range=0..20)
number_slider_29 = Slider(101.9, range=0..200)
number_slider_30 = Slider(5, range=0..10)
armchair_001 = Script()  # -> out, A
# ---------- armchair_001: C# ----------
//Grasshopper Script Instance
//#! csharp
using System;
using System.Collections;
using System.Collections.Generic;
using System.Drawing;

using Rhino;
using Rhino.Geometry;

using Grasshopper;
using Grasshopper.Kernel;
using Grasshopper.Kernel.Data;
using Grasshopper.Kernel.Types;

public class Script_Instance : GH_ScriptInstance
{
  private void RunScript(object x, object y, ref object A)
  {
    // Parameters for armchair parts - would need to be adjusted based on actual chair dimensions
    double seatHeight = 0.5;
    double seatWidth = 1.5;
    double seatDepth = 1.0;
    
    double backHeight = 1.5;
    double backWidth = 1.5;
    double backDepth = 0.2;
    
    double armHeight = 0.5;
    double armWidth = 0.3;
    double armDepth = 1.0;

    // Create seat as a Brep
    Box seatBox = new Box(Plane.WorldXY, new Interval(-seatWidth / 2, seatWidth / 2), new Interval(-seatDepth / 2, seatDepth / 2), new Interval(0, seatHeight));
    Brep seatBrep = Brep.CreateFromBox(seatBox);

    // Create back as a Brep
    Plane backPlane = new Plane(new Point3d(0, seatDepth / 2 + backDepth / 2, seatHeight), Vector3d.ZAxis);
    Rectangle3d backRect = new Rectangle3d(backPlane, backWidth, backHeight);
    Brep backBrep = Extrusion.Create(backRect.ToNurbsCurve(), backDepth, true).ToBrep();

    // Create arm as a Brep
    Plane armPlane = new Plane(new Point3d(-seatWidth / 2 - armWidth / 2, 0, 0), Vector3d.ZAxis);
    Box armBox = new Box(armPlane, new Interval(-armWidth / 2, armWidth / 2), new Interval(-armDepth / 2, armDepth / 2), new Interval(0, armHeight));
    Brep armLeftBrep = Brep.CreateFromBox(armBox);

    armPlane = new Plane(new Point3d(seatWidth / 2 + armWidth / 2, 0, 0), Vector3d.ZAxis);
    armBox = new Box(armPlane, new Interval(-armWidth / 2, armWidth / 2), new Interval(-armDepth / 2, armDepth / 2), new Interval(0, armHeight));
    Brep armRightBrep = Brep.CreateFromBox(armBox);

    // Output the Breps
    A = new List<Brep> { seatBrep, backBrep, armLeftBrep, armRightBrep };
  }

  // Override Methods
  public override void BeforeRunScript()
  {
    // Implementation code before running the script
  }
  
  // Additional helper methods and logic
}
# ---------- end armchair_001 ----------
armchair_002 = Script()  # -> out, A
# ---------- armchair_002: C# ----------
//Grasshopper Script Instance
//#! csharp
using System;
using System.Collections.Generic;
using Rhino.Geometry;

public class Script_Instance : GH_ScriptInstance
{
  private void RunScript(ref object A)
  {
    // Initialize a list to store the chair parts
    List<Brep> chairParts = new List<Brep>();

    // Define basic parameters (These values should be based on the desired dimensions of your chair)
    double seatWidth = 2.0;
    double seatDepth = 1.0;
    double seatHeight = 0.5;
    double backHeight = 2.0;
    double armHeight = 1.0;
    double armWidth = 0.3;

    // Create the seat surface with a slight curvature for comfort
    Point3d[] seatPoints = {
      new Point3d(-seatWidth / 2, -seatDepth / 2, 0),
      new Point3d(seatWidth / 2, -seatDepth / 2, 0),
      new Point3d(-seatWidth / 2, seatDepth / 2, 0),
      new Point3d(seatWidth / 2, seatDepth / 2, 0),
      new Point3d(-seatWidth / 2, -seatDepth / 6, seatHeight / 2),
      new Point3d(seatWidth / 2, -seatDepth / 6, seatHeight / 2),
      new Point3d(-seatWidth / 2, seatDepth / 6, seatHeight / 2),
      new Point3d(seatWidth / 2, seatDepth / 6, seatHeight / 2)
    };

    NurbsSurface seatSurface = NurbsSurface.CreateThroughPoints(seatPoints, 4, 2, 1, 1, false, false);

    // Create the backrest
    Curve backProfile = new Arc(new Point3d(0, seatDepth / 2, seatHeight), backHeight, Math.PI).ToNurbsCurve();
    Brep backBrep = Extrusion.Create(backProfile, seatWidth, true).ToBrep();

    // Create armrests using trigonometric functions to model the curvature
    List<Point3d> leftArmPoints = new List<Point3d>();
    List<Point3d> rightArmPoints = new List<Point3d>();
    for (double t = 0; t <= Math.PI; t += Math.PI / 10)
    {
      double z = (Math.Cos(t) + 1) * armHeight / 2;
      leftArmPoints.Add(new Point3d(-seatWidth / 2 - armWidth, Math.Sin(t) * seatDepth / 2, z));
      rightArmPoints.Add(new Point3d(seatWidth / 2 + armWidth, Math.Sin(t) * seatDepth / 2, z));
    }

    Curve leftArmCurve = Curve.CreateInterpolatedCurve(leftArmPoints, 3);
    Curve rightArmCurve = Curve.CreateInterpolatedCurve(rightArmPoints, 3);
    Brep leftArmBrep = Extrusion.Create(leftArmCurve, armWidth, true).ToBrep();
    Brep rightArmBrep = Extrusion.Create(rightArmCurve, armWidth, true).ToBrep();

    // Add the parts to the list
    chairParts.Add(seatSurface.ToBrep());
    chairParts.Add(backBrep);
    chairParts.Add(leftArmBrep);
    chairParts.Add(rightArmBrep);

    // Output the chair parts as separate Breps
    A = chairParts;
  }

  // Override Methods
  public override void BeforeRunScript()
  {
    // Implementation code before running the script
  }

  // Additional helper methods and logic
}
# ---------- end armchair_002 ----------
armchair_003 = Script()  # -> out, A
# ---------- armchair_003: C# ----------
//Grasshopper Script Instance
//#! csharp
using System;
using System.Collections.Generic;
using Rhino.Geometry;

public class Script_Instance : GH_ScriptInstance
{
  private void RunScript(ref object A)
  {
    // Define parameters for the armchair
    double seatWidth = 2.0;
    double seatDepth = 1.0;
    double seatHeight = 0.5;
    double backHeight = 2.0;
    double armHeight = 1.0;
    double armWidth = 0.3;
    double armElevation = 0.2; // Height above the seat
    double backCurveIntensity = 0.5; // Intensity of the curve for the back
    
    // Create the seat with a curve to mimic cushioning
    var seatCurvePoints = new List<Point3d>
    {
      new Point3d(-seatWidth / 2, -seatDepth / 2, 0),
      new Point3d(0, -seatDepth / 2, seatHeight / 4),
      new Point3d(seatWidth / 2, -seatDepth / 2, 0),
      new Point3d(seatWidth / 2, 0, seatHeight / 2),
      new Point3d(seatWidth / 2, seatDepth / 2, 0),
      new Point3d(0, seatDepth / 2, seatHeight / 4),
      new Point3d(-seatWidth / 2, seatDepth / 2, 0),
      new Point3d(-seatWidth / 2, 0, seatHeight / 2)
    };
    var seatCurve = Curve.CreateInterpolatedCurve(seatCurvePoints, 3);
    var seatSurface = Surface.CreateExtrusion(seatCurve, new Vector3d(0, 0, seatHeight)).ToBrep();

    // Create backrest with a spline for a more organic shape
    var backPoints = new List<Point3d>
    {
      new Point3d(-seatWidth / 2, seatDepth / 2 + backCurveIntensity, seatHeight),
      new Point3d(-seatWidth / 2, seatDepth / 2, backHeight + seatHeight),
      new Point3d(seatWidth / 2, seatDepth / 2, backHeight + seatHeight),
      new Point3d(seatWidth / 2, seatDepth / 2 + backCurveIntensity, seatHeight)
    };
    var backSpline = Curve.CreateControlPointCurve(backPoints, 3);
    var backSurface = Surface.CreateExtrusion(backSpline, new Vector3d(0, -backCurveIntensity * 2, 0)).ToBrep();

    // Create arms with a complex shape to mimic armrest cushioning and supports
    var armCurvePoints = new List<Point3d>
    {
      new Point3d(-seatWidth / 2 - armWidth, 0, armElevation),
      new Point3d(-seatWidth / 2 - armWidth / 2, -seatDepth / 4, armHeight + armElevation),
      new Point3d(-seatWidth / 2 - armWidth / 2, seatDepth / 4, armHeight + armElevation),
      new Point3d(-seatWidth / 2 - armWidth, 0, armElevation)
    };
    var armCurve = Curve.CreateInterpolatedCurve(armCurvePoints, 3);
    var leftArmSurface = Surface.CreateExtrusion(armCurve, new Vector3d(armWidth, 0, 0)).ToBrep();
    var rightArmSurface = leftArmSurface.DuplicateBrep();
    rightArmSurface.Translate(new Vector3d(seatWidth + 2 * armWidth, 0, 0));

    // Merge all parts into a single collection
    List<Brep> armchairParts = new List<Brep>
    {
      seatSurface,
      backSurface,
      leftArmSurface,
      rightArmSurface
    };

    // Output the armchair parts as separate Breps
    A = armchairParts;
  }

  // Override Methods
  public override void BeforeRunScript()
  {
    // Implementation code before running the script
  }

  // Additional helper methods and logic
}
# ---------- end armchair_003 ----------
armchair_004 = Script()  # -> out, A
# ---------- armchair_004: C# ----------
//Grasshopper Script Instance
//#! csharp
using System;
using System.Collections.Generic;
using Rhino.Geometry;

public class Script_Instance : GH_ScriptInstance
{
  private void RunScript(ref object A)
  {
    // Parameters for the armchair components
    double seatWidth = 2.0;
    double seatDepth = 1.0;
    double seatHeight = 0.5;
    double backWidth = seatWidth;
    double backHeight = 2.0;
    double backDepth = 0.2;
    double armWidth = 0.3;
    double armDepth = seatDepth;
    double armHeight = 0.7;

    // Create detailed seat
    Brep seat = CreateDetailedSeat(seatWidth, seatDepth, seatHeight);

    // Create detailed backrest
    Brep backrest = CreateDetailedBackrest(backWidth, backHeight, backDepth, seatHeight);

    // Create detailed armrests
    Brep leftArmrest = CreateDetailedArmrest(seatWidth, armWidth, armDepth, armHeight, true);
    Brep rightArmrest = CreateDetailedArmrest(seatWidth, armWidth, armDepth, armHeight, false);

    // Combine all parts into a single list
    List<Brep> armchairParts = new List<Brep> { seat, backrest, leftArmrest, rightArmrest };

    // Output the Breps
    A = armchairParts;
  }

  // Function to create a detailed seat with a cushioning effect
  private Brep CreateDetailedSeat(double width, double depth, double height)
  {
    // Define the points for the seat curves
    var pointsTop = new List<Point3d>
    {
      new Point3d(-width / 2, -depth / 2, height),
      new Point3d(0, -depth / 2, height * 1.25),
      new Point3d(width / 2, -depth / 2, height),
      new Point3d(width / 2, 0, height * 1.5),
      new Point3d(width / 2, depth / 2, height),
      new Point3d(0, depth / 2, height * 1.25),
      new Point3d(-width / 2, depth / 2, height),
      new Point3d(-width / 2, 0, height * 1.5),
      new Point3d(-width / 2, -depth / 2, height)  // Closing the curve
    };

    var pointsBottom = new List<Point3d>();
    foreach (var pt in pointsTop)
    {
      pointsBottom.Add(new Point3d(pt.X, pt.Y, 0));
    }

    // Ensuring the bottom curve is closed
    pointsBottom.Add(pointsBottom[0]);

    // Create the cushion surface
    var curveTop = Curve.CreateInterpolatedCurve(pointsTop, 3);
    var curveBottom = Curve.CreateInterpolatedCurve(pointsBottom, 3);

    // Loft the top and bottom curves to create the seat surface
    List<Brep> seatBreps = new List<Brep>();
    seatBreps.AddRange(Brep.CreateFromLoft(new Curve[] { curveBottom, curveTop }, Point3d.Unset, Point3d.Unset, LoftType.Straight, false));

    // Create the side surfaces of the seat
    for (int i = 0; i < pointsTop.Count - 1; i++)
    {
      int j = (i + 1) % (pointsTop.Count - 1);
      Curve sideCurve = Curve.CreateInterpolatedCurve(new Point3d[] { pointsBottom[i], pointsTop[i], pointsTop[j], pointsBottom[j] }, 3);
      Brep[] sideBreps = Brep.CreateFromLoft(new Curve[] { sideCurve }, Point3d.Unset, Point3d.Unset, LoftType.Straight, false);
      if (sideBreps.Length > 0)
      {
        seatBreps.Add(sideBreps[0]);
      }
    }

    return Brep.JoinBreps(seatBreps, Rhino.RhinoDoc.ActiveDoc.ModelAbsoluteTolerance)[0];
  }

  // Function to create a detailed backrest (placeholder)
  private Brep CreateDetailedBackrest(double width, double height, double depth, double seatHeight)
  {
    // Backrest creation logic
    // ...

    // Placeholder: Replace this with the actual Brep for the backrest
    return null;
  }

  // Function to create a detailed armrest (placeholder)
  private Brep CreateDetailedArmrest(double seatWidth, double armWidth, double armDepth, double armHeight, bool isLeft)
  {
    // Armrest creation logic
    // ...

    // Placeholder: Replace this with the actual Brep for the armrest
    return null;
  }

  // Override methods here if necessary
  public override void BeforeRunScript()
  {
    // Any code to run before the main script, if necessary
  }

  // Additional helper methods and logic can be added here
}
# ---------- end armchair_004 ----------
armchair_005 = Script()  # -> out, A
# ---------- armchair_005: C# ----------
//Grasshopper Script Instance
//#! csharp
using System;
using System.Collections.Generic;
using Rhino.Geometry;

public class Script_Instance : GH_ScriptInstance
{
  private void RunScript(ref object A)
  {
    // Parameters for the armchair components
    double seatWidth = 2.0;
    double seatDepth = 1.0;
    double seatHeight = 0.5;
    double backWidth = seatWidth;
    double backHeight = 2.0;
    double backDepth = 0.2;
    double armWidth = 0.3;
    double armDepth = seatDepth;
    double armHeight = 0.7;

    // Create detailed seat
    Brep seat = CreateDetailedSeat(seatWidth, seatDepth, seatHeight);

    // Create detailed backrest
    //Brep backrest = CreateDetailedBackrest(backWidth, backHeight, backDepth, seatHeight);

    // Create detailed armrests
    //Brep leftArmrest = CreateDetailedArmrest(seatWidth, armWidth, armDepth, armHeight, true);
    //Brep rightArmrest = CreateDetailedArmrest(seatWidth, armWidth, armDepth, armHeight, false);

    // Combine all parts into a single list
    //List<Brep> armchairParts = new List<Brep> { seat, backrest, leftArmrest, rightArmrest };

    // Output the Breps
    //A = armchairParts;
    A = seat;
  }

  // Function to create a detailed seat with a cushioning effect
  private Brep CreateDetailedSeat(double width, double depth, double height)
  {
    // Define the points for the seat curves, ensuring a smooth transition
    var pointsTop = new List<Point3d>
    {
      new Point3d(-width / 2, -depth / 4, height),
      new Point3d(-width / 2, 0, height * 1.25),
      new Point3d(-width / 2, depth / 4, height),
      new Point3d(-width / 4, depth / 2, height * 1.25),
      new Point3d(0, depth / 2, height),
      new Point3d(width / 4, depth / 2, height * 1.25),
      new Point3d(width / 2, depth / 4, height),
      new Point3d(width / 2, 0, height * 1.25),
      new Point3d(width / 2, -depth / 4, height),
      new Point3d(width / 4, -depth / 2, height * 1.25),
      new Point3d(0, -depth / 2, height),
      new Point3d(-width / 4, -depth / 2, height * 1.25),
      new Point3d(-width / 2, -depth / 4, height)  // Ensuring smooth closure
    };

    // Clone top points to bottom with height adjustment
    var pointsBottom = new List<Point3d>();
    foreach (var pt in pointsTop)
    {
      pointsBottom.Add(new Point3d(pt.X, pt.Y, 0));
    }

    // Create the cushion surface
    var curveTop = Curve.CreateInterpolatedCurve(pointsTop, 3);
    var curveBottom = Curve.CreateInterpolatedCurve(pointsBottom, 3);

    // Loft the top and bottom curves to create the seat surface
    List<Brep> seatBreps = new List<Brep>();
    seatBreps.AddRange(Brep.CreateFromLoft(new Curve[] { curveBottom, curveTop }, Point3d.Unset, Point3d.Unset, LoftType.Tight, false));

    // Create the side surfaces of the seat
    for (int i = 0; i < pointsTop.Count - 1; i++)
    {
      int j = (i + 1) % (pointsTop.Count - 1);
      Curve sideCurve = Curve.CreateInterpolatedCurve(new Point3d[] { pointsBottom[i], pointsTop[i], pointsTop[j], pointsBottom[j] }, 3);
      Brep[] sideBreps = Brep.CreateFromLoft(new Curve[] { sideCurve }, Point3d.Unset, Point3d.Unset, LoftType.Tight, false);
      if (sideBreps.Length > 0)
      {
        seatBreps.Add(sideBreps[0]);
      }
    }

    return Brep.JoinBreps(seatBreps, Rhino.RhinoDoc.ActiveDoc.ModelAbsoluteTolerance)[0];
  }

  // Placeholder functions for detailed backrest and armrest...

  // Override methods here if necessary
  public override void BeforeRunScript()
  {
    // Any code to run before the main script, if necessary
  }

  // Additional helper methods and logic can be added here
}
# ---------- end armchair_005 ----------
armchair_007 = Script()  # -> out, A
# ---------- armchair_007: C# ----------
//Grasshopper Script Instance
//#! csharp
using System;
using System.Collections.Generic;
using Rhino.Geometry;

public class Script_Instance : GH_ScriptInstance
{
  private void RunScript(ref object A)
  {
    // Parameters for the armchair components
    double seatWidth = 2.0;
    double seatDepth = 1.0;
    double seatHeight = 0.5;
    double backWidth = seatWidth;
    double backHeight = 2.0;
    double backDepth = 0.2;
    double armWidth = 0.3;
    double armDepth = seatDepth;
    double armHeight = 0.7;

    // Create detailed seat
    Brep seat = CreateDetailedSeat(seatWidth, seatDepth, seatHeight);

    // Create detailed backrest
    //Brep backrest = CreateDetailedBackrest(backWidth, backHeight, backDepth, seatHeight);

    // Create detailed armrests
    //Brep leftArmrest = CreateDetailedArmrest(seatWidth, armWidth, armDepth, armHeight, true);
    //Brep rightArmrest = CreateDetailedArmrest(seatWidth, armWidth, armDepth, armHeight, false);

    // Combine all parts into a single list
    //List<Brep> armchairParts = new List<Brep> { seat, backrest, leftArmrest, rightArmrest };

    // Output the Breps
    //A = armchairParts;
    A = seat;
  }

  private Brep CreateDetailedSeat(double width, double depth, double height)
  {
    // Define the points for the seat curves
    var pointsTop = new List<Point3d>
    {
      new Point3d(-width / 2, 0, height),
      new Point3d(-width / 2, depth / 4, height),
      new Point3d(-width / 4, depth / 2, height * 1.25),
      new Point3d(0, depth / 2, height),
      new Point3d(width / 4, depth / 2, height * 1.25),
      new Point3d(width / 2, depth / 4, height),
      new Point3d(width / 2, 0, height),
      new Point3d(width / 2, -depth / 4, height),
      new Point3d(width / 4, -depth / 2, height * 1.25),
      new Point3d(0, -depth / 2, height),
      new Point3d(-width / 4, -depth / 2, height * 1.25),
      new Point3d(-width / 2, -depth / 4, height),
      new Point3d(-width / 2, 0, height)  // Ensuring a smooth closure
    };

    // Creating the bottom points
    var pointsBottom = new List<Point3d>();
    foreach (var pt in pointsTop)
    {
      pointsBottom.Add(new Point3d(pt.X, pt.Y, 0));
    }

    // Creating the top and bottom curves
    var curveTop = Curve.CreateInterpolatedCurve(pointsTop, 3);
    var curveBottom = Curve.CreateInterpolatedCurve(pointsBottom, 3);

    // Create top surface
    Brep[] topSurfaces = Brep.CreatePlanarBreps(curveTop);
    Brep topSurface = topSurfaces[0];

    // Create bottom surface
    Brep[] bottomSurfaces = Brep.CreatePlanarBreps(curveBottom);
    Brep bottomSurface = bottomSurfaces[0];

    // Lofting the top and bottom curves to create the side surfaces
    List<Brep> seatBreps = new List<Brep>();
    for (int i = 0; i < pointsTop.Count - 1; i++)
    {
      int j = (i + 1) % (pointsTop.Count - 1);
      Curve sideCurve = Curve.CreateInterpolatedCurve(new Point3d[] { pointsBottom[i], pointsTop[i], pointsTop[j], pointsBottom[j] }, 3);
      Brep[] sideBreps = Brep.CreateFromLoft(new Curve[] { sideCurve }, Point3d.Unset, Point3d.Unset, LoftType.Tight, false);
      if (sideBreps.Length > 0)
      {
        seatBreps.AddRange(sideBreps);
      }
    }

    // Adding the top and bottom surfaces to the list of breps
    seatBreps.Add(topSurface);
    seatBreps.Add(bottomSurface);

    // Joining all parts to form the complete seat
    return Brep.JoinBreps(seatBreps, Rhino.RhinoDoc.ActiveDoc.ModelAbsoluteTolerance)[0];
  }

  // Placeholder functions for detailed backrest and armrest...
  // These should be filled in with actual logic to create these components

  // Override methods here if necessary
  public override void BeforeRunScript()
  {
    // Any code to run before the main script, if necessary
  }

  // Additional helper methods and logic can be added here
}
# ---------- end armchair_007 ----------
armchair_006 = Script()  # -> out, A
# ---------- armchair_006: C# ----------
//Grasshopper Script Instance
//#! csharp
using System;
using System.Collections.Generic;
using Rhino.Geometry;

public class Script_Instance : GH_ScriptInstance
{
  private void RunScript(ref object A)
  {
    // Parameters for the armchair components
    double seatWidth = 2.0;
    double seatDepth = 1.0;
    double seatHeight = 0.5;
    double backWidth = seatWidth;
    double backHeight = 2.0;
    double backDepth = 0.2;
    double armWidth = 0.3;
    double armDepth = seatDepth;
    double armHeight = 0.7;

    // Create detailed seat
    Brep seat = CreateDetailedSeat(seatWidth, seatDepth, seatHeight);

    // Create detailed backrest
    //Brep backrest = CreateDetailedBackrest(backWidth, backHeight, backDepth, seatHeight);

    // Create detailed armrests
    //Brep leftArmrest = CreateDetailedArmrest(seatWidth, armWidth, armDepth, armHeight, true);
    //Brep rightArmrest = CreateDetailedArmrest(seatWidth, armWidth, armDepth, armHeight, false);

    // Combine all parts into a single list
    //List<Brep> armchairParts = new List<Brep> { seat, backrest, leftArmrest, rightArmrest };

    // Output the Breps
    //A = armchairParts;
    A = seat;
  }

  private Brep CreateDetailedSeat(double width, double depth, double height)
  {
    // Smoothly interpolating the corner by adjusting control points
    var pointsTop = new List<Point3d>
    {
      new Point3d(-width / 2, 0, height),
      new Point3d(-width / 2, depth / 4, height),
      new Point3d(-width / 4, depth / 2, height * 1.25),
      new Point3d(0, depth / 2, height),
      new Point3d(width / 4, depth / 2, height * 1.25),
      new Point3d(width / 2, depth / 4, height),
      new Point3d(width / 2, 0, height),
      new Point3d(width / 2, -depth / 4, height),
      new Point3d(width / 4, -depth / 2, height * 1.25),
      new Point3d(0, -depth / 2, height),
      new Point3d(-width / 4, -depth / 2, height * 1.25),
      new Point3d(-width / 2, -depth / 4, height),
      new Point3d(-width / 2, 0, height)  // Ensuring a smooth closure
    };

    // Creating the bottom points by mirroring the top points along the height axis
    var pointsBottom = new List<Point3d>();
    foreach (var pt in pointsTop)
    {
      pointsBottom.Add(new Point3d(pt.X, pt.Y, 0));
    }

    // Creating the top and bottom curves
    var curveTop = Curve.CreateInterpolatedCurve(pointsTop, 3);
    var curveBottom = Curve.CreateInterpolatedCurve(pointsBottom, 3);

    // Lofting the top and bottom curves to create the seat surface
    List<Brep> seatBreps = new List<Brep>();
    seatBreps.AddRange(Brep.CreateFromLoft(new Curve[] { curveBottom, curveTop }, Point3d.Unset, Point3d.Unset, LoftType.Tight, false));

    // Creating the side surfaces
    for (int i = 0; i < pointsTop.Count - 1; i++)
    {
      int j = (i + 1) % (pointsTop.Count - 1);
      Curve sideCurve = Curve.CreateInterpolatedCurve(new Point3d[] { pointsBottom[i], pointsTop[i], pointsTop[j], pointsBottom[j] }, 3);
      Brep[] sideBreps = Brep.CreateFromLoft(new Curve[] { sideCurve }, Point3d.Unset, Point3d.Unset, LoftType.Tight, false);
      if (sideBreps.Length > 0)
      {
        seatBreps.Add(sideBreps[0]);
      }
    }

    // Joining all parts to form the complete seat
    return Brep.JoinBreps(seatBreps, Rhino.RhinoDoc.ActiveDoc.ModelAbsoluteTolerance)[0];
  }

  // Placeholder functions for detailed backrest and armrest...
  // These should be filled in with actual logic to create these components

  // Override methods here if necessary
  public override void BeforeRunScript()
  {
    // Any code to run before the main script, if necessary
  }

  // Additional helper methods and logic can be added here
}
# ---------- end armchair_006 ----------
geometry = Geometry(armchair_003.A)
geometry_2 = Geometry(armchair_004.A)
geometry_3 = Geometry(armchair_005.A)
geometry_4 = Geometry(armchair_007.A)
geometry_5 = Geometry(armchair_001.A)
geometry_6 = Geometry(armchair_002.A)
geometry_7 = Geometry(armchair_006.A)
param_viewer = ParamViewer(geometry)
panel = Panel(armchair_003.out)
panel_2 = Panel(geometry)
param_viewer_2 = ParamViewer(geometry_2)
param_viewer_3 = ParamViewer(geometry_3)
panel_3 = Panel(armchair_004.out)
panel_4 = Panel(armchair_005.out)
param_viewer_4 = ParamViewer(geometry_4)
panel_5 = Panel(geometry_2)
param_viewer_5 = ParamViewer(geometry_5)
param_viewer_6 = ParamViewer(geometry_6)
panel_6 = Panel(geometry_3)
param_viewer_7 = ParamViewer(geometry_7)
panel_7 = Panel(armchair_007.out)
panel_8 = Panel(geometry_4)
panel_9 = Panel(armchair_006.out)
panel_10 = Panel(geometry_5)
panel_11 = Panel(geometry_6)
panel_12 = Panel(geometry_7)
panel_13 = Panel(armchair_001.out)
panel_14 = Panel(armchair_002.out)
# Created at
# Wickerson Studios
# copyright 2024
# download all materials at
# www.wickersonstudios.com
# Parametric Arm Chair from
# gpt Image Prompt
number_slider_31 = Slider(10, range=0..10)
number_slider_32 = Slider(4.3, range=0..10)
number_slider_33 = Slider(3, range=0..10)
number_slider_34 = Slider(3, range=0..10)
number_slider_35 = Slider(0.8, range=0..1)
number_slider_36 = Slider(4, range=0..10)
number_slider_37 = Slider(0.583, range=0..1)
number_slider_38 = Slider(3, range=0..10)
number_slider_39 = Slider(5, range=0..10)
number_slider_40 = Slider(0.247, range=0..1)
geometry_8 = Geometry()
param_viewer_8 = ParamViewer(geometry_8)
panel_15 = Panel(geometry_8)
