# Grasshopper definition architecture_bridge_001.gh (Grasshopper 1.0.8)
# plug-ins: RhinoCodePluginGH

number_slider = Slider(7.7, range=0..20)
number_slider_2 = Slider(101.9, range=0..200)
number_slider_3 = Slider(5, range=0..10)
number_slider_4 = Slider(25.9, range=0..100)
number_slider_5 = Slider(7.5, range=0..10)
number_slider_6 = Slider(19.5, range=0..100)
number_slider_7 = Slider(7.7, range=0..20)
number_slider_8 = Slider(101.9, range=0..200)
number_slider_9 = Slider(5, range=0..10)
number_slider_10 = Slider(25.9, range=0..100)
number_slider_11 = Slider(7.5, range=0..10)
number_slider_12 = Slider(19.5, range=0..100)
number_slider_13 = Slider(10.9, range=0..20)
number_slider_14 = Slider(101.9, range=0..200)
number_slider_15 = Slider(5, range=0..10)
number_slider_16 = Slider(25.9, range=0..100)
number_slider_17 = Slider(7.5, range=0..10)
number_slider_18 = Slider(19.5, range=0..100)
bridge_003 = Script()  # -> out, A
# ---------- bridge_003: C# ----------
// Grasshopper Script Instance
//#! csharp
using System;
using System.Collections.Generic;
using Rhino.Geometry;

public class Script_Instance : GH_ScriptInstance
{
  private void RunScript(object x, object y, ref object A)
  {
    // Define the basic dimensions based on the image
    double length = 30.0; // approximate length of the bridge
    double width = 4.0;   // approximate width of the bridge
    double deckThickness = 0.5; // thickness of the deck
    double pillarWidth = 1.5; // width of the pillars
    double pillarHeight = 5.0; // height from the base to the deck
    double railingHeight = 1.0; // height of the railings above the deck
    double railingWidth = 0.1; // width of the railing elements

    // Create the bridge deck
    var deck = CreateDeck(length, width, deckThickness);

    // Create the pillars
    var pillars = CreatePillars(pillarWidth, pillarHeight, length, width);

    // Create the railings
    var railings = CreateRailings(length, width, railingHeight, railingWidth);

    // Combine all components
    List<object> bridgeComponents = new List<object>();
    bridgeComponents.Add(deck);
    bridgeComponents.AddRange(pillars);
    bridgeComponents.AddRange(railings);

    A = bridgeComponents;
  }

  // Methods to create each component
  Brep CreateDeck(double length, double width, double thickness)
  {
    // Create a rectangular deck
    var deck = Brep.CreateFromBox(new Box(Plane.WorldXY, new Interval(-length / 2, length / 2), new Interval(-width / 2, width / 2), new Interval(-thickness, 0)));
    return deck;
  }

  List<Brep> CreatePillars(double width, double height, double bridgeLength, double bridgeWidth)
  {
    List<Brep> pillars = new List<Brep>();

    // Pillar design would be added here
    // This is a placeholder for a simple pillar design - replace with custom logic
    double pillarSpacing = bridgeLength / 5;
    for (double i = -bridgeLength / 2 + pillarSpacing; i <= bridgeLength / 2; i += pillarSpacing)
    {
      var pillar = Brep.CreateFromBox(new Box(Plane.WorldXY, new Interval(i - width / 2, i + width / 2), new Interval(-bridgeWidth / 2, bridgeWidth / 2), new Interval(-height, 0)));
      pillars.Add(pillar);
    }

    return pillars;
  }

  List<Brep> CreateRailings(double bridgeLength, double bridgeWidth, double height, double width)
  {
    List<Brep> railings = new List<Brep>();

    // Railing design would be added here
    // This is a placeholder for a simple railing design - replace with custom logic
    double railingPostSpacing = 1.0; // Distance between railing posts
    for (double i = -bridgeLength / 2; i <= bridgeLength / 2; i += railingPostSpacing)
    {
      // Create vertical railing posts
      var post = Brep.CreateFromBox(new Box(Plane.WorldXY, new Interval(i - width / 2, i + width / 2), new Interval(-bridgeWidth / 2 - width, -bridgeWidth / 2), new Interval(0, height)));
      railings.Add(post);
      post = Brep.CreateFromBox(new Box(Plane.WorldXY, new Interval(i - width / 2, i + width / 2), new Interval(bridgeWidth / 2, bridgeWidth / 2 + width), new Interval(0, height)));
      railings.Add(post);

      // Create horizontal railing bars
      if (i > -bridgeLength / 2) // To avoid duplicating the first bar
      {
        var bar = Brep.CreateFromBox(new Box(Plane.WorldXY, new Interval(i - railingPostSpacing, i), new Interval(-bridgeWidth / 2 - width, -bridgeWidth / 2), new Interval(height - width, height)));
        railings.Add(bar);
        bar = Brep.CreateFromBox(new Box(Plane.WorldXY, new Interval(i - railingPostSpacing, i), new Interval(bridgeWidth / 2, bridgeWidth / 2 + width), new Interval(height - width, height)));
        railings.Add(bar);
      }
    }

    return railings;
  }
}
# ---------- end bridge_003 ----------
bridge_001 = Script()  # -> out, A
# ---------- bridge_001: C# ----------
// Grasshopper Script Instance
//#! csharp
using System;
using System.Collections;
using System.Collections.Generic;
using System.Drawing;

using Rhino;
using Rhino.Geometry;

using Grasshopper;
using Grasshopper.Kernel;
using Grasshopper.Kernel.Data;
using Grasshopper.Kernel.Types;

public class Script_Instance : GH_ScriptInstance
{
  private void RunScript(object x, object y, ref object A)
  {
    // Initialize a list to hold separate bridge components
    List<Brep> bridgeComponents = new List<Brep>();
    
    // Parameters for bridge dimensions - these would need to be replaced with actual dimensions
    double length = 20.0; // Example length of the bridge
    double width = 5.0;  // Example width of the bridge
    double height = 3.0; // Example height of the pillars
    double railingHeight = 1.0; // Example height of the railings
    
    // Create the deck of the bridge
    Rectangle3d deckRect = new Rectangle3d(Plane.WorldXY, length, width);
    Brep deck = Brep.CreatePlanarBreps(deckRect.ToNurbsCurve())[0];
    bridgeComponents.Add(deck);
    
    // Create the pillars
    for (int i = 0; i < 2; i++)
    {
      Point3d basePoint = new Point3d(i * length, width / 2, 0);
      Cylinder pillar = new Cylinder(new Circle(basePoint, 0.5), height);
      bridgeComponents.Add(pillar.ToBrep(true, true));
    }
    
    // Create the railings
    for (int i = 0; i < 2; i++)
    {
      Point3d startPoint = new Point3d(0, i * width, height);
      Point3d endPoint = new Point3d(length, i * width, height);
      Line railLine = new Line(startPoint, endPoint);
      Extrusion railing = Extrusion.Create(railLine.ToNurbsCurve(), railingHeight, true);
      bridgeComponents.Add(railing.ToBrep());
    }
    
    // Output the bridge components
    A = bridgeComponents.ConvertAll(o => (object)o);
  }
}
# ---------- end bridge_001 ----------
bridge_002 = Script()  # -> out, A
# ---------- bridge_002: C# ----------
// Grasshopper Script Instance
//#! csharp
using System;
using System.Collections.Generic;
using Rhino.Geometry;

public class Script_Instance : GH_ScriptInstance
{
  private void RunScript(object x, object y, ref object A)
  {
    // Define the dimensions based on the image
    double length = 30.0; // Length of the bridge
    double width = 4.0;  // Width of the bridge
    double deckThickness = 0.5; // Thickness of the bridge deck
    double pillarWidth = 1.5; // Width of the pillars
    double pillarHeight = 5.0; // Height of the pillars
    double railingHeight = 2.0; // Height of the railing above the deck
    double railingWidth = 0.2; // Width of the railing elements

    // Create deck
    Brep deck = Brep.CreateFromBox(new Box(Plane.WorldXY, new Interval(-length / 2, length / 2), new Interval(-width / 2, width / 2), new Interval(-deckThickness, 0)));
    
    // Create pillars
    List<Brep> pillars = CreatePillars(pillarWidth, pillarHeight, length, width);

    // Create railings
    List<Brep> railings = CreateRailings(length, width, railingWidth, railingHeight, deckThickness);

    // Combine all components
    var bridgeComponents = new List<object> { deck };
    bridgeComponents.AddRange(pillars.ConvertAll(o => (object)o));
    bridgeComponents.AddRange(railings.ConvertAll(o => (object)o));

    A = bridgeComponents;
  }

  // <Custom additional code> 
  List<Brep> CreatePillars(double pillarWidth, double pillarHeight, double length, double width)
  {
    List<Brep> pillars = new List<Brep>();
    double pillarSpacing = length / 4; // Adjust based on the number of pillars desired
    
    for (int i = -1; i <= 1; i += 2) // Positions pillars at both ends of the bridge
    {
      Point3d basePoint = new Point3d(i * (length / 2 - pillarSpacing / 2), 0, -pillarHeight);
      Box pillarBox = new Box(Plane.WorldXY, new Interval(basePoint.X - pillarWidth / 2, basePoint.X + pillarWidth / 2), new Interval(basePoint.Y - width / 2, basePoint.Y + width / 2), new Interval(basePoint.Z, 0));
      pillars.Add(Brep.CreateFromBox(pillarBox));
    }

    return pillars;
  }

  List<Brep> CreateRailings(double length, double width, double railingWidth, double railingHeight, double deckThickness)
  {
    List<Brep> railings = new List<Brep>();
    double railingPostSpacing = 2.0; // Distance between vertical railing posts

    // Top railing bar
    foreach (var edge in new[] { width / 2, -width / 2 })
    {
      Box topRailing = new Box(Plane.WorldXY, new Interval(-length / 2, length / 2), new Interval(edge - railingWidth / 2, edge + railingWidth / 2), new Interval(deckThickness, deckThickness + railingHeight));
      railings.Add(Brep.CreateFromBox(topRailing));
    }

    // Railing posts
    for (double i = -length / 2; i <= length / 2; i += railingPostSpacing)
    {
      foreach (var edge in new[] { width / 2, -width / 2 })
      {
        Box post = new Box(Plane.WorldXY, new Interval(i - railingWidth / 2, i + railingWidth / 2), new Interval(edge - railingWidth / 2, edge + railingWidth / 2), new Interval(deckThickness, deckThickness + railingHeight));
        railings.Add(Brep.CreateFromBox(post));
      }
    }

    return railings;
  }
  // </Custom additional code> 
}
# ---------- end bridge_002 ----------
param_viewer = ParamViewer(bridge_003.A)
panel = Panel(bridge_003.out)
panel_2 = Panel(bridge_003.A)
panel_3 = Panel(bridge_002.out)
panel_4 = Panel(bridge_002.A)
panel_5 = Panel(bridge_001.A)
# Created at
# Wickerson Studios
# copywrite 2024
# download all materials at
# www.wickersonstudios.com
panel_6 = Panel(bridge_001.out)
# Parametric Bridge from
# gpt Image Prompt
number_slider_19 = Slider(31.4, range=0..40)
bridge_004 = Script(
    length=number_slider_19,
    width=Slider(4.99, range=0..10),
    deckThickness=Slider(0.69, range=0..1),
    pillarWidth=Slider(1.8, range=0..10),
    pillarHeight=Slider(6.1, range=0..10),
    railingHeight=Slider(0.9, range=0..10),
    railingWidth=Slider(0.122, range=0..1))  # -> out, A; inputs length: Double, width: Double, deckThickness: Double, pillarWidth: Double, pillarHeight: Double, railingHeight: Double, railingWidth: Double
# ---------- bridge_004: C# ----------
// Grasshopper Script Instance
//#! csharp
using System;
using System.Collections.Generic;
using Rhino.Geometry;

public class Script_Instance : GH_ScriptInstance
{
  private void RunScript(
	double length,
	double width,
	double deckThickness,
	double pillarWidth,
	double pillarHeight,
	double railingHeight,
	double railingWidth,
	ref object A)
  {
    // Define the basic dimensions based on the image
    //double length = 30.0; // approximate length of the bridge
    //double width = 4.0;   // approximate width of the bridge
    //double deckThickness = 0.5; // thickness of the deck
    //double pillarWidth = 1.5; // width of the pillars
    //double pillarHeight = 5.0; // height from the base to the deck
    //double railingHeight = 1.0; // height of the railings above the deck
    //double railingWidth = 0.1; // width of the railing elements

    // Create the bridge deck
    var deck = CreateDeck(length, width, deckThickness);

    // Create the pillars
    var pillars = CreatePillars(pillarWidth, pillarHeight, length, width);

    // Create the railings
    var railings = CreateRailings(length, width, railingHeight, railingWidth);

    // Combine all components
    List<object> bridgeComponents = new List<object>();
    bridgeComponents.Add(deck);
    bridgeComponents.AddRange(pillars);
    bridgeComponents.AddRange(railings);

    A = bridgeComponents;
  }

  // Methods to create each component
  Brep CreateDeck(double length, double width, double thickness)
  {
    // Create a rectangular deck
    var deck = Brep.CreateFromBox(new Box(Plane.WorldXY, new Interval(-length / 2, length / 2), new Interval(-width / 2, width / 2), new Interval(-thickness, 0)));
    return deck;
  }

  List<Brep> CreatePillars(double width, double height, double bridgeLength, double bridgeWidth)
  {
    List<Brep> pillars = new List<Brep>();

    // Pillar design would be added here
    // This is a placeholder for a simple pillar design - replace with custom logic
    double pillarSpacing = bridgeLength / 5;
    for (double i = -bridgeLength / 2 + pillarSpacing; i <= bridgeLength / 2; i += pillarSpacing)
    {
      var pillar = Brep.CreateFromBox(new Box(Plane.WorldXY, new Interval(i - width / 2, i + width / 2), new Interval(-bridgeWidth / 2, bridgeWidth / 2), new Interval(-height, 0)));
      pillars.Add(pillar);
    }

    return pillars;
  }

  List<Brep> CreateRailings(double bridgeLength, double bridgeWidth, double height, double width)
  {
    List<Brep> railings = new List<Brep>();

    // Railing design would be added here
    // This is a placeholder for a simple railing design - replace with custom logic
    double railingPostSpacing = 1.0; // Distance between railing posts
    for (double i = -bridgeLength / 2; i <= bridgeLength / 2; i += railingPostSpacing)
    {
      // Create vertical railing posts
      var post = Brep.CreateFromBox(new Box(Plane.WorldXY, new Interval(i - width / 2, i + width / 2), new Interval(-bridgeWidth / 2 - width, -bridgeWidth / 2), new Interval(0, height)));
      railings.Add(post);
      post = Brep.CreateFromBox(new Box(Plane.WorldXY, new Interval(i - width / 2, i + width / 2), new Interval(bridgeWidth / 2, bridgeWidth / 2 + width), new Interval(0, height)));
      railings.Add(post);

      // Create horizontal railing bars
      if (i > -bridgeLength / 2) // To avoid duplicating the first bar
      {
        var bar = Brep.CreateFromBox(new Box(Plane.WorldXY, new Interval(i - railingPostSpacing, i), new Interval(-bridgeWidth / 2 - width, -bridgeWidth / 2), new Interval(height - width, height)));
        railings.Add(bar);
        bar = Brep.CreateFromBox(new Box(Plane.WorldXY, new Interval(i - railingPostSpacing, i), new Interval(bridgeWidth / 2, bridgeWidth / 2 + width), new Interval(height - width, height)));
        railings.Add(bar);
      }
    }

    return railings;
  }
}
# ---------- end bridge_004 ----------
param_viewer_2 = ParamViewer(bridge_004.A)
panel_7 = Panel(bridge_004.out)
panel_8 = Panel(bridge_004.A)
