# Grasshopper definition architecture_column_001.gh (Grasshopper 1.0.8)
# plug-ins: RhinoCodePluginGH

script = Script()  # -> out, A
# ---------- script: C# ----------
// Grasshopper Script Instance
using System;
using System.Collections;
using System.Collections.Generic;
using System.Drawing;

using Rhino;
using Rhino.Geometry;

using Grasshopper;
using Grasshopper.Kernel;
using Grasshopper.Kernel.Data;
using Grasshopper.Kernel.Types;

using Rhino.Geometry;
using System.Collections.Generic;

void RunScript(ref object A)
{
    var hull = CreateHull();
    var cabin = CreateCabin();

    var boatParts = new List<Brep>();
    if(hull != null)
        boatParts.Add(hull);
    if(cabin != null)
        boatParts.Add(cabin);

    A = boatParts.Count > 0 ? Brep.JoinBreps(boatParts, Rhino.RhinoDoc.ActiveDoc.ModelAbsoluteTolerance) : null;
}

Brep CreateHull()
{
    var points = new List<Point3d>
    {
        new Point3d(-5, -2, 0),
        new Point3d(-3, -2, 2),
        new Point3d(0, -2, 3),
        new Point3d(3, -2, 2),
        new Point3d(5, -2, 0),
        new Point3d(5, 2, 0),
        new Point3d(3, 2, 2),
        new Point3d(0, 2, 3),
        new Point3d(-3, 2, 2),
        new Point3d(-5, 2, 0),
        new Point3d(-5, -2, 0)
    };

    var hullCurve = new PolylineCurve(points);
    var hullBrep = Brep.CreatePlanarBreps(hullCurve)[0];
    
    return hullBrep;
}

Brep CreateCabin()
{
    var baseRectangle = new Rectangle3d(Plane.WorldXY, 1, 0.5);
    var cabinCurve = baseRectangle.ToNurbsCurve();
    
    // Extrude the curve to create the cabin shape
    var extrusionVector = new Vector3d(0, 0, 1);
    var cabin = cabinCurve.Extrude(extrusionVector);
    
    // Move the cabin into position on top of the hull
    cabin.Translate(0, 0, 3);

    return cabin;
}
# ---------- end script ----------
