# Grasshopper definition architecture_robotArm_001.gh (Grasshopper 1.0.8)
# plug-ins: RhinoCodePluginGH

number_slider = Slider(2.9, range=0..10)
number_slider_2 = Slider(25.9, range=0..100)
number_slider_3 = Slider(7.7, range=0..20)
number_slider_4 = Slider(101.9, range=0..200)
number_slider_5 = Slider(5, range=0..10)
number_slider_6 = Slider(7.5, range=0..10)
number_slider_7 = Slider(19.5, range=0..100)
number_slider_8 = Slider(7.7, range=0..20)
number_slider_9 = Slider(101.9, range=0..200)
number_slider_10 = Slider(5, range=0..10)
number_slider_11 = Slider(25.9, range=0..100)
number_slider_12 = Slider(7.5, range=0..10)
number_slider_13 = Slider(19.5, range=0..100)
number_slider_14 = Slider(7.7, range=0..20)
number_slider_15 = Slider(101.9, range=0..200)
number_slider_16 = Slider(5, range=0..10)
number_slider_17 = Slider(25.9, range=0..100)
number_slider_18 = Slider(7.5, range=0..10)
number_slider_19 = Slider(19.5, range=0..100)
number_slider_20 = Slider(7.7, range=0..20)
number_slider_21 = Slider(101.9, range=0..200)
number_slider_22 = Slider(5, range=0..10)
number_slider_23 = Slider(25.9, range=0..100)
number_slider_24 = Slider(7.5, range=0..10)
number_slider_25 = Slider(19.5, range=0..100)
number_slider_26 = Slider(10.9, range=0..20)
number_slider_27 = Slider(101.9, range=0..200)
number_slider_28 = Slider(5, range=0..10)
number_slider_29 = Slider(25.9, range=0..100)
number_slider_30 = Slider(7.5, range=0..10)
number_slider_31 = Slider(19.5, range=0..100)
temple_005 = Script(
    baseLength=Slider(40, range=0..40),
    baseWidth=Slider(26.8, range=0..40),
    baseHeight=number_slider,
    levelHeight=Slider(5.88, range=0..10),
    numberOfLevels=Slider(4, range=0..10),
    levelInset=Slider(4.42, range=0..10),
    roofHeight=Slider(5.88, range=0..10),
    roofOverhang=Slider(2.9, range=0..10),
    stairWidth=Slider(10, range=0..10),
    stairDepth=Slider(17.25, range=0..20),
    stairHeight=number_slider,
    numberOfStairs=Slider(3, range=0..10),
    windowHeight=Slider(2.7, range=0..10),
    windowWidth=Slider(1.1, range=0..10),
    windowDepth=Slider(0.2, range=0..1),
    windowElevation=Slider(0.98, range=0..10),
    doorHeight=Slider(3.4, range=0..10),
    doorWidth=Slider(1.7, range=0..10),
    doorDepth=Slider(0.5, range=0..1),
    doorElevation=Slider(0, range=0..1))  # -> out, A; inputs baseLength: Double, baseWidth: Double, baseHeight: Double, levelHeight: Double, numberOfLevels: Int32, levelInset: Double, roofHeight: Double, roofOverhang: Double, stairWidth: Double, stairDepth: Double, stairHeight: Double, numberOfStairs: Int32, windowHeight: Double, windowWidth: Double, windowDepth: Double, windowElevation: Double, doorHeight: Double, doorWidth: Double, doorDepth: Double, doorElevation: Double
# ---------- temple_005: C# ----------
// Grasshopper Script Instance
//#! csharp
using System;
using System.Collections.Generic;
using Rhino.Geometry;
using Grasshopper.Kernel;

public class Script_Instance : GH_ScriptInstance
{
  private void RunScript(
	double baseLength,
	double baseWidth,
	double baseHeight,
	double levelHeight,
	int numberOfLevels,
	double levelInset,
	double roofHeight,
	double roofOverhang,
	double stairWidth,
	double stairDepth,
	double stairHeight,
	int numberOfStairs,
	double windowHeight,
	double windowWidth,
	double windowDepth,
	double windowElevation,
	double doorHeight,
	double doorWidth,
	double doorDepth,
	double doorElevation,
	ref object A)
  {
    // Initialize fields within RunScript
    //double baseLength = 50.0;
    //double baseWidth = 30.0;
    //double baseHeight = 3.0;
    //double levelHeight = 6.0;
    //int numberOfLevels = 4;
    //double levelInset = 4.0;
    //double roofHeight = 5.0;
    //double roofOverhang = 2.0;
    //double stairWidth = 10.0;
    //double stairDepth = 15.0;
    //double stairHeight = baseHeight;
    //int numberOfStairs = 5;

    //double windowHeight = 2.0;
    //double windowWidth = 1.0;
    //double windowDepth = 0.2;
    //double windowElevation = 1.0;
    //double doorHeight = 3.0;
    //double doorWidth = 1.5;
    //double doorDepth = 0.5;
    //double doorElevation = 0.0;

    try
    {
      List<Brep> templeComponents = new List<Brep>();

      Brep basePlatform = CreatePlatform(baseLength, baseWidth, baseHeight);
      CenterGeometry(basePlatform);
      templeComponents.Add(basePlatform);

      for (int i = 1; i <= numberOfLevels; i++)
      {
        double inset = levelInset * i;
        Brep level = CreatePlatform(baseLength - inset, baseWidth - inset, levelHeight);
        CenterGeometry(level, baseHeight + levelHeight * (i - 1));
        templeComponents.Add(level);
      }

      double finalLength = baseLength - (levelInset * numberOfLevels);
      double finalWidth = baseWidth - (levelInset * numberOfLevels);
      Brep roof = CreateRoof(finalLength, finalWidth, roofHeight, roofOverhang, numberOfLevels, levelHeight);
      CenterGeometry(roof, baseHeight + numberOfLevels * levelHeight);
      templeComponents.Add(roof);

      Brep stairs = CreateStairs(stairWidth, stairDepth, stairHeight, numberOfStairs);
      CenterGeometry(stairs, 0, -baseWidth / 2 - stairDepth / 2);
      templeComponents.Add(stairs);

      if (numberOfLevels > 0)
      {
        Brep firstLevel = templeComponents[1];
        List<Brep> firstLevelWindows = CreateWindows(firstLevel, windowWidth, windowHeight, windowDepth, windowElevation);
        List<Brep> firstLevelDoors = CreateDoors(firstLevel, doorWidth, doorHeight, doorDepth, doorElevation);
        templeComponents.AddRange(firstLevelWindows);
        templeComponents.AddRange(firstLevelDoors);
      }

      A = templeComponents;
    }
    catch (Exception e)
    {
      this.Component.AddRuntimeMessage(GH_RuntimeMessageLevel.Error, e.ToString());
    }
  }

  private Brep CreatePlatform(double length, double width, double height)
  {
    var box = new Box(Plane.WorldXY, new Interval(-length / 2, length / 2), new Interval(-width / 2, width / 2), new Interval(0, height));
    return Brep.CreateFromBox(box);
  }

  private Brep CreateRoof(double baseLength, double baseWidth, double height, double overhang, int numberOfLevels, double levelHeight)
  {
    var length = baseLength + overhang * 2;
    var width = baseWidth + overhang * 2;
    var roofBase = CreatePlatform(length, width, height);
    return roofBase;
  }

  private Brep CreateStairs(double width, double depth, double height, int numberOfSteps)
  {
    var stairSteps = new List<Brep>();
    double stepHeight = height / numberOfSteps;
    double stepDepth = depth / numberOfSteps;

    for (int i = 0; i < numberOfSteps; i++)
    {
      double currentStepHeight = stepHeight * i;
      Point3d stepOrigin = new Point3d(-width / 2, -depth / 2 + (stepDepth * i), currentStepHeight);
      Box stepBox = new Box(Plane.WorldXY, new Interval(-width / 2, width / 2), new Interval(-depth / 2 + (stepDepth * i), -depth / 2 + (stepDepth * (i + 1))), new Interval(currentStepHeight, currentStepHeight + stepHeight));
      stairSteps.Add(Brep.CreateFromBox(stepBox));
    }

    return Brep.JoinBreps(stairSteps, DocumentTolerance())[0];
  }

  private List<Brep> CreateWindows(Brep level, double width, double height, double depth, double elevation)
  {
    var windows = new List<Brep>();
    // Logic to create windows based on the level size and position them
    // Placeholder logic - should be replaced with actual window creation logic
    return windows;
  }

  private List<Brep> CreateDoors(Brep level, double width, double height, double depth, double elevation)
  {
    var doors = new List<Brep>();
    // Logic to create doors based on the level size and position them
    // Placeholder logic - should be replaced with actual door creation logic
    return doors;
  }

  private void CenterGeometry(Brep geometry, double verticalOffset = 0, double frontOffset = 0)
  {
    var boundingBox = geometry.GetBoundingBox(true);
    var translation = Transform.Translation(0 - boundingBox.Center.X, 0 - boundingBox.Center.Y + frontOffset, verticalOffset - boundingBox.Min.Z);
    geometry.Transform(translation);
  }

  private double DocumentTolerance()
  {
    return Rhino.RhinoDoc.ActiveDoc.ModelAbsoluteTolerance;
  }
}
# ---------- end temple_005 ----------
temple_005_2 = Script()  # -> out, A
# ---------- temple_005_2: C# ----------
// Grasshopper Script Instance
//#! csharp
using System;
using System.Collections.Generic;
using Rhino.Geometry;
using Grasshopper.Kernel;

public class Script_Instance : GH_ScriptInstance
{
  private void RunScript(object x, object y, ref object A)
  {
    // Initialize fields within RunScript
    double baseLength = 50.0;
    double baseWidth = 30.0;
    double baseHeight = 3.0;
    double levelHeight = 6.0;
    int numberOfLevels = 4;
    double levelInset = 4.0;
    double roofHeight = 5.0;
    double roofOverhang = 2.0;
    double stairWidth = 10.0;
    double stairDepth = 15.0;
    double stairHeight = baseHeight;
    int numberOfStairs = 5;

    double windowHeight = 2.0;
    double windowWidth = 1.0;
    double windowDepth = 0.2;
    double windowElevation = 1.0;
    double doorHeight = 3.0;
    double doorWidth = 1.5;
    double doorDepth = 0.5;
    double doorElevation = 0.0;

    try
    {
      List<Brep> templeComponents = new List<Brep>();

      Brep basePlatform = CreatePlatform(baseLength, baseWidth, baseHeight);
      CenterGeometry(basePlatform);
      templeComponents.Add(basePlatform);

      for (int i = 1; i <= numberOfLevels; i++)
      {
        double inset = levelInset * i;
        Brep level = CreatePlatform(baseLength - inset, baseWidth - inset, levelHeight);
        CenterGeometry(level, baseHeight + levelHeight * (i - 1));
        templeComponents.Add(level);
      }

      double finalLength = baseLength - (levelInset * numberOfLevels);
      double finalWidth = baseWidth - (levelInset * numberOfLevels);
      Brep roof = CreateRoof(finalLength, finalWidth, roofHeight, roofOverhang, numberOfLevels, levelHeight);
      CenterGeometry(roof, baseHeight + numberOfLevels * levelHeight);
      templeComponents.Add(roof);

      Brep stairs = CreateStairs(stairWidth, stairDepth, stairHeight, numberOfStairs);
      CenterGeometry(stairs, 0, -baseWidth / 2 - stairDepth / 2);
      templeComponents.Add(stairs);

      if (numberOfLevels > 0)
      {
        Brep firstLevel = templeComponents[1];
        List<Brep> firstLevelWindows = CreateWindows(firstLevel, windowWidth, windowHeight, windowDepth, windowElevation);
        List<Brep> firstLevelDoors = CreateDoors(firstLevel, doorWidth, doorHeight, doorDepth, doorElevation);
        templeComponents.AddRange(firstLevelWindows);
        templeComponents.AddRange(firstLevelDoors);
      }

      A = templeComponents;
    }
    catch (Exception e)
    {
      this.Component.AddRuntimeMessage(GH_RuntimeMessageLevel.Error, e.ToString());
    }
  }

  private Brep CreatePlatform(double length, double width, double height)
  {
    var box = new Box(Plane.WorldXY, new Interval(-length / 2, length / 2), new Interval(-width / 2, width / 2), new Interval(0, height));
    return Brep.CreateFromBox(box);
  }

  private Brep CreateRoof(double baseLength, double baseWidth, double height, double overhang, int numberOfLevels, double levelHeight)
  {
    var length = baseLength + overhang * 2;
    var width = baseWidth + overhang * 2;
    var roofBase = CreatePlatform(length, width, height);
    return roofBase;
  }

  private Brep CreateStairs(double width, double depth, double height, int numberOfSteps)
  {
    var stairSteps = new List<Brep>();
    double stepHeight = height / numberOfSteps;
    double stepDepth = depth / numberOfSteps;

    for (int i = 0; i < numberOfSteps; i++)
    {
      double currentStepHeight = stepHeight * i;
      Point3d stepOrigin = new Point3d(-width / 2, -depth / 2 + (stepDepth * i), currentStepHeight);
      Box stepBox = new Box(Plane.WorldXY, new Interval(-width / 2, width / 2), new Interval(-depth / 2 + (stepDepth * i), -depth / 2 + (stepDepth * (i + 1))), new Interval(currentStepHeight, currentStepHeight + stepHeight));
      stairSteps.Add(Brep.CreateFromBox(stepBox));
    }

    return Brep.JoinBreps(stairSteps, DocumentTolerance())[0];
  }

  private List<Brep> CreateWindows(Brep level, double width, double height, double depth, double elevation)
  {
    var windows = new List<Brep>();
    // Logic to create windows based on the level size and position them
    // Placeholder logic - should be replaced with actual window creation logic
    return windows;
  }

  private List<Brep> CreateDoors(Brep level, double width, double height, double depth, double elevation)
  {
    var doors = new List<Brep>();
    // Logic to create doors based on the level size and position them
    // Placeholder logic - should be replaced with actual door creation logic
    return doors;
  }

  private void CenterGeometry(Brep geometry, double verticalOffset = 0, double frontOffset = 0)
  {
    var boundingBox = geometry.GetBoundingBox(true);
    var translation = Transform.Translation(0 - boundingBox.Center.X, 0 - boundingBox.Center.Y + frontOffset, verticalOffset - boundingBox.Min.Z);
    geometry.Transform(translation);
  }

  private double DocumentTolerance()
  {
    return Rhino.RhinoDoc.ActiveDoc.ModelAbsoluteTolerance;
  }
}
# ---------- end temple_005_2 ----------
temple_004 = Script()  # -> out, A
# ---------- temple_004: C# ----------
// Grasshopper Script Instance
//#! csharp
using System;
using System.Collections.Generic;
using Rhino.Geometry;
using Grasshopper.Kernel;

public class Script_Instance : GH_ScriptInstance
{
  private void RunScript(object x, object y, ref object A)
  {
    try
    {
      // Initialize a list to store the parts of the temple
      List<Brep> templeComponents = new List<Brep>();

      // Parameters for the base and proportions
      double baseLength = 50.0;
      double baseWidth = 30.0;
      double baseHeight = 3.0;
      double levelHeight = 6.0;
      int numberOfLevels = 4;
      double levelInset = 4.0; // Correctly defined in the context
      double roofHeight = 5.0;
      double roofOverhang = 2.0;
      double stairWidth = 10.0;
      double stairDepth = 15.0;
      double stairHeight = baseHeight;
      int numberOfStairs = 5;

      // Create the base of the temple
      Brep basePlatform = CreatePlatform(baseLength, baseWidth, baseHeight);
      CenterGeometry(basePlatform);
      templeComponents.Add(basePlatform);

      // Create multiple levels with decreasing size
      for (int i = 1; i <= numberOfLevels; i++)
      {
        double inset = levelInset * i;
        Brep level = CreatePlatform(baseLength - inset, baseWidth - inset, levelHeight);
        CenterGeometry(level, baseHeight + levelHeight * (i - 1));
        templeComponents.Add(level);
      }

      // Create the roof
      double finalLength = baseLength - (levelInset * numberOfLevels);
      double finalWidth = baseWidth - (levelInset * numberOfLevels);
      Brep roof = CreateRoof(finalLength, finalWidth, roofHeight, roofOverhang, numberOfLevels, levelHeight);
      CenterGeometry(roof, baseHeight + numberOfLevels * levelHeight);
      templeComponents.Add(roof);

      // Create stairs leading to the base of the temple
      Brep stairs = CreateStairs(stairWidth, stairDepth, stairHeight, numberOfStairs);
      CenterGeometry(stairs, 0, -baseWidth / 2 - stairDepth / 2); // Position in front of the base
      templeComponents.Add(stairs);

      // Output the geometry
      A = templeComponents;
    }
    catch (Exception e)
    {
      this.Component.AddRuntimeMessage(GH_RuntimeMessageLevel.Error, e.ToString());
    }
  }

  // Method to create the base platform
  private Brep CreatePlatform(double length, double width, double height)
  {
    var box = new Box(Plane.WorldXY, new Interval(-length / 2, length / 2), new Interval(-width / 2, width / 2), new Interval(0, height));
    return Brep.CreateFromBox(box);
  }

  // Method to create the roof
  private Brep CreateRoof(double baseLength, double baseWidth, double height, double overhang, int numberOfLevels, double levelHeight)
  {
    var length = baseLength + overhang * 2;
    var width = baseWidth + overhang * 2;
    var roofBase = CreatePlatform(length, width, height);
    // Add code here to shape the roofBase into the proper roof shape with slopes
    return roofBase;
  }

  // Method to create the stairs
  private Brep CreateStairs(double width, double depth, double height, int numberOfSteps)
  {
    double stepHeight = height / numberOfSteps;
    double stepDepth = depth / numberOfSteps;
    var stairSteps = new List<Brep>();

    for (int i = 0; i < numberOfSteps; i++)
    {
      double currentStepHeight = stepHeight * i;
      Point3d stepOrigin = new Point3d(-width / 2, -depth / 2 + (stepDepth * i), currentStepHeight);
      Box stepBox = new Box(Plane.WorldXY, new Interval(-width / 2, width / 2), new Interval(-depth / 2 + (stepDepth * i), -depth / 2 + (stepDepth * (i + 1))), new Interval(currentStepHeight, currentStepHeight + stepHeight));
      stairSteps.Add(Brep.CreateFromBox(stepBox));
    }

    return Brep.JoinBreps(stairSteps, DocumentTolerance())[0];
  }

  // Helper method to center geometry at the world origin or a specified height
  private void CenterGeometry(Brep geometry, double verticalOffset = 0, double frontOffset = 0)
  {
    var boundingBox = geometry.GetBoundingBox(true);
    var translation = Transform.Translation(0 - boundingBox.Center.X, 0 - boundingBox.Center.Y + frontOffset, verticalOffset - boundingBox.Min.Z);
    geometry.Transform(translation);
  }

  // Method to get document's tolerance
  private double DocumentTolerance()
  {
    return Rhino.RhinoDoc.ActiveDoc.ModelAbsoluteTolerance;
  }
  
  // Placeholder methods for additional details like windows, doors, etc. should be added here.
  // ...

}
# ---------- end temple_004 ----------
temple_001 = Script()  # -> out, A
# ---------- temple_001: C# ----------
//Grasshopper Script Instance
//#! csharp
using System;
using System.Collections;
using System.Collections.Generic;
using System.Drawing;

using Rhino;
using Rhino.Geometry;

using Grasshopper;
using Grasshopper.Kernel;
using Grasshopper.Kernel.Data;
using Grasshopper.Kernel.Types;

public class Script_Instance : GH_ScriptInstance
{
  private void RunScript(object x, object y, ref object A)
  {
    // Declare a list to hold the final geometry
    List<Brep> templeComponents = new List<Brep>();
    
    // You would define methods for creating each part of the temple here.
    // For example:
    Brep basePlatform = CreateBasePlatform();
    templeComponents.Add(basePlatform);

    Brep firstLevel = CreateLevel(basePlatform, 1);
    templeComponents.Add(firstLevel);

    // Continue defining levels...
    Brep secondLevel = CreateLevel(firstLevel, 2);
    templeComponents.Add(secondLevel);

    // And so on for additional levels, roofs, details, stairs, etc.
    // ...

    // Finally, set the output
    A = templeComponents;
  }

  // Method to create the base platform
  private Brep CreateBasePlatform()
  {
    // Logic to create the base platform
    // This is placeholder logic and needs to be replaced with actual geometry creation
    return new Brep();
  }

  // Method to create each level of the temple
  private Brep CreateLevel(Brep lowerLevel, int levelNumber)
  {
    // Logic to create a level of the temple based on the lower level geometry and level number
    // This is placeholder logic and needs to be replaced with actual geometry creation
    return new Brep();
  }

  // You can add more methods for roofs, details, stairs, etc.
  // ...

  // <Custom additional code> 
}
# ---------- end temple_001 ----------
temple_002 = Script()  # -> out, A
# ---------- temple_002: C# ----------
// Grasshopper Script Instance
//#! csharp
using System;
using System.Collections.Generic;
using Rhino.Geometry;
using Grasshopper.Kernel;

public class Script_Instance : GH_ScriptInstance
{
  private void RunScript(object x, object y, ref object A)
  {
    try
    {
      // Initialize a list to store the parts of the temple
      List<Brep> templeComponents = new List<Brep>();

      // Parameters for the base and proportions
      // These should be determined based on the image provided
      double baseLength = 30.0;
      double baseWidth = 20.0;
      double baseHeight = 2.0;
      double levelHeight = 5.0;
      int numberOfLevels = 3;

      // Create base platform
      Point3d baseOrigin = new Point3d(0, 0, 0);
      Brep basePlatform = CreatePlatform(baseOrigin, baseLength, baseWidth, baseHeight); // Changed 'base' to 'basePlatform'
      templeComponents.Add(basePlatform);

      // Create multiple levels
      for (int i = 0; i < numberOfLevels; i++)
      {
        double insetLength = i * 2.0;
        double insetWidth = i * 2.0;
        Point3d levelOrigin = new Point3d(baseOrigin.X + insetLength, baseOrigin.Y + insetWidth, baseHeight + i * levelHeight);
        Brep levelPlatform = CreatePlatform(levelOrigin, baseLength - insetLength * 2, baseWidth - insetWidth * 2, levelHeight); // Changed 'base' to 'levelPlatform'
        templeComponents.Add(levelPlatform);
      }

      // Output the geometry
      A = templeComponents;
    }
    catch (Exception e)
    {
      this.Component.AddRuntimeMessage(GH_RuntimeMessageLevel.Error, e.ToString());
    }
  }

  // Create the platform of the temple
  private Brep CreatePlatform(Point3d origin, double length, double width, double height)
  {
    // Use RhinoCommon API to create the platform geometry
    return Brep.CreateFromBox(new Box(Plane.WorldXY, new Interval(origin.X, origin.X + length), new Interval(origin.Y, origin.Y + width), new Interval(origin.Z, origin.Z + height)));
  }

  // Additional methods (roof, stairs, details...) would go here
}
# ---------- end temple_002 ----------
temple_003 = Script()  # -> out, A
# ---------- temple_003: C# ----------
// Grasshopper Script Instance
//#! csharp
using System;
using System.Collections.Generic;
using Rhino.Geometry;
using Grasshopper.Kernel;

public class Script_Instance : GH_ScriptInstance
{
  private void RunScript(object x, object y, ref object A)
  {
    try
    {
      // Initialize a list to store the parts of the temple
      List<Brep> templeComponents = new List<Brep>();

      // Parameters for the base and proportions
      double baseLength = 50.0;
      double baseWidth = 30.0;
      double baseHeight = 3.0;
      double levelHeight = 6.0;
      int numberOfLevels = 4;
      double levelInset = 4.0;
      double roofHeight = 5.0;
      double roofOverhang = 2.0;
      double stairWidth = 10.0;
      double stairHeight = baseHeight;
      double stairDepth = 15.0;
      int numberOfStairs = 5;

      // Create the base of the temple
      Brep basePlatform = CreatePlatform(baseLength, baseWidth, baseHeight);
      templeComponents.Add(basePlatform);

      // Create multiple levels with decreasing size
      double currentLength = baseLength;
      double currentWidth = baseWidth;
      for (int i = 0; i < numberOfLevels; i++)
      {
        currentLength -= levelInset;
        currentWidth -= levelInset;
        Point3d levelOrigin = new Point3d(-(currentLength / 2), -(currentWidth / 2), baseHeight + (i * levelHeight));
        Brep level = CreatePlatform(currentLength, currentWidth, levelHeight);
        level.Translate(levelOrigin.X, levelOrigin.Y, levelOrigin.Z);
        templeComponents.Add(level);
      }

      // Create the roof for the top level
      Point3d roofOrigin = new Point3d(-(currentLength / 2), -(currentWidth / 2), baseHeight + (numberOfLevels * levelHeight));
      Brep roof = CreateRoof(currentLength + roofOverhang * 2, currentWidth + roofOverhang * 2, roofHeight);
      roof.Translate(roofOrigin.X - roofOverhang, roofOrigin.Y - roofOverhang, roofOrigin.Z);
      templeComponents.Add(roof);

      // Create stairs leading to the base of the temple
      Brep stairs = CreateStairs(stairWidth, stairDepth, stairHeight, numberOfStairs);
      stairs.Translate(-(stairWidth / 2), -(baseWidth / 2) - (stairDepth / 2), 0);
      templeComponents.Add(stairs);

      // Add windows to the first level (as an example, add details to other levels similarly)
      Brep firstLevel = templeComponents[1]; // Assuming index 1 is the first level above base
      List<Brep> windows = CreateWindows(firstLevel, 2.0, 1.0, 0.2, 5);
      templeComponents.AddRange(windows);

      // Output the geometry
      A = templeComponents;
    }
    catch (Exception e)
    {
      this.Component.AddRuntimeMessage(GH_RuntimeMessageLevel.Error, e.ToString());
    }
  }

  // Method to create the base platform
  private Brep CreatePlatform(double length, double width, double height)
  {
    Box box = new Box(Plane.WorldXY, new Interval(-length / 2, length / 2), new Interval(-width / 2, width / 2), new Interval(0, height));
    return Brep.CreateFromBox(box);
  }

  // Method to create the roof
  private Brep CreateRoof(double length, double width, double height)
  {
    // Placeholder: Implement more detailed roof geometry creation based on image
    return CreatePlatform(length, width, height); // Simplified placeholder
  }

  // Method to create the stairs
  private Brep CreateStairs(double width, double depth, double height, int steps)
  {
    // Placeholder: Implement stair creation logic
    // For now, just a simple box representing the stair space
    return CreatePlatform(width, depth, height); // Simplified placeholder
  }

  // Method to create windows on a level
  private List<Brep> CreateWindows(Brep level, double width, double height, double depth, int quantity)
  {
    // Placeholder: Implement window creation logic
    List<Brep> windows = new List<Brep>();
    // For now, create a series of small boxes representing windows
    for (int i = 0; i < quantity; i++)
    {
      double windowSpacing = (level.GetBoundingBox(true).Max.X - level.GetBoundingBox(true).Min.X) / (quantity + 1);
      Point3d windowOrigin = new Point3d(level.GetBoundingBox(true).Min.X + (windowSpacing * (i + 1)), level.GetBoundingBox(true).Min.Y, level.GetBoundingBox(true).Min.Z + height / 2);
      Brep window = CreatePlatform(width, depth, height);
      window.Translate(windowOrigin.X - width / 2, windowOrigin.Y - depth / 2, windowOrigin.Z - height / 2);
      windows.Add(window);
    }
    return windows;
  }

  // <Custom additional code for other components like eaves, decorative elements, etc.>
}
# ---------- end temple_003 ----------
param_viewer = ParamViewer(temple_005_2.A)
param_viewer_2 = ParamViewer(temple_004.A)
panel = Panel(temple_005_2.out)
panel_2 = Panel(temple_005_2.A)
panel_3 = Panel(temple_004.out)
panel_4 = Panel(temple_004.A)
panel_5 = Panel(temple_005.out)
param_viewer_3 = ParamViewer(temple_005.A)
param_viewer_4 = ParamViewer(temple_003.A)
panel_6 = Panel(temple_003.out)
panel_7 = Panel(temple_003.A)
panel_8 = Panel(temple_002.out)
panel_9 = Panel(temple_002.A)
panel_10 = Panel(temple_001.A)
panel_11 = Panel(temple_001.out)
panel_12 = Panel(temple_005.A)
# Created at
# Wickerson Studios
# copywrite 2024
# download all materials at
# www.wickersonstudios.com
# Parametric Temple from
# gpt Image Prompt
number_slider_32 = Slider(40, range=0..40)
number_slider_33 = Slider(2.9, range=0..10)
temple_006 = Script(
    baseLength=number_slider_32,
    baseWidth=Slider(26.8, range=0..40),
    baseHeight=number_slider_33,
    levelHeight=Slider(5.88, range=0..10),
    numberOfLevels=Slider(4, range=0..10),
    levelInset=Slider(4.42, range=0..10),
    roofHeight=Slider(5.88, range=0..10),
    roofOverhang=Slider(2.9, range=0..10),
    stairWidth=Slider(10, range=0..10),
    stairDepth=Slider(11.81, range=0..20),
    stairHeight=number_slider_33,
    numberOfStairs=Slider(3, range=0..10),
    windowHeight=Slider(3.5, range=0..10),
    windowWidth=Slider(1.2, range=0..10),
    windowDepth=Slider(0.2, range=0..1),
    windowElevation=Slider(1.38, range=0..10),
    doorHeight=Slider(5.2, range=0..10),
    doorWidth=Slider(3.3, range=0..10),
    doorDepth=Slider(0.5, range=0..1),
    doorElevation=Slider(0, range=0..1))  # -> out, A; inputs baseLength: Double, baseWidth: Double, baseHeight: Double, levelHeight: Double, numberOfLevels: Int32, levelInset: Double, roofHeight: Double, roofOverhang: Double, stairWidth: Double, stairDepth: Double, stairHeight: Double, numberOfStairs: Int32, windowHeight: Double, windowWidth: Double, windowDepth: Double, windowElevation: Double, doorHeight: Double, doorWidth: Double, doorDepth: Double, doorElevation: Double
# ---------- temple_006: C# ----------
// Grasshopper Script Instance
//#! csharp
using System;
using System.Collections.Generic;
using Rhino.Geometry;
using Grasshopper.Kernel;

public class Script_Instance : GH_ScriptInstance
{
  private void RunScript(
	double baseLength,
	double baseWidth,
	double baseHeight,
	double levelHeight,
	int numberOfLevels,
	double levelInset,
	double roofHeight,
	double roofOverhang,
	double stairWidth,
	double stairDepth,
	double stairHeight,
	int numberOfStairs,
	double windowHeight,
	double windowWidth,
	double windowDepth,
	double windowElevation,
	double doorHeight,
	double doorWidth,
	double doorDepth,
	double doorElevation,
	ref object A)
  {
    // Define parameters
    // double baseLength = 50.0;
    // double baseWidth = 30.0;
    // double baseHeight = 3.0;
    // double levelHeight = 6.0;
    // int numberOfLevels = 4;
    // double levelInset = 4.0;
    // double roofHeight = 5.0;
    // double roofOverhang = 2.0;
    // double stairWidth = 10.0;
    // double stairDepth = 30.0;
    // double stairHeight = baseHeight;
    // int numberOfStairs = 10;

    // double windowHeight = 2.0;
    // double windowWidth = 1.0;
    // double windowDepth = 0.2;
    // double windowElevation = 1.0;
    // double doorHeight = 3.0;
    // double doorWidth = 1.5;
    // double doorDepth = 0.5;
    // double doorElevation = 0.0;

    List<Brep> templeComponents = new List<Brep>();

    // Create base platform
    Brep basePlatform = CreatePlatform(baseLength, baseWidth, baseHeight);
    CenterGeometry(basePlatform);
    templeComponents.Add(basePlatform);

    // Create levels
    for (int i = 1; i <= numberOfLevels; i++)
    {
      double inset = levelInset * i;
      Brep level = CreatePlatform(baseLength - inset, baseWidth - inset, levelHeight);
      CenterGeometry(level, baseHeight + levelHeight * (i - 1));
      templeComponents.Add(level);
    }

    // Create roof
    Brep roof = CreateRoof(baseLength, baseWidth, roofHeight, roofOverhang, numberOfLevels, levelInset, levelHeight);
    CenterGeometry(roof, baseHeight + numberOfLevels * levelHeight);
    templeComponents.Add(roof);

    // Create stairs
    Brep stairs = CreateStairs(stairWidth, stairDepth, stairHeight, numberOfStairs);
    CenterGeometry(stairs, 0, -baseWidth / 2 - stairDepth / 2);
    templeComponents.Add(stairs);

    // Create windows and doors for the first level
    if (numberOfLevels > 0)
    {
      Brep firstLevel = templeComponents[1];
      List<Brep> windows = CreateWindows(firstLevel, windowWidth, windowHeight, windowDepth, windowElevation);
      List<Brep> doors = CreateDoors(firstLevel, doorWidth, doorHeight, doorDepth, doorElevation);
      templeComponents.AddRange(windows);
      templeComponents.AddRange(doors);
    }

    A = templeComponents;
  }

  private Brep CreatePlatform(double length, double width, double height)
  {
    var box = new Box(Plane.WorldXY, new Interval(-length / 2, length / 2), new Interval(-width / 2, width / 2), new Interval(0, height));
    return Brep.CreateFromBox(box);
  }

  private Brep CreateRoof(double baseLength, double baseWidth, double height, double overhang, int numberOfLevels, double levelInset, double levelHeight)
  {
    double roofLength = baseLength - (numberOfLevels * levelInset) + overhang * 2;
    double roofWidth = baseWidth - (numberOfLevels * levelInset) + overhang * 2;
    var box = new Box(Plane.WorldXY, new Interval(-roofLength / 2, roofLength / 2), new Interval(-roofWidth / 2, roofWidth / 2), new Interval(0, height));
    return Brep.CreateFromBox(box);
  }

  private Brep CreateStairs(double width, double depth, double height, int numberOfSteps)
  {
    var stairSteps = new List<Brep>();
    double stepHeight = height / numberOfSteps;
    double stepDepth = depth / numberOfSteps;

    for (int i = 0; i < numberOfSteps; i++)
    {
      double currentStepHeight = stepHeight * i;
      Point3d stepOrigin = new Point3d(-width / 2, -depth + stepDepth * (i + 1), currentStepHeight);
      Box stepBox = new Box(Plane.WorldXY, new Interval(-width / 2, width / 2), new Interval(stepOrigin.Y, stepOrigin.Y + stepDepth), new Interval(currentStepHeight, currentStepHeight + stepHeight));
      stairSteps.Add(Brep.CreateFromBox(stepBox));
    }

    return Brep.JoinBreps(stairSteps, DocumentTolerance())[0];
  }

  private List<Brep> CreateWindows(Brep level, double width, double height, double depth, double elevation)
  {
    var windows = new List<Brep>();
    BoundingBox bbox = level.GetBoundingBox(true);
    double levelWidth = bbox.Max.X - bbox.Min.X;
    int numWindows = (int)(levelWidth / (width * 3));

    for (int i = 0; i < numWindows; i++)
    {
      double xPosition = bbox.Min.X + (i + 0.5) * width * 3;
      var windowPlane = new Plane(new Point3d(xPosition, bbox.Min.Y - depth / 2, elevation + bbox.Min.Z), Vector3d.XAxis, Vector3d.YAxis);
      var window = Brep.CreateFromBox(new Box(windowPlane, new Interval(-width / 2, width / 2), new Interval(-depth / 2, depth / 2), new Interval(0, height)));
      windows.Add(window);
    }
    return windows;
  }

  private List<Brep> CreateDoors(Brep level, double width, double height, double depth, double elevation)
  {
    var doors = new List<Brep>();
    BoundingBox bbox = level.GetBoundingBox(true);
    var doorPlane = new Plane(new Point3d(bbox.Min.X + bbox.Max.X / 2, bbox.Min.Y - depth, elevation + bbox.Min.Z), Vector3d.XAxis, Vector3d.YAxis);
    var door = Brep.CreateFromBox(new Box(doorPlane, new Interval(-width / 2, width / 2), new Interval(-depth, 0), new Interval(0, height)));
    doors.Add(door);
    return doors;
  }

  private void CenterGeometry(Brep geometry, double verticalOffset = 0, double frontOffset = 0)
  {
    var boundingBox = geometry.GetBoundingBox(true);
    var translation = Transform.Translation(0 - boundingBox.Center.X, 0 - boundingBox.Center.Y + frontOffset, verticalOffset - boundingBox.Min.Z);
    geometry.Transform(translation);
  }

  private double DocumentTolerance()
  {
    return Rhino.RhinoDoc.ActiveDoc.ModelAbsoluteTolerance;
  }
}
# ---------- end temple_006 ----------
temple_006_2 = Script()  # -> out, A
# ---------- temple_006_2: C# ----------
// Grasshopper Script Instance
//#! csharp
using System;
using System.Collections.Generic;
using Rhino.Geometry;
using Grasshopper.Kernel;

public class Script_Instance : GH_ScriptInstance
{
  private void RunScript(object x, object y, ref object A)
  {
    double baseLength = 50.0;
    double baseWidth = 30.0;
    double baseHeight = 3.0;
    double levelHeight = 6.0;
    int numberOfLevels = 4;
    double levelInset = 4.0;
    double roofHeight = 5.0;
    double roofOverhang = 2.0;
    double stairWidth = 10.0;
    double stairDepth = 15.0;
    double stairHeight = baseHeight;
    int numberOfStairs = 10;

    double windowHeight = 1.0;
    double windowWidth = 1.0;
    double windowDepth = 0.2;
    double windowElevation = 1.0;
    double doorHeight = 3.0;
    double doorWidth = 1.5;
    double doorDepth = 0.5;
    double doorElevation = 0.0;

    List<Brep> templeComponents = new List<Brep>();

    Brep basePlatform = CreatePlatform(baseLength, baseWidth, baseHeight);
    CenterGeometry(basePlatform);
    templeComponents.Add(basePlatform);

    // Create levels and windows
    for (int i = 1; i <= numberOfLevels; i++)
    {
      double inset = levelInset * i;
      Brep level = CreatePlatform(baseLength - inset, baseWidth - inset, levelHeight);
      CenterGeometry(level, baseHeight + levelHeight * (i - 1));
      templeComponents.Add(level);

      List<Brep> levelWindows = CreateWindows(level, windowWidth, windowHeight, windowDepth, windowElevation);
      templeComponents.AddRange(levelWindows);
    }

    Brep roof = CreateRoof(baseLength, baseWidth, roofHeight, roofOverhang, numberOfLevels, levelInset, levelHeight);
    CenterGeometry(roof, baseHeight + numberOfLevels * levelHeight);
    templeComponents.Add(roof);

    Brep stairs = CreateStairs(stairWidth, stairDepth, stairHeight, numberOfStairs);
    CenterGeometry(stairs, 0, -baseWidth / 2 - stairDepth / 2);
    templeComponents.Add(stairs);

    A = templeComponents;
  }

  private Brep CreatePlatform(double length, double width, double height)
  {
    var box = new Box(Plane.WorldXY, new Interval(-length / 2, length / 2), new Interval(-width / 2, width / 2), new Interval(0, height));
    return Brep.CreateFromBox(box);
  }

  private Brep CreateRoof(double baseLength, double baseWidth, double height, double overhang, int numberOfLevels, double levelInset, double levelHeight)
  {
    double roofLength = baseLength - (numberOfLevels * levelInset) + overhang * 2;
    double roofWidth = baseWidth - (numberOfLevels * levelInset) + overhang * 2;
    var box = new Box(Plane.WorldXY, new Interval(-roofLength / 2, roofLength / 2), new Interval(-roofWidth / 2, roofWidth / 2), new Interval(0, height));
    return Brep.CreateFromBox(box);
  }

  private Brep CreateStairs(double width, double depth, double height, int numberOfSteps)
  {
    var stairSteps = new List<Brep>();
    double stepHeight = height / numberOfSteps;
    double stepDepth = depth / numberOfSteps;

    for (int i = 0; i < numberOfSteps; i++)
    {
      Point3d stepOrigin = new Point3d(-width / 2, -depth + stepDepth * (i + 1), stepHeight * i);
      Box stepBox = new Box(Plane.WorldXY, new Interval(-width / 2, width / 2), new Interval(stepOrigin.Y, stepOrigin.Y + stepDepth), new Interval(stepOrigin.Z, stepOrigin.Z + stepHeight));
      stairSteps.Add(Brep.CreateFromBox(stepBox));
    }

    return Brep.JoinBreps(stairSteps, DocumentTolerance())[0];
  }

  private List<Brep> CreateWindows(Brep level, double width, double height, double depth, double elevation)
  {
    var windows = new List<Brep>();
    BoundingBox bbox = level.GetBoundingBox(true);
    double numWindowsPerSide = 3; // For demonstration, you can adjust this based on level size
    double spacing = bbox.Max.X - bbox.Min.X - (numWindowsPerSide * width);
    spacing /= (numWindowsPerSide + 1); // Spacing between windows

    // Front and back
    for (int i = 0; i < numWindowsPerSide; i++)
    {
      double xPosition = bbox.Min.X + spacing + (i * (width + spacing));
      windows.Add(CreateWindow(xPosition, bbox.Min.Y - depth, bbox.Min.Z + elevation, width, height, depth)); // Front
      windows.Add(CreateWindow(xPosition, bbox.Max.Y, bbox.Min.Z + elevation, width, height, depth)); // Back
    }

    // Sides
    for (int i = 0; i < numWindowsPerSide; i++)
    {
      double yPosition = bbox.Min.Y + spacing + (i * (width + spacing));
      windows.Add(CreateWindow(bbox.Min.X - depth, yPosition, bbox.Min.Z + elevation, width, height, depth)); // Left
      windows.Add(CreateWindow(bbox.Max.X, yPosition, bbox.Min.Z + elevation, width, height, depth)); // Right
    }

    return windows;
  }

  // Helper method to create a single window
  private Brep CreateWindow(double x, double y, double z, double width, double height, double depth)
  {
    var windowPlane = new Plane(new Point3d(x, y, z), Vector3d.XAxis, Vector3d.YAxis);
    var windowBox = new Box(windowPlane, new Interval(-width / 2, width / 2), new Interval(0, depth), new Interval(0, height));
    return Brep.CreateFromBox(windowBox);
  }

  private void CenterGeometry(Brep geometry, double verticalOffset = 0, double frontOffset = 0)
  {
    var boundingBox = geometry.GetBoundingBox(true);
    var translation = Transform.Translation(0 - boundingBox.Center.X, 0 - boundingBox.Center.Y + frontOffset, verticalOffset - boundingBox.Min.Z);
    geometry.Transform(translation);
  }

  private double DocumentTolerance()
  {
    return Rhino.RhinoDoc.ActiveDoc.ModelAbsoluteTolerance;
  }
}
# ---------- end temple_006_2 ----------
geometry = Geometry(temple_006.A)
geometry_2 = Geometry(temple_006_2.A)
panel_13 = Panel(temple_006.out)
param_viewer_5 = ParamViewer(temple_006.A)
panel_14 = Panel(temple_006_2.out)
param_viewer_6 = ParamViewer(temple_006_2.A)
panel_15 = Panel(geometry)
panel_16 = Panel(geometry_2)
