# Grasshopper definition architecture_steeringWheel_001.gh (Grasshopper 1.0.8)
# plug-ins: RhinoCodePluginGH

number_slider = Slider(25.9, range=0..100)
number_slider_2 = Slider(7.5, range=0..10)
number_slider_3 = Slider(10.9, range=0..20)
number_slider_4 = Slider(101.9, range=0..200)
number_slider_5 = Slider(5, range=0..10)
number_slider_6 = Slider(19.5, range=0..100)
number_slider_7 = Slider(25.9, range=0..100)
number_slider_8 = Slider(25.9, range=0..100)
number_slider_9 = Slider(7.5, range=0..10)
number_slider_10 = Slider(19.5, range=0..100)
number_slider_11 = Slider(25.9, range=0..100)
number_slider_12 = Slider(7.5, range=0..10)
number_slider_13 = Slider(19.5, range=0..100)
number_slider_14 = Slider(10.9, range=0..20)
number_slider_15 = Slider(101.9, range=0..200)
number_slider_16 = Slider(5, range=0..10)
number_slider_17 = Slider(7.5, range=0..10)
number_slider_18 = Slider(19.5, range=0..100)
number_slider_19 = Slider(10.9, range=0..20)
number_slider_20 = Slider(101.9, range=0..200)
number_slider_21 = Slider(5, range=0..10)
number_slider_22 = Slider(10.9, range=0..20)
number_slider_23 = Slider(101.9, range=0..200)
number_slider_24 = Slider(5, range=0..10)
steeringwheel_001 = Script()  # -> out, A, B, C
# ---------- steeringwheel_001: C# ----------
// Grasshopper Script Instance
// #! csharp
using System;
using System.Collections.Generic;
using System.Drawing;

using Rhino;
using Rhino.Geometry;

using Grasshopper;
using Grasshopper.Kernel;
using Grasshopper.Kernel.Data;
using Grasshopper.Kernel.Types;

public class Script_Instance : GH_ScriptInstance
{
  private void RunScript(
	object x,
	object y,
	ref object A,
	ref object B,
	ref object C)
  {
    // Outputs
    A = null; // Will hold the outer ring
    B = null; // Will hold the spokes
    C = null; // Will hold the central hub

    // Parameters for the wheel
    double outerDiameter = 1000; // Example diameter, adjust as necessary
    double innerDiameter = 900;  // Example inner diameter, adjust as necessary
    double thickness = 50;       // Thickness of the wheel
    int numberOfSpokes = 8;      // Number of spokes
    double spokeWidth = 30;      // Example width of the spokes, adjust as necessary

    // Create the outer ring
    Curve outerCircle = new Circle(Plane.WorldXY, outerDiameter / 2).ToNurbsCurve();
    Curve innerCircle = new Circle(Plane.WorldXY, innerDiameter / 2).ToNurbsCurve();
    Brep[] outerRingBreps = Brep.CreatePlanarBreps(new Curve[] { outerCircle, innerCircle }, 0.01);
    Brep outerRing = outerRingBreps.Length > 0 ? outerRingBreps[0] : null;

    // Create the spokes
    List<Brep> spokes = new List<Brep>();
    for (int i = 0; i < numberOfSpokes; i++)
    {
      double angle = 2 * Math.PI / numberOfSpokes * i;
      Point3d innerPoint = new Point3d(Math.Cos(angle) * (innerDiameter / 2), Math.Sin(angle) * (innerDiameter / 2), 0);
      Point3d outerPoint = new Point3d(Math.Cos(angle) * (outerDiameter / 2), Math.Sin(angle) * (outerDiameter / 2), 0);
      spokes.Add(CreateSpoke(innerPoint, outerPoint, spokeWidth, thickness));
    }

    // Create the central hub
    Brep centralHub = Brep.CreateFromCylinder(new Cylinder(new Circle(Plane.WorldXY, innerDiameter / 4), thickness), true, true);

    // Assign the geometries to the output parameters
    A = outerRing;
    B = spokes;
    C = centralHub;
  }

  // <Custom additional code>
  private Brep CreateSpoke(Point3d innerPoint, Point3d outerPoint, double width, double thickness)
  {
    Vector3d direction = outerPoint - innerPoint;
    Vector3d perpDirection = new Vector3d(-direction.Y, direction.X, 0);
    perpDirection.Unitize();

    Point3d corner1 = innerPoint + perpDirection * width / 2;
    Point3d corner2 = innerPoint - perpDirection * width / 2;
    Point3d corner3 = outerPoint - perpDirection * width / 2;
    Point3d corner4 = outerPoint + perpDirection * width / 2;

    // Create the spoke's profile as a polyline
    Polyline polyline = new Polyline(new[] { corner1, corner2, corner3, corner4, corner1 });
    Curve profileCurve = polyline.ToNurbsCurve();

    // Extrude the profile curve to create the spoke
    Brep spoke = Surface.CreateExtrusion(profileCurve, Vector3d.ZAxis * thickness).ToBrep();
    spoke.CapPlanarHoles(0.01);  // Ensure the Brep is solid

    return spoke;
  }
}
# ---------- end steeringwheel_001 ----------
steeringwheel_003 = Script()  # -> out, A, B, C, D
# ---------- steeringwheel_003: C# ----------
// Grasshopper Script Instance
// #! csharp
using System;
using System.Collections.Generic;
using System.Drawing;

using Rhino;
using Rhino.Geometry;

using Grasshopper;
using Grasshopper.Kernel;
using Grasshopper.Kernel.Data;
using Grasshopper.Kernel.Types;

public class Script_Instance : GH_ScriptInstance
{
  private void RunScript(object x, object y, ref object A, ref object B, ref object C, ref object D)
  {
    // Specified tolerances
    double tolerance = 0.01; // Absolute tolerance (you may adjust this as needed)
    double angleTolerance = RhinoMath.ToRadians(1); // Angle tolerance in radians (1 degree)

    // Outputs
    A = null; // Will hold the assembled wheel
    B = null; // Will hold the handles
    C = null; // Will hold the spokes
    D = null; // Will hold the central hub

    // Parameters for the wheel
    double outerDiameter = 1000; // Example diameter, adjust as necessary
    double innerDiameter = 800;  // Example inner diameter, adjust as necessary
    double thickness = 100;      // Example thickness, adjust as necessary
    int numberOfSpokes = 6;      // Number of spokes
    double spokeWidth = 50;      // Width of the spokes, adjust as necessary
    double handleDiameter = 40;  // Diameter of the handles, adjust as necessary
    double handleLength = 150;   // Length of the handles, adjust as necessary
    double hubDiameter = 200;    // Diameter of the central hub, adjust as necessary

    // Create the outer ring
    var outerRing = new Torus(Plane.WorldXY, outerDiameter / 2, thickness / 2).ToBrep();

    // Create the central hub
    var hub = new Cylinder(new Circle(Plane.WorldXY, hubDiameter / 2), thickness).ToBrep(true, true);

    // Create the spokes
    var spokes = new List<Brep>();
    for (int i = 0; i < numberOfSpokes; i++)
    {
      double angle = 2 * Math.PI / numberOfSpokes * i;
      spokes.Add(CreateSpoke(innerDiameter, hubDiameter, thickness, spokeWidth, angle));
    }

    // Create the handles
    var handles = new List<Brep>();
    for (int i = 0; i < numberOfSpokes; i++)
    {
      double angle = 2 * Math.PI / numberOfSpokes * i;
      handles.Add(CreateHandle(outerDiameter, thickness, handleDiameter, handleLength, angle));
    }

    // Combine all parts
    var allParts = new List<Brep> { outerRing, hub };
    allParts.AddRange(spokes);
    allParts.AddRange(handles);
    var joinedWheel = Brep.JoinBreps(allParts, tolerance);

    // Assigning outputs
    A = joinedWheel; // The assembled wheel
    B = handles;     // The handles
    C = spokes;      // The spokes
    D = hub;         // The hub
  }

  // <Custom additional code>
  private Brep CreateSpoke(double innerDiameter, double hubDiameter, double thickness, double width, double angle)
  {
    Point3d innerPoint = new Point3d(Math.Cos(angle) * hubDiameter / 2, Math.Sin(angle) * hubDiameter / 2, 0);
    Point3d outerPoint = new Point3d(Math.Cos(angle) * innerDiameter / 2, Math.Sin(angle) * innerDiameter / 2, 0);
    Vector3d perpDirection = new Vector3d(-Math.Sin(angle), Math.Cos(angle), 0);
    perpDirection *= width / 2;

    List<Point3d> corners = new List<Point3d>
    {
      outerPoint + perpDirection,
      outerPoint - perpDirection,
      innerPoint - perpDirection,
      innerPoint + perpDirection,
      outerPoint + perpDirection // Close the loop
    };

    Curve profile = new Polyline(corners).ToNurbsCurve();
    Brep spoke = Extrusion.Create(profile, thickness, true).ToBrep();
    return spoke;
  }

  private Brep CreateHandle(double outerDiameter, double thickness, double diameter, double length, double angle)
  {
    // Define the handle's base point
    Point3d handleBasePoint = new Point3d(
      Math.Cos(angle) * (outerDiameter / 2 + length),
      Math.Sin(angle) * (outerDiameter / 2 + length),
      thickness / 2);

    // Calculate tangent and normal vectors for the handle's orientation
    Vector3d tangent = new Vector3d(-Math.Sin(angle), Math.Cos(angle), 0);
    Vector3d normal = new Vector3d(Math.Cos(angle), Math.Sin(angle), 0);
    
    // Rotate the handle to lie flat on the XY plane
    Plane handlePlane = new Plane(handleBasePoint, normal, tangent);
    Circle handleCircle = new Circle(handlePlane, diameter / 2);
    Brep handle = Extrusion.Create(handleCircle.ToNurbsCurve(), length, true).ToBrep();
    
    return handle;
  }
}
# ---------- end steeringwheel_003 ----------
steeringwheel_004 = Script()  # -> out, A, B, C, D
# ---------- steeringwheel_004: C# ----------
// Grasshopper Script Instance
// #! csharp
using System;
using System.Collections.Generic;
using System.Drawing;

using Rhino;
using Rhino.Geometry;

using Grasshopper;
using Grasshopper.Kernel;
using Grasshopper.Kernel.Data;
using Grasshopper.Kernel.Types;

public class Script_Instance : GH_ScriptInstance
{
  private void RunScript(object x, object y, ref object A, ref object B, ref object C, ref object D)
  {
    // Specified tolerances
    double tolerance = 0.01;
    double angleTolerance = RhinoMath.ToRadians(1);

    // Outputs
    A = null;
    B = null;
    C = null;
    D = null;

    // Parameters for the wheel
    double outerDiameter = 1000;
    double innerDiameter = 800;
    double thickness = 100;
    int numberOfSpokes = 6;
    double spokeWidth = 50;
    double handleDiameter = 40;
    double handleLength = 150;
    double hubDiameter = 200;

    // Create the outer ring as a torus
    var outerTorus = new Torus(Plane.WorldXY, outerDiameter / 2, thickness / 2).ToBrep();

    // Create the central hub as a cylinder
    var hubCylinder = new Cylinder(new Circle(Plane.WorldXY, hubDiameter / 2), thickness).ToBrep(true, true);

    // Create the spokes
    var spokes = new List<Brep>();
    for (int i = 0; i < numberOfSpokes; i++)
    {
      double angle = 2 * Math.PI / numberOfSpokes * i;
      spokes.Add(CreateSpoke(innerDiameter, hubDiameter, thickness, spokeWidth, angle));
    }

    // Create the handles
    var handles = new List<Brep>();
    for (int i = 0; i < numberOfSpokes; i++)
    {
      double angle = 2 * Math.PI / numberOfSpokes * i;
      handles.Add(CreateHandle(outerDiameter, thickness, handleDiameter, handleLength, angle));
    }

    // Combine all parts
    var allComponents = new List<Brep> { outerTorus, hubCylinder };
    allComponents.AddRange(spokes);
    allComponents.AddRange(handles);
    var joinedWheel = Brep.JoinBreps(allComponents, tolerance);

    // Assigning outputs
    A = joinedWheel; // The assembled wheel
    B = handles;     // The handles
    C = spokes;      // The spokes
    D = hubCylinder; // The hub
  }

  // <Custom additional code>
  private Brep CreateSpoke(double innerDiameter, double hubDiameter, double thickness, double width, double angle)
  {
    var innerRadius = hubDiameter / 2;
    var outerRadius = innerDiameter / 2;
    var innerPoint = new Point3d(Math.Cos(angle) * innerRadius, Math.Sin(angle) * innerRadius, 0);
    var outerPoint = new Point3d(Math.Cos(angle) * outerRadius, Math.Sin(angle) * outerRadius, 0);
    var perpVector = new Vector3d(-Math.Sin(angle), Math.Cos(angle), 0) * width / 2;

    var corners = new List<Point3d>
    {
      outerPoint + perpVector,
      outerPoint - perpVector,
      innerPoint - perpVector,
      innerPoint + perpVector,
      outerPoint + perpVector // Close the loop
    };

    var profile = new Polyline(corners).ToNurbsCurve();
    var extrusion = Extrusion.Create(profile, thickness, true);
    return extrusion.ToBrep(true);
  }

  private Brep CreateHandle(double outerDiameter, double thickness, double diameter, double length, double angle)
  {
    var radius = (outerDiameter / 2) + length;
    var basePoint = new Point3d(Math.Cos(angle) * radius, Math.Sin(angle) * radius, thickness / 2);
    var tangent = new Vector3d(-Math.Sin(angle), Math.Cos(angle), 0);
    var normal = new Vector3d(Math.Cos(angle), Math.Sin(angle), 0) * length;

    // Rotate the normal to get it perpendicular to the tangent
    normal.Rotate(Math.PI / 2, tangent);

    var handleCircle = new Circle(new Plane(basePoint, tangent, normal), diameter / 2);
    var handle = Extrusion.Create(handleCircle.ToNurbsCurve(), thickness, true).ToBrep();
    return handle;
  }
}
# ---------- end steeringwheel_004 ----------
steeringwheel_002 = Script()  # -> out, A, B, C, D
# ---------- steeringwheel_002: C# ----------
// Grasshopper Script Instance
// #! csharp
using System;
using System.Collections.Generic;
using System.Drawing;

using Rhino;
using Rhino.Geometry;

using Grasshopper;
using Grasshopper.Kernel;
using Grasshopper.Kernel.Data;
using Grasshopper.Kernel.Types;

public class Script_Instance : GH_ScriptInstance
{
  private void RunScript(object x, object y, ref object A, ref object B, ref object C, ref object D)
  {
    // Outputs
    A = null; // Will hold the outer ring
    B = null; // Will hold the handles
    C = null; // Will hold the spokes
    D = null; // Will hold the central hub

    // Parameters for the wheel
    double outerDiameter = 1000; // Example diameter, adjust as necessary
    double innerDiameter = 800;  // Example inner diameter, adjust as necessary
    double thickness = 100;      // Example thickness, adjust as necessary
    int numberOfSpokes = 6;      // Number of spokes
    double spokeWidth = 50;      // Width of the spokes, adjust as necessary
    double handleDiameter = 40;  // Diameter of the handles, adjust as necessary
    double handleLength = 150;   // Length of the handles, adjust as necessary
    double hubDiameter = 200;    // Diameter of the central hub, adjust as necessary

    // Create the outer ring
    var outerRing = new Torus(Plane.WorldXY, outerDiameter / 2, spokeWidth / 2).ToBrep();

    // Create the handles
    var handles = new List<Brep>();
    for (int i = 0; i < numberOfSpokes; i++)
    {
      double angle = 2 * Math.PI / numberOfSpokes * i;
      Point3d handleCenter = new Point3d(
        Math.Cos(angle) * (outerDiameter / 2 + handleLength / 2),
        Math.Sin(angle) * (outerDiameter / 2 + handleLength / 2),
        0);
      var handlePath = new Line(handleCenter, handleCenter + Vector3d.ZAxis * thickness);
      var handleProfile = new Circle(Plane.WorldXY, handleCenter, handleDiameter / 2).ToNurbsCurve();
      var handle = Extrusion.Create(handleProfile, thickness, true).ToBrep();
      handles.Add(handle);
    }

    // Create the spokes
    var spokes = new List<Brep>();
    for (int i = 0; i < numberOfSpokes; i++)
    {
      double angle = 2 * Math.PI / numberOfSpokes * i;
      Point3d innerPoint = new Point3d(Math.Cos(angle) * innerDiameter / 2, Math.Sin(angle) * innerDiameter / 2, 0);
      Point3d outerPoint = new Point3d(Math.Cos(angle) * outerDiameter / 2, Math.Sin(angle) * outerDiameter / 2, 0);
      var spoke = CreateSpoke(innerPoint, outerPoint, spokeWidth, thickness);
      spokes.Add(spoke);
    }

    // Create the central hub
    var hubPath = new Line(Plane.WorldXY.Origin, Plane.WorldXY.Origin + Vector3d.ZAxis * thickness);
    var hubProfile = new Circle(Plane.WorldXY, hubDiameter / 2).ToNurbsCurve();
    var hub = Extrusion.Create(hubProfile, thickness, true).ToBrep();

    // Assign the geometries to the output parameters
    A = outerRing;
    B = handles;
    C = spokes;
    D = hub;
  }

  // <Custom additional code>
  private Brep CreateSpoke(Point3d innerPoint, Point3d outerPoint, double width, double thickness)
  {
    Vector3d direction = outerPoint - innerPoint;
    Vector3d perpDirection = new Vector3d(-direction.Y, direction.X, 0);
    perpDirection.Unitize();

    // Calculate the four corner points of the spoke
    Point3d corner1 = innerPoint + perpDirection * width / 2;
    Point3d corner2 = innerPoint - perpDirection * width / 2;
    Point3d corner3 = outerPoint - perpDirection * width / 2;
    Point3d corner4 = outerPoint + perpDirection * width / 2;

    // Create the profile of the spoke
    Polyline polyline = new Polyline(new[] { corner1, corner2, corner3, corner4, corner1 });
    Curve profile = polyline.ToNurbsCurve();

    // Extrude the profile curve to create the spoke
    var spoke = Extrusion.Create(profile, thickness, true).ToBrep();
    return spoke;
  }
}
# ---------- end steeringwheel_002 ----------
entwine = Entwine(Branch00=steeringwheel_001.A, Branch01=steeringwheel_001.B, Branch02=steeringwheel_001.C, FlattenInputs=True)
entwine_2 = Entwine(
    Branch00=steeringwheel_003.A,
    Branch01=steeringwheel_003.B,
    Branch02=steeringwheel_003.C,
    Branch03=steeringwheel_003.D,
    FlattenInputs=True)
entwine_3 = Entwine(
    Branch00=steeringwheel_004.A,
    Branch01=steeringwheel_004.B,
    Branch02=steeringwheel_004.C,
    Branch03=steeringwheel_004.D,
    FlattenInputs=True)
entwine_4 = Entwine(
    Branch00=steeringwheel_002.A,
    Branch01=steeringwheel_002.B,
    Branch02=steeringwheel_002.C,
    Branch03=steeringwheel_002.D,
    FlattenInputs=True)
geometry = Geometry(entwine_2)
geometry_2 = Geometry(entwine)
geometry_3 = Geometry(entwine_4)
geometry_4 = Geometry(entwine_3)
param_viewer = ParamViewer(geometry)
panel = Panel(geometry)
panel_2 = Panel(steeringwheel_003.out)
param_viewer_2 = ParamViewer(geometry_4)
param_viewer_3 = ParamViewer(geometry_2)
param_viewer_4 = ParamViewer(geometry_3)
panel_3 = Panel(geometry_2)
panel_4 = Panel(geometry_3)
panel_5 = Panel(geometry_4)
panel_6 = Panel(steeringwheel_001.out)
panel_7 = Panel(steeringwheel_002.out)
panel_8 = Panel(steeringwheel_004.out)
# Created at
# Wickerson Studios
# copyright 2024
# download all materials at
# www.wickersonstudios.com
# Parametric Steering Wheel from
# gpt Image Prompt
number_slider_25 = Slider(776, range=0..1000)
steeringwheel_005 = Script(
    outerDiameter=number_slider_25,
    innerDiameter=Slider(792, range=0..1000),
    thickness=Slider(100, range=0..100),
    numberOfSpokes=Slider(7, range=0..10),
    spokeWidth=Slider(25, range=0..100),
    handleDiameter=Slider(39, range=0..100),
    handleLength=Slider(118, range=0..1000),
    hubDiameter=Slider(208, range=0..1000))  # -> out, A, B, C, D; inputs outerDiameter: Double, innerDiameter: Double, thickness: Double, numberOfSpokes: Int32, spokeWidth: Double, handleDiameter: Double, handleLength: Double, hubDiameter: Double
# ---------- steeringwheel_005: C# ----------
// Grasshopper Script Instance
// #! csharp
using System;
using System.Collections.Generic;
using System.Drawing;

using Rhino;
using Rhino.Geometry;

using Grasshopper;
using Grasshopper.Kernel;
using Grasshopper.Kernel.Data;
using Grasshopper.Kernel.Types;

public class Script_Instance : GH_ScriptInstance
{
  private void RunScript(
	double outerDiameter,
	double innerDiameter,
	double thickness,
	int numberOfSpokes,
	double spokeWidth,
	double handleDiameter,
	double handleLength,
	double hubDiameter,
	ref object A,
	ref object B,
	ref object C,
	ref object D)
  {
    // Specified tolerances
    double tolerance = 0.01;
    double angleTolerance = RhinoMath.ToRadians(1);

    // Outputs
    A = null;
    B = null;
    C = null;
    D = null;

    // Parameters for the wheel
    // double outerDiameter = 1000;
    // double innerDiameter = 800;
    // double thickness = 100;
    // int numberOfSpokes = 6;
    // double spokeWidth = 50;
    // double handleDiameter = 40;
    // double handleLength = 150;
    // double hubDiameter = 200;

    // Create the outer ring as a torus
    var outerTorus = new Torus(Plane.WorldXY, outerDiameter / 2, thickness / 2).ToBrep();

    // Create the central hub as a cylinder
    var hubCylinder = new Cylinder(new Circle(Plane.WorldXY, hubDiameter / 2), thickness).ToBrep(true, true);

    // Create the spokes
    var spokes = new List<Brep>();
    for (int i = 0; i < numberOfSpokes; i++)
    {
      double angle = 2 * Math.PI / numberOfSpokes * i;
      spokes.Add(CreateSpoke(innerDiameter, hubDiameter, thickness, spokeWidth, angle));
    }

    // Create the handles
    var handles = new List<Brep>();
    for (int i = 0; i < numberOfSpokes; i++)
    {
      double angle = 2 * Math.PI / numberOfSpokes * i;
      handles.Add(CreateHandle(outerDiameter, thickness, handleDiameter, handleLength, angle));
    }

    // Combine all parts
    var allComponents = new List<Brep> { outerTorus, hubCylinder };
    allComponents.AddRange(spokes);
    allComponents.AddRange(handles);
    var joinedWheel = Brep.JoinBreps(allComponents, tolerance);

    // Assigning outputs
    A = joinedWheel; // The assembled wheel
    B = handles;     // The handles
    C = spokes;      // The spokes
    D = hubCylinder; // The hub
  }

  // <Custom additional code>
  private Brep CreateSpoke(double innerDiameter, double hubDiameter, double thickness, double width, double angle)
  {
    var innerRadius = hubDiameter / 2;
    var outerRadius = innerDiameter / 2;
    var innerPoint = new Point3d(Math.Cos(angle) * innerRadius, Math.Sin(angle) * innerRadius, 0);
    var outerPoint = new Point3d(Math.Cos(angle) * outerRadius, Math.Sin(angle) * outerRadius, 0);
    var perpVector = new Vector3d(-Math.Sin(angle), Math.Cos(angle), 0) * width / 2;

    var corners = new List<Point3d>
    {
      outerPoint + perpVector,
      outerPoint - perpVector,
      innerPoint - perpVector,
      innerPoint + perpVector,
      outerPoint + perpVector // Close the loop
    };

    var profile = new Polyline(corners).ToNurbsCurve();
    var extrusion = Extrusion.Create(profile, thickness, true);
    return extrusion.ToBrep(true);
  }

  private Brep CreateHandle(double outerDiameter, double thickness, double diameter, double length, double angle)
  {
    var radius = (outerDiameter / 2) + length;
    var basePoint = new Point3d(Math.Cos(angle) * radius, Math.Sin(angle) * radius, thickness / 2);
    var tangent = new Vector3d(-Math.Sin(angle), Math.Cos(angle), 0);
    var normal = new Vector3d(Math.Cos(angle), Math.Sin(angle), 0) * length;

    // Rotate the normal to get it perpendicular to the tangent
    normal.Rotate(Math.PI / 2, tangent);

    var handleCircle = new Circle(new Plane(basePoint, tangent, normal), diameter / 2);
    var handle = Extrusion.Create(handleCircle.ToNurbsCurve(), thickness, true).ToBrep();
    return handle;
  }
}
# ---------- end steeringwheel_005 ----------
entwine_5 = Entwine(
    Branch00=steeringwheel_005.A,
    Branch01=steeringwheel_005.B,
    Branch02=steeringwheel_005.C,
    Branch03=steeringwheel_005.D,
    FlattenInputs=True)
panel_9 = Panel(steeringwheel_005.out)
param_viewer_5 = ParamViewer(entwine_5)
panel_10 = Panel(entwine_5)
