# Grasshopper definition architecture_tower_001.gh (Grasshopper 1.0.8)
# plug-ins: RhinoCodePluginGH

number_slider = Slider(7.7, range=0..20)
number_slider_2 = Slider(101.9, range=0..200)
number_slider_3 = Slider(5, range=0..10)
number_slider_4 = Slider(25.9, range=0..100)
number_slider_5 = Slider(7.5, range=0..10)
number_slider_6 = Slider(19.5, range=0..100)
number_slider_7 = Slider(7.7, range=0..20)
number_slider_8 = Slider(101.9, range=0..200)
number_slider_9 = Slider(5, range=0..10)
number_slider_10 = Slider(25.9, range=0..100)
number_slider_11 = Slider(7.5, range=0..10)
number_slider_12 = Slider(19.5, range=0..100)
number_slider_13 = Slider(25.9, range=0..100)
number_slider_14 = Slider(10.9, range=0..20)
number_slider_15 = Slider(101.9, range=0..200)
number_slider_16 = Slider(5, range=0..10)
number_slider_17 = Slider(7.5, range=0..10)
number_slider_18 = Slider(19.5, range=0..100)
tower_003 = Script()  # -> out, A
# ---------- tower_003: C# ----------
// Grasshopper Script Instance
//#! csharp
using System;
using System.Collections.Generic;
using Rhino.Geometry;

public class Script_Instance : GH_ScriptInstance
{
  private void RunScript(object x, object y, ref object A)
  {
    // List to store the tower geometry
    List<Brep> towerBreps = new List<Brep>();

    // Parameters for the overall tower form
    double baseWidth = 20; // Base width of the tower, adjust as necessary
    double towerHeight = 50; // Total height of the tower, adjust as necessary
    int tierCount = 4; // Typical for Eiffel Tower
    double taperRatio = 0.75; // Tapering of each tier
    double curveFactor = 0.2; // Factor of curvature for the legs

    Point3d basePoint = Point3d.Origin;
    double currentLevelHeight = 0;

    for (int i = 0; i < tierCount; i++)
    {
      // Compute tier dimensions
      double tierWidth = baseWidth * Math.Pow(taperRatio, i);
      double tierHeight = towerHeight / tierCount;

      // Create curves for the tower legs
      var curves = new List<Curve>();
      for (int j = 0; j < 4; j++)
      {
        Point3d startPoint = new Point3d(
          basePoint.X + Math.Cos(j * Math.PI / 2) * tierWidth / 2,
          basePoint.Y + Math.Sin(j * Math.PI / 2) * tierWidth / 2,
          currentLevelHeight
        );
        Point3d endPoint = new Point3d(
          basePoint.X + Math.Cos(j * Math.PI / 2) * tierWidth / 2 * taperRatio,
          basePoint.Y + Math.Sin(j * Math.PI / 2) * tierWidth / 2 * taperRatio,
          currentLevelHeight + tierHeight
        );

        // Midpoint for defining arc bulge
        Point3d midPoint = new Point3d(
          (startPoint.X + endPoint.X) / 2,
          (startPoint.Y + endPoint.Y) / 2,
          (startPoint.Z + endPoint.Z) / 2
        );

        // Vector from midpoint towards bulge point
        Vector3d bulgeDirection = new Vector3d(
          basePoint.X - midPoint.X,
          basePoint.Y - midPoint.Y,
          0
        );
        bulgeDirection.Unitize(); // Normalize the direction vector
        bulgeDirection *= tierWidth * curveFactor; // Scale by the bulge factor

        // Bulge point
        Point3d bulgePoint = midPoint + bulgeDirection;

        // Create the arc
        Arc arc = new Arc(startPoint, bulgePoint, endPoint);
        Curve legCurve = arc.ToNurbsCurve();
        curves.Add(legCurve);
      }

      // Loft the curves to form the legs
      Brep[] legs = Brep.CreateFromLoft(curves, Point3d.Unset, Point3d.Unset, LoftType.Straight, true);

      // Add the leg geometry to the tower geometry
      foreach (Brep leg in legs)
      {
        towerBreps.Add(leg);
      }

      // Update current level height
      currentLevelHeight += tierHeight;
    }

    // Outputs
    A = towerBreps;
  }

  // <Custom additional code> 

  // </Custom additional code> 
}
# ---------- end tower_003 ----------
tower_001 = Script()  # -> out, A
# ---------- tower_001: C# ----------
// Grasshopper Script Instance
//#! csharp
using System;
using System.Collections.Generic;
using Rhino.Geometry;

public class Script_Instance : GH_ScriptInstance
{
  private void RunScript(object x, object y, ref object A)
  {
    // List to store the separate tier geometry
    List<Brep> towerTiers = new List<Brep>();

    // Parameters to define the tower (adjust these based on your model)
    double baseWidth = 10; // Base width of the tower
    double tierHeight = 5; // Height of each tier
    double taperRatio = 0.9; // Tapering ratio for each subsequent tier
    int tierCount = 4; // Number of tiers

    // Starting point for the tower base
    Point3d basePoint = new Point3d(0, 0, 0);

    // Create each tier of the tower
    for(int i = 0; i < tierCount; i++)
    {
      // Calculate the size of the tier
      double currentWidth = baseWidth * Math.Pow(taperRatio, i);
      double currentHeight = tierHeight;

      // Create the base rectangle for the tier
      Rectangle3d baseRectangle = new Rectangle3d(Plane.WorldXY, currentWidth, currentWidth);
      baseRectangle.Transform(Transform.Translation(0, 0, i * tierHeight));

      // Extrude the base rectangle to create the tier
      Extrusion tierExtrusion = Extrusion.Create(baseRectangle.ToNurbsCurve(), currentHeight, true);

      // Add the tier Brep to the list
      towerTiers.Add(tierExtrusion.ToBrep());
    }

    // Output the individual tier geometry
    A = towerTiers;
  }

  // <Custom additional code> 

  // </Custom additional code> 
}
# ---------- end tower_001 ----------
tower_002 = Script()  # -> out, A; inputs x: Double
# ---------- tower_002: C# ----------
// Grasshopper Script Instance
//#! csharp
using System;
using System.Collections.Generic;
using Rhino.Geometry;

public class Script_Instance : GH_ScriptInstance
{
  private void RunScript(double x, object y, ref object A)
  {
    // List to store the separate tier geometry
    List<Brep> towerTiers = new List<Brep>();

    // Parameters to define the tower (adjust these based on your model)
    double baseWidth = 10; // Base width of the tower
    double tierHeight = 5; // Height of each tier
    double taperRatio = 0.9; // Tapering ratio for each subsequent tier
    int tierCount = 4; // Number of tiers

    // Starting point for the tower base
    Point3d basePoint = new Point3d(0, 0, 0);

    // Height accumulator to keep track of the total height as we stack tiers
    double heightAccumulator = 0;

    // Create each tier of the tower
    for (int i = 0; i < tierCount; i++)
    {
      // Calculate the size of the tier
      double currentWidth = baseWidth * Math.Pow(taperRatio, i);
      double currentHeight = tierHeight;

      // Center the base point for the current tier
      double offset = (baseWidth - currentWidth) / 2; // Calculate the offset to center the tier
      Point3d tierBasePoint = new Point3d(basePoint.X + offset, basePoint.Y + offset, heightAccumulator);

      // Create the base rectangle for the tier
      Rectangle3d baseRectangle = new Rectangle3d(new Plane(tierBasePoint, Vector3d.ZAxis), currentWidth, currentWidth);

      // Extrude the base rectangle to create the tier
      Extrusion tierExtrusion = Extrusion.Create(baseRectangle.ToNurbsCurve(), currentHeight, true);

      // Add the tier Brep to the list
      towerTiers.Add(tierExtrusion.ToBrep());

      // Update the height accumulator
      heightAccumulator += currentHeight;
    }

    // Output the individual tier geometry
    A = towerTiers;
  }

  // <Custom additional code> 

  // </Custom additional code> 
}
# ---------- end tower_002 ----------
panel = Panel(tower_003.out)
panel_2 = Panel(tower_003.A)
panel_3 = Panel(tower_002.out)
panel_4 = Panel(tower_002.A)
panel_5 = Panel(tower_001.out)
panel_6 = Panel(tower_001.A)
# Created at
# Wickerson Studios
# copywrite 2024
# download all materials at
# www.wickersonstudios.com
# Parametric Tower from
# gpt Image Prompt
number_slider_19 = Slider(18.7, range=0..20)
tower_003_2 = Script(
    baseWidth=number_slider_19,
    towerHeight=Slider(55.8, range=0..200),
    tierCount=Slider(4, range=0..10),
    taperRatio=Slider(0.69, range=0..1),
    curveFactor=Slider(0.193, range=0..1))  # -> out, A; inputs baseWidth: Double, towerHeight: Double, tierCount: Int32, taperRatio: Double, curveFactor: Double
# ---------- tower_003_2: C# ----------
// Grasshopper Script Instance
//#! csharp
using System;
using System.Collections.Generic;
using Rhino.Geometry;

public class Script_Instance : GH_ScriptInstance
{
  private void RunScript(
	double baseWidth,
	double towerHeight,
	int tierCount,
	double taperRatio,
	double curveFactor,
	ref object A)
  {
    // List to store the tower geometry
    List<Brep> towerBreps = new List<Brep>();

    // Parameters for the overall tower form
    //double baseWidth = 20; // Base width of the tower, adjust as necessary
    //double towerHeight = 50; // Total height of the tower, adjust as necessary
    //int tierCount = 4; // Typical for Eiffel Tower
    //double taperRatio = 0.75; // Tapering of each tier
    //double curveFactor = 0.2; // Factor of curvature for the legs

    Point3d basePoint = Point3d.Origin;
    double currentLevelHeight = 0;

    for (int i = 0; i < tierCount; i++)
    {
      // Compute tier dimensions
      double tierWidth = baseWidth * Math.Pow(taperRatio, i);
      double tierHeight = towerHeight / tierCount;

      // Create curves for the tower legs
      var curves = new List<Curve>();
      for (int j = 0; j < 4; j++)
      {
        Point3d startPoint = new Point3d(
          basePoint.X + Math.Cos(j * Math.PI / 2) * tierWidth / 2,
          basePoint.Y + Math.Sin(j * Math.PI / 2) * tierWidth / 2,
          currentLevelHeight
        );
        Point3d endPoint = new Point3d(
          basePoint.X + Math.Cos(j * Math.PI / 2) * tierWidth / 2 * taperRatio,
          basePoint.Y + Math.Sin(j * Math.PI / 2) * tierWidth / 2 * taperRatio,
          currentLevelHeight + tierHeight
        );

        // Midpoint for defining arc bulge
        Point3d midPoint = new Point3d(
          (startPoint.X + endPoint.X) / 2,
          (startPoint.Y + endPoint.Y) / 2,
          (startPoint.Z + endPoint.Z) / 2
        );

        // Vector from midpoint towards bulge point
        Vector3d bulgeDirection = new Vector3d(
          basePoint.X - midPoint.X,
          basePoint.Y - midPoint.Y,
          0
        );
        bulgeDirection.Unitize(); // Normalize the direction vector
        bulgeDirection *= tierWidth * curveFactor; // Scale by the bulge factor

        // Bulge point
        Point3d bulgePoint = midPoint + bulgeDirection;

        // Create the arc
        Arc arc = new Arc(startPoint, bulgePoint, endPoint);
        Curve legCurve = arc.ToNurbsCurve();
        curves.Add(legCurve);
      }

      // Loft the curves to form the legs
      Brep[] legs = Brep.CreateFromLoft(curves, Point3d.Unset, Point3d.Unset, LoftType.Straight, true);

      // Add the leg geometry to the tower geometry
      foreach (Brep leg in legs)
      {
        towerBreps.Add(leg);
      }

      // Update current level height
      currentLevelHeight += tierHeight;
    }

    // Outputs
    A = towerBreps;
  }

  // <Custom additional code> 

  // </Custom additional code> 
}
# ---------- end tower_003_2 ----------
panel_7 = Panel(tower_003_2.out)
panel_8 = Panel(tower_003_2.A)
