# Grasshopper definition architecture_vase_001.gh (Grasshopper 1.0.8)
# plug-ins: RhinoCodePluginGH

number_slider = Slider(25.9, range=0..100)
number_slider_2 = Slider(7.5, range=0..10)
number_slider_3 = Slider(10.9, range=0..20)
number_slider_4 = Slider(101.9, range=0..200)
number_slider_5 = Slider(5, range=0..10)
number_slider_6 = Slider(19.5, range=0..100)
number_slider_7 = Slider(25.9, range=0..100)
number_slider_8 = Slider(7.5, range=0..10)
number_slider_9 = Slider(19.5, range=0..100)
number_slider_10 = Slider(25.9, range=0..100)
number_slider_11 = Slider(7.5, range=0..10)
number_slider_12 = Slider(19.5, range=0..100)
number_slider_13 = Slider(10.9, range=0..20)
number_slider_14 = Slider(101.9, range=0..200)
number_slider_15 = Slider(5, range=0..10)
number_slider_16 = Slider(10.9, range=0..20)
number_slider_17 = Slider(101.9, range=0..200)
number_slider_18 = Slider(5, range=0..10)
parametricvase_001 = Script()  # -> out, A
# ---------- parametricvase_001: C# ----------
using System;
using System.Collections.Generic;
using Rhino.Geometry;

public class Script_Instance : GH_ScriptInstance
{
  private void RunScript(ref object A)
  {
    // Vase parameters
    double height = 10.0; // Vase height
    double bottomRadius = 3.0; // Bottom radius of the vase
    double topRadius = 1.5; // Top radius of the vase
    double curvature = 0.5; // Controls the curvature of the vase's profile
    int uCount = 20; // Number of grid divisions in the U direction (around the vase)
    int vCount = 30; // Number of grid divisions in the V direction (along the vase's height)

    // Create the vase profile curve
    Curve profile = CreateVaseProfile(height, bottomRadius, topRadius, curvature);

    // Revolve the profile curve to create a vase surface
    Brep vaseBrep = RevolveProfile(profile, height);

    // Generate grid and panels
    List<Brep> panels = CreateGridPanels(vaseBrep, uCount, vCount);

    A = panels;
  }

  // Method to create the vase profile curve
  Curve CreateVaseProfile(double height, double bottomRadius, double topRadius, double curvature)
  {
    var points = new List<Point3d>
    {
      new Point3d(0, 0, 0),
      new Point3d(bottomRadius, 0, height * curvature),
      new Point3d(topRadius, 0, height - height * curvature),
      new Point3d(0, 0, height)
    };

    return Curve.CreateControlPointCurve(points, 3);
  }

  // Method to revolve the profile curve and create the vase surface
  Brep RevolveProfile(Curve profile, double height)
  {
    Line axis = new Line(new Point3d(0, 0, 0), new Point3d(0, 0, height));
    var revolve = Brep.CreateFromRevSurface(RevSurface.Create(profile, axis), false, false);
    return revolve;
  }

  // Method to create the grid panels on the vase
  List<Brep> CreateGridPanels(Brep vaseBrep, int uCount, int vCount)
  {
    List<Brep> panels = new List<Brep>();

    // Get the surface from the Brep
    Surface vaseSurface = vaseBrep.Surfaces[0];

    // Divide the surface into a grid
    for (int u = 0; u < uCount; u++)
    {
      for (int v = 0; v < vCount; v++)
      {
        // Define the corner points of each grid cell
        double u0 = (double)u / uCount;
        double v0 = (double)v / vCount;
        double u1 = (double)(u + 1) / uCount;
        double v1 = (double)(v + 1) / vCount;

        // Create the four corners of the grid cell
        Point3d pt0 = vaseSurface.PointAt(u0, v0);
        Point3d pt1 = vaseSurface.PointAt(u1, v0);
        Point3d pt2 = vaseSurface.PointAt(u1, v1);
        Point3d pt3 = vaseSurface.PointAt(u0, v1);

        // Build the edges of the cell
        Curve edge0 = new LineCurve(pt0, pt1);
        Curve edge1 = new LineCurve(pt1, pt2);
        Curve edge2 = new LineCurve(pt2, pt3);
        Curve edge3 = new LineCurve(pt3, pt0);

        // Loft the curves to create the panel surface
        var loftSurfaces = Brep.CreateFromLoft(new List<Curve> { edge0, edge1, edge2, edge3 }, Point3d.Unset, Point3d.Unset, LoftType.Straight, false);

        // Add the panel to the list
        foreach (var loftSurface in loftSurfaces)
        {
          panels.Add(loftSurface);
        }
      }
    }

    return panels;
  }
}
# ---------- end parametricvase_001 ----------
parametricvase_002 = Script()  # -> out, A
# ---------- parametricvase_002: C# ----------
using System;
using System.Collections.Generic;
using Rhino.Geometry;

public class Script_Instance : GH_ScriptInstance
{
  private void RunScript(ref object A)
  {
    // Vase parameters
    double height = 10.0; // Vase height
    double bottomRadius = 3.0; // Bottom radius of the vase
    double topRadius = 1.5; // Top radius of the vase
    double curvature = 0.5; // Controls the curvature of the vase's profile
    int uCount = 20; // Number of grid divisions in the U direction (around the vase)
    int vCount = 30; // Number of grid divisions in the V direction (along the vase's height)

    // Create the vase profile curve
    Curve profile = CreateVaseProfile(height, bottomRadius, topRadius, curvature);

    // Revolve the profile curve to create a vase surface
    Brep vaseBrep = RevolveProfile(profile, height);

    // Generate grid and panels
    List<Brep> panels = CreateGridPanels(vaseBrep, uCount, vCount);

    // Rotate and duplicate the panels through a polar array around the Z-axis 8 times
    List<Brep> rotatedPanels = new List<Brep>();
    foreach (var panel in panels)
    {
      rotatedPanels.AddRange(CreatePolarArray(panel, 7, Math.PI * 2, new Vector3d(0, 0, 1)));
    }

    A = rotatedPanels;
  }

  // Method to create the vase profile curve
  Curve CreateVaseProfile(double height, double bottomRadius, double topRadius, double curvature)
  {
    var points = new List<Point3d>
    {
      new Point3d(0, 0, 0),
      new Point3d(bottomRadius, 0, height * curvature),
      new Point3d(topRadius, 0, height - height * curvature),
      new Point3d(0, 0, height)
    };

    return Curve.CreateControlPointCurve(points, 3);
  }

  // Method to revolve the profile curve and create the vase surface
  Brep RevolveProfile(Curve profile, double height)
  {
    Line axis = new Line(new Point3d(0, 0, 0), new Point3d(0, 0, height));
    return Brep.CreateFromRevSurface(RevSurface.Create(profile, axis), false, false);
  }

  // Method to create the grid panels on the vase
  List<Brep> CreateGridPanels(Brep vaseBrep, int uCount, int vCount)
  {
    List<Brep> panels = new List<Brep>();
    Surface vaseSurface = vaseBrep.Surfaces[0];

    for (int u = 0; u < uCount; u++)
    {
      for (int v = 0; v < vCount; v++)
      {
        double u0 = (double)u / uCount;
        double v0 = (double)v / vCount;
        double u1 = (double)(u + 1) / uCount;
        double v1 = (double)(v + 1) / vCount;

        Point3d pt0 = vaseSurface.PointAt(u0, v0);
        Point3d pt1 = vaseSurface.PointAt(u1, v0);
        Point3d pt2 = vaseSurface.PointAt(u1, v1);
        Point3d pt3 = vaseSurface.PointAt(u0, v1);

        Curve edge0 = new LineCurve(pt0, pt1);
        Curve edge1 = new LineCurve(pt1, pt2);
        Curve edge2 = new LineCurve(pt2, pt3);
        Curve edge3 = new LineCurve(pt3, pt0);

        var loftSurfaces = Brep.CreateFromLoft(new List<Curve> { edge0, edge1, edge2, edge3 }, Point3d.Unset, Point3d.Unset, LoftType.Straight, false);
        panels.AddRange(loftSurfaces);
      }
    }

    return panels;
  }

  // Method to create a polar array of the given geometry
  List<Brep> CreatePolarArray(Brep brep, int numberOfItems, double angle, Vector3d axis)
  {
    List<Brep> arrayItems = new List<Brep>();
    Point3d center = Point3d.Origin; // Center of rotation
    for (int i = 0; i < numberOfItems; i++)
    {
      double currentAngle = angle * i / numberOfItems;
      Transform rotation = Transform.Rotation(currentAngle, axis, center);
      Brep rotatedItem = brep.DuplicateBrep();
      rotatedItem.Transform(rotation);
      arrayItems.Add(rotatedItem);
    }
    return arrayItems;
  }
}
# ---------- end parametricvase_002 ----------
parametricvase_003 = Script()  # -> out, A
# ---------- parametricvase_003: C# ----------
using System;
using System.Collections.Generic;
using Rhino.Geometry;

public class Script_Instance : GH_ScriptInstance
{
  private void RunScript(ref object A)
  {
    // Vase parameters
    double height = 10.0; // Vase height
    double bottomRadius = 3.0; // Bottom radius of the vase
    double topRadius = 1.5; // Top radius of the vase
    double curvature = 0.5; // Controls the curvature of the vase's profile
    int uCount = 20; // Number of grid divisions in the U direction (around the vase)
    int vCount = 30; // Number of grid divisions in the V direction (along the vase's height)

    // Create the vase profile curve
    Curve profile = CreateVaseProfile(height, bottomRadius, topRadius, curvature);

    // Revolve the profile curve to create a vase surface
    Brep vaseBrep = RevolveProfile(profile, height);

    // Generate grid and panels with trigonometric pattern
    List<Brep> panels = CreateGridPanels(vaseBrep, uCount, vCount);

    // Rotate and duplicate the panels through a polar array around the Z-axis 8 times
    List<Brep> rotatedPanels = new List<Brep>();
    foreach (var panel in panels)
    {
      rotatedPanels.AddRange(CreatePolarArray(panel, 8, Math.PI * 2, new Vector3d(0, 0, 1)));
    }

    A = rotatedPanels;
  }

  Curve CreateVaseProfile(double height, double bottomRadius, double topRadius, double curvature)
  {
    var points = new List<Point3d>
    {
      new Point3d(0, 0, 0),
      new Point3d(bottomRadius, 0, height * curvature),
      new Point3d(topRadius, 0, height - height * curvature),
      new Point3d(0, 0, height)
    };

    return Curve.CreateControlPointCurve(points, 3);
  }

  Brep RevolveProfile(Curve profile, double height)
  {
    Line axis = new Line(new Point3d(0, 0, 0), new Point3d(0, 0, height));
    return Brep.CreateFromRevSurface(RevSurface.Create(profile, axis), false, false);
  }

  List<Brep> CreateGridPanels(Brep vaseBrep, int uCount, int vCount)
  {
    List<Brep> panels = new List<Brep>();
    Surface vaseSurface = vaseBrep.Surfaces[0];

    for (int u = 0; u < uCount; u++)
    {
      for (int v = 0; v < vCount; v++)
      {
        double u0 = (double)u / uCount;
        double v0 = (double)v / vCount;
        double u1 = (double)(u + 1) / uCount;
        double v1 = (double)(v + 1) / vCount;

        // Apply trigonometric transformations to the points
        Point3d pt0 = TransformPoint(vaseSurface.PointAt(u0, v0), u, v, uCount, vCount);
        Point3d pt1 = TransformPoint(vaseSurface.PointAt(u1, v0), u, v, uCount, vCount);
        Point3d pt2 = TransformPoint(vaseSurface.PointAt(u1, v1), u, v, uCount, vCount);
        Point3d pt3 = TransformPoint(vaseSurface.PointAt(u0, v1), u, v, uCount, vCount);

        Curve edge0 = new LineCurve(pt0, pt1);
        Curve edge1 = new LineCurve(pt1, pt2);
        Curve edge2 = new LineCurve(pt2, pt3);
        Curve edge3 = new LineCurve(pt3, pt0);

        var loftSurfaces = Brep.CreateFromLoft(new List<Curve> { edge0, edge1, edge2, edge3 }, Point3d.Unset, Point3d.Unset, LoftType.Straight, false);
        panels.AddRange(loftSurfaces);
      }
    }

    return panels;
  }

  Point3d TransformPoint(Point3d point, int u, int v, int uCount, int vCount)
  {
    // Applying a trigonometric transformation to the point
    double frequencyU = 3.0; // Frequency for U direction
    double frequencyV = 5.0; // Frequency for V direction
    double amplitudeU = 0.1; // Amplitude for U direction
    double amplitudeV = 0.1; // Amplitude for V direction

    double uOffset = amplitudeU * Math.Sin(2 * Math.PI * frequencyU * u / uCount);
    double vOffset = amplitudeV * Math.Cos(2 * Math.PI * frequencyV * v / vCount);

    return new Point3d(point.X + uOffset, point.Y + vOffset, point.Z);
  }

  List<Brep> CreatePolarArray(Brep brep, int numberOfItems, double angle, Vector3d axis)
  {
    List<Brep> arrayItems = new List<Brep>();
    Point3d center = Point3d.Origin;
    for (int i = 0; i < numberOfItems; i++)
    {
      double currentAngle = angle * i / numberOfItems;
      Transform rotation = Transform.Rotation(currentAngle, axis, center);
      Brep rotatedItem = brep.DuplicateBrep();
      rotatedItem.Transform(rotation);
      arrayItems.Add(rotatedItem);
    }
    return arrayItems;
  }
}
# ---------- end parametricvase_003 ----------
geometry = Geometry(parametricvase_003.A)
geometry_2 = Geometry(parametricvase_001.A)
geometry_3 = Geometry(parametricvase_002.A)
param_viewer = ParamViewer(geometry)
panel = Panel(parametricvase_003.out)
panel_2 = Panel(geometry)
param_viewer_2 = ParamViewer(geometry_2)
param_viewer_3 = ParamViewer(geometry_3)
panel_3 = Panel(geometry_2)
panel_4 = Panel(geometry_3)
panel_5 = Panel(parametricvase_001.out)
panel_6 = Panel(parametricvase_002.out)
# Created at
# Wickerson Studios
# copyright 2024
# download all materials at
# www.wickersonstudios.com
# Parametric Parametric Vase from
# gpt Image Prompt
number_slider_19 = Slider(10, range=0..10)
parametricvase_004 = Script(
    height=number_slider_19,
    bottomRadius=Slider(3, range=0..10),
    topRadius=Slider(4.3, range=0..10),
    curvature=Slider(0.8, range=0..1),
    uCount=Slider(3, range=0..10),
    vCount=Slider(4, range=0..10),
    frequencyU=Slider(3, range=0..10),
    frequencyV=Slider(5, range=0..10),
    amplitudeU=Slider(0.247, range=0..1),
    amplitudeV=Slider(0.583, range=0..1))  # -> out, A; inputs height: Double, bottomRadius: Double, topRadius: Double, curvature: Double, uCount: Int32, vCount: Int32, frequencyU: Double, frequencyV: Double, amplitudeU: Double, amplitudeV: Double
# ---------- parametricvase_004: C# ----------
using System;
using System.Collections.Generic;
using Rhino.Geometry;

public class Script_Instance : GH_ScriptInstance
{
  private void RunScript(
	double height,
	double bottomRadius,
	double topRadius,
	double curvature,
	int uCount,
	int vCount,
	double frequencyU,
	double frequencyV,
	double amplitudeU,
	double amplitudeV,
	ref object A)
  {
    // Vase parameters
    // double height = 10.0; // Vase height
    // double bottomRadius = 3.0; // Bottom radius of the vase
    // double topRadius = 1.5; // Top radius of the vase
    // double curvature = 0.5; // Controls the curvature of the vase's profile
    // int uCount = 20; // Number of grid divisions in the U direction (around the vase)
    // int vCount = 30; // Number of grid divisions in the V direction (along the vase's height)

    // Create the vase profile curve
    Curve profile = CreateVaseProfile(height, bottomRadius, topRadius, curvature);

    // Revolve the profile curve to create a vase surface
    Brep vaseBrep = RevolveProfile(profile, height);

    // Generate grid and panels with trigonometric pattern
    List<Brep> panels = CreateGridPanels(vaseBrep, uCount, vCount);

    // Rotate and duplicate the panels through a polar array around the Z-axis 8 times
    List<Brep> rotatedPanels = new List<Brep>();
    foreach (var panel in panels)
    {
      rotatedPanels.AddRange(CreatePolarArray(panel, 8, Math.PI * 2, new Vector3d(0, 0, 1)));
    }

    A = rotatedPanels;
  }

  Curve CreateVaseProfile(double height, double bottomRadius, double topRadius, double curvature)
  {
    var points = new List<Point3d>
    {
      new Point3d(0, 0, 0),
      new Point3d(bottomRadius, 0, height * curvature),
      new Point3d(topRadius, 0, height - height * curvature),
      new Point3d(0, 0, height)
    };

    return Curve.CreateControlPointCurve(points, 3);
  }

  Brep RevolveProfile(Curve profile, double height)
  {
    Line axis = new Line(new Point3d(0, 0, 0), new Point3d(0, 0, height));
    return Brep.CreateFromRevSurface(RevSurface.Create(profile, axis), false, false);
  }

  List<Brep> CreateGridPanels(Brep vaseBrep, int uCount, int vCount)
  {
    List<Brep> panels = new List<Brep>();
    Surface vaseSurface = vaseBrep.Surfaces[0];

    for (int u = 0; u < uCount; u++)
    {
      for (int v = 0; v < vCount; v++)
      {
        double u0 = (double)u / uCount;
        double v0 = (double)v / vCount;
        double u1 = (double)(u + 1) / uCount;
        double v1 = (double)(v + 1) / vCount;

        // Apply trigonometric transformations to the points
        Point3d pt0 = TransformPoint(vaseSurface.PointAt(u0, v0), u, v, uCount, vCount);
        Point3d pt1 = TransformPoint(vaseSurface.PointAt(u1, v0), u, v, uCount, vCount);
        Point3d pt2 = TransformPoint(vaseSurface.PointAt(u1, v1), u, v, uCount, vCount);
        Point3d pt3 = TransformPoint(vaseSurface.PointAt(u0, v1), u, v, uCount, vCount);

        Curve edge0 = new LineCurve(pt0, pt1);
        Curve edge1 = new LineCurve(pt1, pt2);
        Curve edge2 = new LineCurve(pt2, pt3);
        Curve edge3 = new LineCurve(pt3, pt0);

        var loftSurfaces = Brep.CreateFromLoft(new List<Curve> { edge0, edge1, edge2, edge3 }, Point3d.Unset, Point3d.Unset, LoftType.Straight, false);
        panels.AddRange(loftSurfaces);
      }
    }

    return panels;
  }

  Point3d TransformPoint(Point3d point, int u, int v, int uCount, int vCount)
  {
    // Applying a trigonometric transformation to the point
    double frequencyU = 3.0; // Frequency for U direction
    double frequencyV = 5.0; // Frequency for V direction
    double amplitudeU = 0.1; // Amplitude for U direction
    double amplitudeV = 0.1; // Amplitude for V direction

    double uOffset = amplitudeU * Math.Sin(2 * Math.PI * frequencyU * u / uCount);
    double vOffset = amplitudeV * Math.Cos(2 * Math.PI * frequencyV * v / vCount);

    return new Point3d(point.X + uOffset, point.Y + vOffset, point.Z);
  }

  List<Brep> CreatePolarArray(Brep brep, int numberOfItems, double angle, Vector3d axis)
  {
    List<Brep> arrayItems = new List<Brep>();
    Point3d center = Point3d.Origin;
    for (int i = 0; i < numberOfItems; i++)
    {
      double currentAngle = angle * i / numberOfItems;
      Transform rotation = Transform.Rotation(currentAngle, axis, center);
      Brep rotatedItem = brep.DuplicateBrep();
      rotatedItem.Transform(rotation);
      arrayItems.Add(rotatedItem);
    }
    return arrayItems;
  }
}
# ---------- end parametricvase_004 ----------
geometry_4 = Geometry(parametricvase_004.A)
panel_7 = Panel(parametricvase_004.out)
param_viewer_4 = ParamViewer(geometry_4)
panel_8 = Panel(geometry_4)
